# Dynamo custom node 3DView.BoundryBox.dyf (Dynamo 1.3.2.2480)
# category: Dan's Nodes
# Takes in a 3D View and outputs the views scope box as a boundry box

n3DView = Input(3DView)
create = List.Create(n3DView, n3DView)

# group: Multiple views
python_script = Python(IN[0]=create)
# ---------- python_script.python (60 lines) ----------
import clr
clr.AddReference('ProtoGeometry')
from Autodesk.DesignScript.Geometry import *

clr.AddReference("RevitNodes")
import Revit
clr.ImportExtensions(Revit.Elements)

clr.AddReference("RevitServices")
import RevitServices
from RevitServices.Persistence import DocumentManager
from RevitServices.Transactions import TransactionManager

from System.Collections.Generic import *

clr.AddReference("RevitAPI")
import Autodesk
from Autodesk.Revit.DB import *

clr.ImportExtensions(Revit.GeometryConversion)

doc = DocumentManager.Instance.CurrentDBDocument
uiapp = DocumentManager.Instance.CurrentUIApplication
app = uiapp.Application


views = UnwrapElement(IN[0])

TransactionManager.Instance.EnsureInTransaction(doc)

viewlist = []
sectionboxes = []
floors = []
floorboxes = []

for view in views:
	viewlist.append(view)
	sectionbox = view.GetSectionBox()
	transform = sectionbox.Transform
	sboxoriginx = transform.Origin.X
	sboxoriginy = transform.Origin.Y
	sboxoriginz = transform.Origin.Z
	minx = sectionbox.Min.X + sboxoriginx
	maxx = sectionbox.Max.X + sboxoriginx
	miny = sectionbox.Min.Y + sboxoriginy
	maxy = sectionbox.Max.Y + sboxoriginy
	minz = sectionbox.Min.Z + sboxoriginz
	maxz = sectionbox.Max.Z + sboxoriginz
	bbox = BoundingBoxXYZ()
	bbox.Min = XYZ((minx), (miny), (minz))
	bbox.Max = XYZ((maxx), (maxy), (maxz))
	tsectionbox = bbox.ToProtoType()
	sectionboxes.append(tsectionbox)
	collector = FilteredElementCollector(doc, view.Id)
	floor = collector.OfClass(Floor).ToElements()
	floors.append(floor)

TransactionManager.Instance.TransactionTaskDone()

OUT = views, sectionboxes, floors
# ----------------------------------------

code_block = CodeBlock { 1; }
getItemAtIndex = List.GetItemAtIndex(list=python_script, index=code_block)
code_block_2 = CodeBlock { 0; }
getItemAtIndex_2 = List.GetItemAtIndex(list=getItemAtIndex, index=code_block_2)
Output = Output(getItemAtIndex_2)  # ""
