# Dynamo custom node Readme.dyf "Install or Update Orchid" (Dynamo 1.3.0.875)
# category: Orchid
# How to install or update the Orchid package?
# Add a watch node to read the instruction, a web browser has opened the Github link for you. If not, then rerun the graph once more.

python_script = Python()
# ---------- python_script.python (6 lines) ----------
# Set sys.path
import sys
sys.path.insert(0, 'C:\Program files (x86)\IronPython 2.7\Lib')
import webbrowser
url = "https://github.com/erfajo/OrchidForDynamo"
webbrowser.open_new(url)
# ----------------------------------------
code_block = CodeBlock()
# ---------- code_block.designscript (18 lines) ----------
"
This package must be obtained from Github at
https://github.com/erfajo/OrchidForDynamo

Clone or zip the repository and copy the
content hereof into your package folder path
into the 'Orchid' folder!

The package folder path can be found via
the menu item
'Settings' -> 'Manage Node and Package Paths'

From the content may the following
root files be deleted:
LICENSE
README.md
.gitignore
";
# ----------------------------------------
create = List.Create(python_script, code_block)
lastItem = List.LastItem(create)
Watch = Output(lastItem)
