# Dynamo custom node RIE.AllElementsOfFamilyType.dyf (Dynamo 1.3.3.4651)
# category: RIE.Elements
# Retrieves all element of input family type, also works for links.

familyType = Input(familyType : FamilyType)
LinkOptional = Input(LinkOptional : var = null)
linkDocFromLink = Custom[RIE.LinkDocFromLink](LinkInstance=LinkOptional)  # Retrieves link Document element from link element.
python_script = Python(IN[0]=familyType, IN[1]=linkDocFromLink)
# ---------- python_script.python (39 lines) ----------
import System
import clr
clr.AddReference('RevitAPI')
from Autodesk.Revit.DB import *

clr.AddReference("RevitServices")
import RevitServices
from RevitServices.Persistence import DocumentManager

def tolist(obj):
	if isinstance(obj, list):
		return UnwrapElement(obj)
	else:
		return [UnwrapElement(obj)]
		
doc = DocumentManager.Instance.CurrentDBDocument

if not IN[1] == None:
	doc = UnwrapElement(IN[1])

famtypes = tolist(IN[0])
OUT = []

elementlist = list()
for ft in famtypes:
	collector = FilteredElementCollector(doc)
	bic = System.Enum.ToObject(BuiltInCategory, ft.Category.Id.IntegerValue)
	collector.OfCategory(bic)
	# This is a workaround
	# because I was to lazy to learn
	# how to implement LINQ in Python
	ftlist =  list()
	for item in collector.ToElements():
		if item.GetTypeId().IntegerValue == ft.Id.IntegerValue:
			ftlist.append(item)
	elementlist.append(ftlist)
OUT = elementlist
if len(OUT) == 1:
	OUT = OUT[0]
# ----------------------------------------
Elements = Output(python_script)
