# Dynamo custom node RIE.BBox.Translate.dyf (Dynamo 1.3.3.4651)
# category: RIE.Geometry
# Translate boundingbox by distance and direction

BBox = Input(BBox : BoundingBox)
minPoint = BoundingBox.MinPoint(BBox)
maxPoint = BoundingBox.MaxPoint(BBox)
byStartPointEndPoint = Line.ByStartPointEndPoint(startPoint=minPoint, endPoint=maxPoint)
direction = Input(direction : Vector)
distance = Input(distance : double)
translate = Geometry.Translate(geometry=byStartPointEndPoint, direction=direction, distance=distance)
startPoint = Curve.StartPoint(translate)
endPoint = Curve.EndPoint(translate)
byCorners = BoundingBox.ByCorners(min=startPoint, max=endPoint)
BBox_2 = Output(byCorners)  # "BBox"
