# Dynamo custom node RIE.BBoxCenterPoint.dyf (Dynamo 1.3.3.4651)
# category: RIE.Geometry
# Returns centerpoint of boundinbox.

BBox = Input()
code_block = CodeBlock(BBox=BBox) { BBox; }
maxPoint = BoundingBox.MaxPoint(code_block)
deconstructPoint = Custom[RIE.DeconstructPoint](Point=maxPoint)  # Deconstructs points into their X, Y and Z values. Idea stolen from Lunchbox's equivalent node.
minPoint = BoundingBox.MinPoint(code_block)
deconstructPoint_2 = Custom[RIE.DeconstructPoint](Point=minPoint)
code_block_2 = CodeBlock(a=deconstructPoint.X, b=deconstructPoint_2.X) { (a+b)/2; }
code_block_3 = CodeBlock(a=deconstructPoint.Y, b=deconstructPoint_2.Y) { (a+b)/2; }
code_block_4 = CodeBlock(a=deconstructPoint.Z, b=deconstructPoint_2.Z) { (a+b)/2; }
byCoordinates = Point.ByCoordinates(x=code_block_2, y=code_block_3, z=code_block_4)
Point = Output(byCoordinates)
