# Dynamo custom node RIE.BoundingBox.Expand.dyf (Dynamo 1.3.3.4651)
# category: RIE.Geometry
# Expands the input boundingbox by given input amount

BBox = Input()
minPoint = BoundingBox.MinPoint(BBox)
maxPoint = BoundingBox.MaxPoint(BBox)
create = List.Create(minPoint, maxPoint)
transpose = List.Transpose(create)
XAxis = Vector.XAxis()
reverse = Vector.Reverse(XAxis)
YAxis = Vector.YAxis()
reverse_2 = Vector.Reverse(YAxis)
ZAxis = Vector.ZAxis()
reverse_3 = Vector.Reverse(ZAxis)
join = List.Join(XAxis, reverse, YAxis, reverse_2, ZAxis, reverse_3)
Amount = Input()
byStartPointDirectionLength = Line.ByStartPointDirectionLength(startPoint=transpose@L2, direction=join, length=Amount, lacing=CrossProduct)
flatten = Flatten()  # unwired: arg0
map = List.Map(list=byStartPointDirectionLength, f_x=flatten)
byGeometry = BoundingBox.ByGeometry(map)
BBox_2 = Output(byGeometry)  # "BBox"
