# Dynamo custom node RIE.BuiltinCategoryFromCategory.dyf "RIE.BuildinCategoryFromCategory" (Dynamo 1.3.3.4651)
# category: RIE.Elements
# Returns the OST builtincategory from input category.

Cat = Input()
python_script = Python(IN[0]=Cat)
# ---------- python_script.python (35 lines) ----------
import clr
import System
clr.AddReference('RevitAPI')
clr.AddReference('RevitAPIUI')
from Autodesk.Revit.DB import *
import Autodesk
clr.AddReference("RevitNodes")
import Revit

def tolist(obj):
	if isinstance(obj, list):
		return UnwrapElement(obj)
	else:
		return [UnwrapElement(obj)]

bics = System.Enum.GetValues(BuiltInCategory)
cdata = list()
for bic in bics:
	try:
		cdata.append((bic,Revit.Elements.Category.ById(ElementId(bic).IntegerValue)))
	except:
		pass
		
cat = []
OUT = []
		
for cats in tolist(IN[0]):
	cat.append(cats.Name.ToString())

for i in cdata:
	if i[1].ToString() in cat:
		OUT.append(i[0])
		
if len(OUT) == 1:
	OUT = OUT[0]
# ----------------------------------------
Bic = Output(python_script)
