# Dynamo custom node RIE.CreateSheets.dyf (Dynamo 1.3.3.4651)
# category: RIE.Views
# Create sheets with inputs; Sheet Name, Number and Titleblock

SheetName = Input()
SheetNumber = Input()
TitleBlock = Input()
name_number_titleblock = Python(IN[0]=SheetName, IN[1]=SheetNumber, IN[2]=TitleBlock)
# ---------- name_number_titleblock.python (49 lines) ----------
#Make Sheets
import clr
clr.AddReference('RevitAPI')
from Autodesk.Revit.DB import *

clr.AddReference("RevitNodes")
import Revit
clr.ImportExtensions(Revit.Elements)

clr.AddReference("RevitServices")
import RevitServices
from RevitServices.Persistence import DocumentManager
from RevitServices.Transactions import TransactionManager

def tolist(obj):
	if isinstance(obj, list):
		return UnwrapElement(obj)
	else:
		return [UnwrapElement(obj)]


doc = DocumentManager.Instance.CurrentDBDocument
sheetnames = tolist(IN[0])
sheetnumbers = tolist(IN[1])
titleblock = tolist(IN[2]) #unwrapped titleblock
sheetlist = []
notcreated = []


TransactionManager.Instance.EnsureInTransaction(doc) # you need an active transaction as you will create elements
 

for number in range(len(sheetnumbers)):
	if len(titleblock) > 1:
		newsheet = ViewSheet.Create(doc,titleblock[number].Id) # create a new sheet where titleblock.Id is the id of the titleblock
	else:
		newsheet = ViewSheet.Create(doc,titleblock[0].Id) # create a new sheet where titleblock.Id is the id of the titleblock
	newsheet.Name = sheetnames[number]
	try:
		newsheet.SheetNumber = sheetnumbers[number]
		sheetlist.append(newsheet.ToDSType(False))
	except:
		notcreated.append(number) 
		doc.Delete(newsheet.Id)


	
TransactionManager.Instance.TransactionTaskDone()
OUT = sheetlist, notcreated
# ----------------------------------------
code_block = CodeBlock(a=name_number_titleblock) { a[0]; a[1]; }
Sheets = Output(code_block.out0)
FailedIndices = Output(code_block.out1)
