# Dynamo custom node RIE.ElectricalCategories.dyf (Dynamo 1.3.3.4651)
# category: RIE.Elements
# Retrieves all categories relevant for electrical installations.

categories = Categories("CommunicationDevices")
categories_2 = Categories("DataDevices")
categories_3 = Categories("ElectricalFixtures")
categories_4 = Categories("ElectricalEquipment")
categories_5 = Categories("FireAlarmDevices")
categories_6 = Categories("LightingDevices")
categories_7 = Categories("LightingFixtures")
categories_8 = Categories("NurseCallDevices")
categories_9 = Categories("SecurityDevices")
categories_10 = Categories("TelephoneDevices")
create = List.Create(categories, categories_2, categories_3, categories_4, categories_5, categories_6, categories_7, categories_8, categories_9, categories_10)
Objects = Output(create)
categories_11 = Categories("Conduit")
categories_12 = Categories("ConduitFitting")
categories_13 = Categories("CableTray")
categories_14 = Categories("CableTrayFitting")
# note: Courtesy of Rune Haugland
create_2 = List.Create(categories_11, categories_12, categories_13, categories_14)
Runs = Output(create_2)
