# Dynamo custom node RIE.Element.SpaceAndRoom.dyf (Dynamo 1.3.3.4651)
# category: RIE.Elements
# Gets the Spaces and Rooms containing the input  list of Elements

Elements = Input()
LinkOptional = Input(LinkOptional : var = null)  # Optional. If no Link Instance is input, Current Document will be used.
linkDocFromLink = Custom[RIE.LinkDocFromLink](LinkInstance=LinkOptional)  # Retrieves link Document element from link element.
python_script = Python(IN[0]=Elements, IN[1]=linkDocFromLink)
# ---------- python_script.python (62 lines) ----------
import clr
clr.AddReference('ProtoGeometry')
from Autodesk.DesignScript.Geometry import *

clr.AddReference('RevitServices')
import RevitServices
from RevitServices.Persistence import DocumentManager
from RevitServices.Transactions import TransactionManager
from System.Collections.Generic import *

clr.AddReference('RevitNodes')
import Revit
clr.ImportExtensions(Revit.Elements)
clr.ImportExtensions(Revit.GeometryConversion)

clr.AddReference('RevitAPI')
import Autodesk
from Autodesk.Revit.DB import *
from Autodesk.Revit.DB.Electrical import *

clr.AddReference('DSCoreNodes')
import DSCore
from DSCore.List import *

import sys
pyt_path = r'C:\Program Files (x86)\IronPython 2.7\Lib'
sys.path.append(pyt_path)

doc = DocumentManager.Instance.CurrentDBDocument
if IN[1] != None:
	doc = IN[1]
uiapp = DocumentManager.Instance.CurrentUIApplication
app = uiapp.Application
uidoc = DocumentManager.Instance.CurrentUIApplication.ActiveUIDocument

OUT = []
spaces = []
rooms = []
pointlist = []

def tolist(obj):
	if isinstance(obj,list):
		return obj
	else:
		return [obj]

for _ in tolist(IN[0]):
	ele = UnwrapElement(_)
	pointlist.append(ele.Location.Point)

for _ in pointlist:
	pt = UnwrapElement(_)
	if doc.GetSpaceAtPoint(pt) == None:
		spaces.append("No Space")
	else:
		spaces.append(doc.GetSpaceAtPoint(pt))
	if doc.GetRoomAtPoint(pt) == None:
		rooms.append("No Room")
	else:
		rooms.append(doc.GetRoomAtPoint(pt))

OUT = spaces, rooms
# ----------------------------------------
code_block = CodeBlock(a=python_script) { a[0]; a[1]; }
Spaces = Output(code_block.out0)
Rooms = Output(code_block.out1)
