# Dynamo custom node RIE.ElementsByView.dyf (Dynamo 1.3.3.4651)
# category: RIE.Elements
# Selects elements that are visible in input view. Forked from Marc.
# Tags : Elements by view

Views = Input()
elements_in_views = Python(IN[0]=Views)
# ---------- elements_in_views.python (28 lines) ----------
#Made by Marc Tavenier @marctavenier
import clr
clr.AddReference('RevitAPI')
from Autodesk.Revit.DB import *

clr.AddReference('RevitServices')
import RevitServices
from RevitServices.Persistence import DocumentManager

doc = DocumentManager.Instance.CurrentDBDocument

def tolist(obj):
	if isinstance(obj, list):
		return UnwrapElement(obj)
	else:
		return [UnwrapElement(obj)]

views = tolist(IN[0])
elems = []

for view in views:
	filter = FilteredElementCollector(doc, view.Id)
	elems.append(filter.ToElements())

if len(elems) == 1:
	OUT = elems[0]
else:
	OUT = elems
# ----------------------------------------
Elements = Output(elements_in_views)
