# Dynamo custom node RIE.OpenMyDynamoFolder.dyf (Dynamo 1.3.3.4651)
# category: RIE.Commands
# Opens your local dynamo folder in windows explorer

OpenFolder = Input(OpenFolder : bool = true)
my_dynamo_folder_python = Python(IN[0]=OpenFolder)
# ---------- my_dynamo_folder_python.python (19 lines) ----------
import clr
import sys

pyt_path = r"C:\Program Files (x86)\IronPython 2.7\Lib"
sys.path.append(pyt_path)

import getpass

start = "C:\Users"+"\\"
Username = getpass.getuser()
end = "\\"+"AppData\Roaming\Dynamo\Dynamo Revit"+"\\"

dynpath = start+Username+end

if IN[0] == True:
	import os
	os.startfile(dynpath)

OUT = dynpath
# ----------------------------------------
Path = Output(my_dynamo_folder_python)
