# Dynamo custom node RIE.ReplaceNullsWith.dyf (Dynamo 1.3.3.4651)
# category: RIE.List
# Replaces nulls in input list with input replacement object.

List = Input()
ReplaceWith = Input()
python_script = Python(IN[0]=List, IN[1]=ReplaceWith)
# ---------- python_script.python (16 lines) ----------
OUT = []

def tolist(obj):
	if isinstance(obj, list):
		return obj
	else:
		return [obj]
		
for i in tolist(IN[0]):
	if i == None:
		try:
			OUT.append(tolist(IN[1])[0])
		except:
			OUT.append(tolist(IN[1]))
	else:
		OUT.append(i)
# ----------------------------------------
List_2 = Output(python_script)  # "List"
