# Dynamo custom node RIE.SpaceBoundaryLines.dyf (Dynamo 1.3.3.4651)
# category: RIE.Geometry
# Outputs Boundarylines of input Space elements

Spaces = Input()
python_script = Python(IN[0]=Spaces)
# ---------- python_script.python (69 lines) ----------
import clr
clr.AddReference('RevitAPI')
from Autodesk.Revit.DB import *
import Autodesk

clr.AddReference("RevitNodes")
import Revit
clr.ImportExtensions(Revit.GeometryConversion)

clr.AddReference("RevitServices")
import RevitServices
from RevitServices.Persistence import DocumentManager

def tolist(obj):
	if isinstance(obj, list):
		return UnwrapElement(obj)
	else:
		return [UnwrapElement(obj)]

items = tolist(IN[0])

doc = DocumentManager.Instance.CurrentDBDocument
uiapp = DocumentManager.Instance.CurrentUIApplication
app = uiapp.Application
if int(app.VersionNumber) > 2017: fullVersion = app.SubVersionNumber
else: fullVersion = str(app.VersionNumber)

version = int(app.VersionNumber)



elementlist = list()
curvelist = list()

for item in items:
	doc = item.Document
	calculator = SpatialElementGeometryCalculator(doc)
	options = Autodesk.Revit.DB.SpatialElementBoundaryOptions()
	# get boundary location from area computation settings
	boundloc = Autodesk.Revit.DB.AreaVolumeSettings.GetAreaVolumeSettings(doc).GetSpatialElementBoundaryLocation(SpatialElementType.Space)
	options.SpatialElementBoundaryLocation = boundloc
	#method #1 - get boundary segments
	
	try:
		for boundarylist in item.GetBoundarySegments(options):
			clist = list()
			for boundary in boundarylist:
				if version > 2016:
					clist.append(boundary.GetCurve().ToProtoType())
				else:
					clist.append(boundary.Curve.ToProtoType())
			curvelist.append(clist)
	except:
		pass
	#method #2 - spatial element geometry calculator
	try:
		results = calculator.CalculateSpatialElementGeometry(item)
		for face in results.GetGeometry().Faces:
			blist = list()
			clist = list()
			for bface in results.GetBoundaryFaceInfo(face):
				blist.append(doc.GetElement(bface.SpatialBoundaryElement.HostElementId))
			elementlist.append(blist)
			curvelist.append(clist)
	except:
		pass	
	# write results to list

OUT = [x for x in curvelist if x]
# ----------------------------------------
length = Curve.Length(python_script@L2)
sum = Math.Sum(length@L2)
maximumItem = List.MaximumItem(sum)
indexOf = IndexOf(sum, maximumItem)
getItemAtIndex = List.GetItemAtIndex(list=python_script, index=indexOf)
PerimeterLines = Output(getItemAtIndex)
AllBoundaries = Output(python_script)
