# Dynamo graph (1.3.2) Circuit Lights (DLR L2L3).dyn (Dynamo 1.3.2.2480)

# group: Collect all Lighting Fixtures
categories = Categories("LightingFixtures")
all_elements_of_category = ElementsOfCategory(categories)

# group: Filter by letter in Name
name = Element.Name(all_elements_of_category)
code_block = CodeBlock { "L"; }
contains = String.Contains(str=name, searchFor=code_block)
filterByBoolMask = List.FilterByBoolMask(list=all_elements_of_category, mask=contains)

id = Element.Id(filterByBoolMask.in)

# group: Group the lights by the element ids (this is for when something is tagged multiple times or in multiple views)
groupByKey = List.GroupByKey(list=filterByBoolMask.in, keys=id)

# group: Dictionaries provide a way to look stuff up by a given key
code_block_2 = CodeBlock(taggedElement=groupByKey.groups, tag=groupByKey.unique_keys)
# ---------- code_block_2.designscript (4 lines) ----------
//declare a new dictionary to store this in
tagDictionary = {};
//dictionary[whatToLookUpBy] = tagElement
tagDictionary[taggedElement] = tag;
# ----------------------------------------

# group: SELECT LIGHTS
select_model_elements = DSModelElementsSelection()  # 1013 picked in the model

# group: Sample element selected manually
id_2 = Element.Id(select_model_elements)

# group: Retrieve the Lighting Fixtures for the given element from the dictionary
code_block_3 = CodeBlock(tagDictionary=code_block_2.tagDictionary, taggedElement=id_2) { tagDictionary[taggedElement]; }

clean = List.Clean(list=code_block_3@L1)
flatten = Flatten(clean)

# group: # OF LIGHTS IN A ROW
code_block_4 = CodeBlock { 11; }

# group: GROUP LIGHTS INTO ROWS BASED ON LOCATION AND ROW/COLOUMN VALUES
getLocation = Element.GetLocation(flatten)
Y = Point.Y(getLocation)
sortByKey = List.SortByKey(list=flatten, keys=Y)
chop = List.Chop(list=sortByKey.sorted_list, lengths=code_block_4)
getLocation_2 = Element.GetLocation(chop)
X = Point.X(getLocation_2)
sortByKey_2 = List.SortByKey(list=chop@@L2, keys=X@L2)

watch = Watch(sortByKey_2.sorted_list)

# group: # OF CIRCUITS
code_block_5 = CodeBlock { 4; }

# group: LIGHTING PATTERN
diagonalLeft = List.DiagonalLeft(watch, code_block_4)
code_block_6 = CodeBlock(A=code_block_5) { 0..(A-1); }
takeEveryNthItem = List.TakeEveryNthItem(diagonalLeft, code_block_5, code_block_6)

# group: Panel #
code_block_7 = CodeBlock { 3; }

getItemAtIndex = List.GetItemAtIndex(list=takeEveryNthItem, index=code_block_7)
getLocation_3 = Element.GetLocation(getItemAtIndex@@L2)
Y_2 = Point.Y(getLocation_3)

# group: Below This Element
select_model_element = DSModelElementSelection()

getLocation_4 = Element.GetLocation(select_model_element)
Y_3 = Point.Y(getLocation_4)
lt = Y_2 < Y_3
filterByBoolMask_2 = List.FilterByBoolMask(list=getItemAtIndex, mask=lt)

# group: Above This Element
select_model_element_2 = DSModelElementSelection()

getLocation_5 = Element.GetLocation(select_model_element_2)
Y_4 = Point.Y(getLocation_5)
getLocation_6 = Element.GetLocation(filterByBoolMask_2.in)
Y_5 = Point.Y(getLocation_6)
lt_2 = Y_4 < Y_5
filterByBoolMask_3 = List.FilterByBoolMask(list=filterByBoolMask_2.in, mask=lt_2)
flatten_2 = Flatten(filterByBoolMask_3.in)
getLocation_7 = Element.GetLocation(flatten_2)
X_2 = Point.X(getLocation_7)

# group: X AXIS DIVIDE
select_model_element_3 = DSModelElementSelection()

getLocation_8 = Element.GetLocation(select_model_element_3)
X_3 = Point.X(getLocation_8)
lt_3 = X_2 < X_3

# group: OUT = RIGHT IN = LEFT
filterByBoolMask_4 = List.FilterByBoolMask(list=flatten_2, mask=lt_3)

# group: Create new circuit on Panel and assign elementset to new circuit
python_script = Python(IN[0]=filterByBoolMask_4.in)
# ---------- python_script.python (57 lines) ----------
import clr
clr.AddReference('ProtoGeometry')
from Autodesk.DesignScript.Geometry import *

clr.AddReference('RevitServices')
import RevitServices
from RevitServices.Persistence import DocumentManager
from RevitServices.Transactions import TransactionManager
from System.Collections.Generic import *

clr.AddReference('RevitNodes')
import Revit
clr.ImportExtensions(Revit.Elements)

clr.AddReference('RevitAPI')
import Autodesk
from Autodesk.Revit.DB import *
from Autodesk.Revit.DB.Electrical import *
from Autodesk.Revit.DB import MEPSystem

clr.AddReference('DSCoreNodes')
import DSCore
from DSCore.List import *

import sys
pyt_path = r'C:\Program Files (x86)\IronPython 2.7\Lib'
sys.path.append(pyt_path)

# Import List ( ICollection(ElementId) = List[ElementId]() )
clr.AddReference("System")
from System.Collections.Generic import List 

#The inputs to this node will be stored as a list in the IN variables.
input = UnwrapElement(IN[0])

electComponents = List[ElementId]()


for i in input:
	electComponents.Add(i.Id)


doc = DocumentManager.Instance.CurrentDBDocument
uiapp = DocumentManager.Instance.CurrentUIApplication
app = uiapp.Application
uidoc = DocumentManager.Instance.CurrentUIApplication.ActiveUIDocument

TransactionManager.Instance.EnsureInTransaction(doc)

newcircuit = ElectricalSystem.Create(doc, electComponents, ElectricalSystemType.PowerCircuit)


OUT = []
OUT.append(newcircuit)


TransactionManager.Instance.TransactionTaskDone()
# ----------------------------------------

# group: CHOOSE YOUR PANEL ("A" PANEL FIRST)
select_model_element_4 = DSModelElementSelection()  # 1 picked in the model
select_model_element_5 = DSModelElementSelection()  # 1 picked in the model
select_model_element_6 = DSModelElementSelection()  # 1 picked in the model
select_model_element_7 = DSModelElementSelection()  # 1 picked in the model

join = List.Join(select_model_element_4, select_model_element_5, select_model_element_6, select_model_element_7)
getItemAtIndex_2 = List.GetItemAtIndex(list=join, index=code_block_7)

# group: Select panel. IN[0] = Electrical System IN[1] = Panel element
python_script_2 = Python(IN[0]=python_script, IN[1]=getItemAtIndex_2)
# ---------- python_script_2.python (51 lines) ----------
import clr
clr.AddReference('ProtoGeometry')
from Autodesk.DesignScript.Geometry import *

clr.AddReference('RevitServices')
import RevitServices
from RevitServices.Persistence import DocumentManager
from RevitServices.Transactions import TransactionManager
from System.Collections.Generic import *

clr.AddReference('RevitNodes')
import Revit
clr.ImportExtensions(Revit.Elements)

clr.AddReference('RevitAPI')
import Autodesk
from Autodesk.Revit.DB import *
from Autodesk.Revit.DB.Electrical import *
from Autodesk.Revit.DB import MEPSystem

clr.AddReference('DSCoreNodes')
import DSCore
from DSCore.List import *

import sys
pyt_path = r'C:\Program Files (x86)\IronPython 2.7\Lib'
sys.path.append(pyt_path)

# Import List ( ICollection(ElementId) = List[ElementId]() )
clr.AddReference("System")
from System.Collections.Generic import List 


circuit = UnwrapElement(IN[0])
panel = UnwrapElement(IN[1])

doc = DocumentManager.Instance.CurrentDBDocument
uiapp = DocumentManager.Instance.CurrentUIApplication
app = uiapp.Application
uidoc = DocumentManager.Instance.CurrentUIApplication.ActiveUIDocument

TransactionManager.Instance.EnsureInTransaction(doc)

for _ in circuit:
	_.SelectPanel(panel)

TransactionManager.Instance.TransactionTaskDone()

#Assign your output to the OUT variable.
OUT = []
OUT = circuit, panel
# ----------------------------------------

watch_2 = Watch(takeEveryNthItem)
setRevitSelection = Custom[RIE.SetRevitSelection](Elements=getItemAtIndex)  # Input elements to select in Revit model

# group: Create new circuit on Panel and assign elementset to new circuit
python_script_3 = Python(IN[0]=filterByBoolMask_4.out)  # same code as python_script

# group: Select panel. IN[0] = Electrical System IN[1] = Panel element
python_script_4 = Python(IN[0]=python_script_3, IN[1]=getItemAtIndex_2)  # same code as python_script_2
