# Dynamo graph (1.3.2) Remove Circuits (Light Fixture Filter).dyn (Dynamo 1.3.2.2480)

select_model_elements = DSModelElementsSelection()  # 1 picked in the model
categories = Categories("LightingFixtures")
byCategory = Revit.ElementFilter.ByCategory(select_model_elements, categories)
code_block = CodeBlock { "L"; }
byNameBeginsWith = Revit.ElementFilter.ByNameBeginsWith(byCategory, code_block)
electricalCircuit = Custom[Element.ElectricalCircuit](Element=byNameBeginsWith)  # Returns the electrical circuit of the element
removeFromCircuit = Custom[ElectricalSystem.RemoveFromCircuit](Circuit=electricalCircuit, Elements=byNameBeginsWith)  # Removes the elements from the circuit
