# Dynamo graph 1.3.1 GET EQUIPMENT.dyn (Dynamo 1.3.2.2480)

# group: Get Links
get_documents = Custom[Get Documents]()  # Queries all linked Revit files and retrieves their Name, LinkInstance and Document properties.

get_documents_2 = Custom[Get Documents]()
categories = Categories("MechanicalEquipment")
linkedInstanceElements = Custom[Springs.Collector.LinkedInstanceElements](linkInstance=get_documents_2.Link_Instance, category=categories)  # Extract elements by category from the selected linked instances. The transform CS can be used to get the exact location of the elements in the host file. If an error occurs or the linked document is unloaded, an error will be returned in the elements output and the appropriate transform will be a null. You can use those nulls to filter out the errors.
number = DoubleInput(1)
flatten = List.Flatten(list=linkedInstanceElements.elements, amt=number)
string = StringInput("Number")
getParameterValueByName = Element.GetParameterValueByName(element=flatten, parameterName=string)
getDocument = RevitElements.RevitLink.GetDocument()  # unwired: arg0
get_documents_3 = Custom[Get Documents]()
