# Dynamo graph 1.3.1 LinkedMechToElec Building L2L3 (Must Set Phase) - LOCATION VERSION.dyn (Dynamo 1.3.2.2480)

file_path = Filename("C:\Users\dcleary\Desktop\Copy of Equipment CheckNew.xlsm")

# group: GET MECHANICAL CONNECTIONS -
family_types = FamilyTypes("ID MECH CONNECTION:MECHANICAL CONNECTION (120V)")
all_elements_of_family_type = ElementsOfFamilyType(family_types)
string = StringInput("EQUIPMENT NAME_IDG")
number = DoubleInput(1)

family_types_2 = FamilyTypes("ID MECH CONNECTION:MECHANICAL CONNECTION (480V)")
all_elements_of_family_type_2 = ElementsOfFamilyType(family_types_2)
create = List.Create(all_elements_of_family_type, all_elements_of_family_type_2)

# group: FILTER BY PHASE
select_phase = RevitPhases("Suite 124")
byPhaseCreated = Revit.ElementFilter.ByPhaseCreated(create, select_phase)
number_2 = DoubleInput(1)
flatten = List.Flatten(list=byPhaseCreated, amt=number_2)

# group (continued): GET MECHANICAL CONNECTIONS -
getParameterValueByName = Element.GetParameterValueByName(element=flatten, parameterName=string)
groupByKey = List.GroupByKey(list=flatten, keys=getParameterValueByName)
flatten_2 = List.Flatten(list=groupByKey.groups, amt=number)
getParameterValueByName_2 = Element.GetParameterValueByName(element=flatten_2, parameterName=string)
duplicateItemIndicies = archilab.Lists.Lists.DuplicateItemIndicies(getParameterValueByName_2)
removeItemAtIndex = List.RemoveItemAtIndex(list=getParameterValueByName_2, indices=duplicateItemIndicies.out1)
removeItemAtIndex_2 = List.RemoveItemAtIndex(list=flatten_2, indices=duplicateItemIndicies.out1)
countOccurences = Custom[List.CountOccurences](seq=getParameterValueByName_2)  # Counts the number of occurences of each unique element in a given list
removeItemAtIndex_3 = List.RemoveItemAtIndex(list=getParameterValueByName_2, indices=duplicateItemIndicies.out0)
eq = countOccurences.uniqueElements == removeItemAtIndex_3

# group: GET MECHANICAL EQUIPMENT
get_documents = Custom[Get Documents]()  # Queries all linked Revit files and retrieves their Name, LinkInstance and Document properties.
categories = Categories("MechanicalEquipment")
linkedInstanceElements = Custom[Springs.Collector.LinkedInstanceElements](linkInstance=get_documents.Link_Instance, category=categories)  # Extract elements by category from the selected linked instances. The transform CS can be used to get the exact location of the elements in the host file. If an error occurs or the linked document is unloaded, an error will be returned in the elements output and the appropriate transform will be a null. You can use those nulls to filter out the errors.
number_3 = DoubleInput(1)
flatten_3 = List.Flatten(list=linkedInstanceElements.elements, amt=number_3)
string_2 = StringInput("Number")

# group: REMOVES FIRST ITEM IN LIST. FIX FOR MISSING LINKED MODEL
restOfItems = List.RestOfItems(flatten_3)

# group: PHASE FILTER FIRE PROTECTION
string_3 = StringInput("Tag")
getParameterValueByName_3 = Element.GetParameterValueByName(element=restOfItems, parameterName=string_3)
string_4 = StringInput("L124")
eq_2 = getParameterValueByName_3 == string_4
filterByBoolMask = List.FilterByBoolMask(list=restOfItems, mask=eq_2)

# group: PHASE FILTER MECHANICAL
string_5 = StringInput("Tag")
getParameterValueByName_4 = Element.GetParameterValueByName(element=restOfItems, parameterName=string_5)
string_6 = StringInput("L124-")
eq_3 = getParameterValueByName_4 == string_6
filterByBoolMask_2 = List.FilterByBoolMask(list=restOfItems, mask=eq_3)

join = List.Join(filterByBoolMask.in, filterByBoolMask_2.in)

# group (continued): GET MECHANICAL EQUIPMENT
getParameterValueByName_5 = Element.GetParameterValueByName(element=join, parameterName=string_2)
setIntersection = SetIntersection(getParameterValueByName_5, removeItemAtIndex)
containsItem = List.ContainsItem(list=setIntersection, item=getParameterValueByName_5)
filterByBoolMask_3 = List.FilterByBoolMask(list=getParameterValueByName_5, mask=containsItem)
filterByBoolMask_4 = List.FilterByBoolMask(list=join, mask=containsItem)
join_2 = List.Join(filterByBoolMask_4.in, filterByBoolMask_4.out)

watch = Watch(join_2)
watch_2 = Watch(removeItemAtIndex_2)

# group: GET MECHANICAL VOLTS ALSO SET VOLTAGE TO CORRESPONDING UNPOWERED ELECTRICAL CONNECTION
type = archilab.Revit.Elements.WarningElement.Type(watch)
string_7 = StringInput("Volts")
getParameterValueByName_6 = Element.GetParameterValueByName(element=type, parameterName=string_7)
getParameterValueByName_7 = Element.GetParameterValueByName(element=watch, parameterName=string_7)
code_block = CodeBlock(a=getParameterValueByName_6, b=getParameterValueByName_7) { a+b; }
toNumber = String.ToNumber(code_block)
number_4 = DoubleInput(0)
replaceNull = Custom[List.ReplaceNull](seq=toNumber, replacement=number_4)  # Replaces all null values within a given list with a substitute
number_5 = DoubleInput(0.0929)
code_block_2 = CodeBlock(x=replaceNull, y=number_5) { x*y; }
round = Math.Round(code_block_2)
string_8 = StringInput("Volts")
setParameterByName = Element.SetParameterByName(element=watch_2, parameterName=string_8, value=replaceNull)

# group: GET MECHANICAL PHASE ALSO SET PHASE TO CORRESPONDING UNPOWERED ELECTRICAL CONNECTION
string_9 = StringInput("Location")
getParameterValueByName_8 = Element.GetParameterValueByName(element=type, parameterName=string_9)
getParameterValueByName_9 = Element.GetParameterValueByName(element=watch, parameterName=string_9)
code_block_3 = CodeBlock(a=getParameterValueByName_8, b=getParameterValueByName_9) { a+b; }
toNumber_2 = String.ToNumber(code_block_3)
number_6 = DoubleInput(0)
replaceNull_2 = Custom[List.ReplaceNull](seq=toNumber_2, replacement=number_6)
string_10 = StringInput("Location")
setParameterByName_2 = Element.SetParameterByName(element=watch_2, parameterName=string_10, value=getParameterValueByName_9)

# group: WRITE MECHANICAL PARAMETERS TO EXCEL
string_11 = StringInput("Mech Data")
code_block_4 = CodeBlock { 0; true; }
code_block_5 = CodeBlock { "Mech Equip"; "Mech Poles"; "Mech Volts"; "Duplicates"; }
create_2 = List.Create(code_block_5.out0, code_block_5.out1, code_block_5.out2, code_block_5.out3)
join_3 = List.Join(filterByBoolMask_3.in, filterByBoolMask_3.out)
create_3 = List.Create(join_3, replaceNull_2, round)
transpose = List.Transpose(create_3)
addItemToFront = List.AddItemToFront(item=create_2, list=transpose)
writeToFile = Excel.WriteToFile(filePath=file_path, sheetName=string_11, startRow=code_block_4.out0, startCol=code_block_4.out0, data=addItemToFront, overWrite=code_block_4.out1)

# group: GET ELECTRICAL PARAMETERS
string_12 = StringInput("Volts")
lunchbox_get_parameter_value = Custom[LunchBox Get Parameter Value](Element=watch_2, ParamName=string_12)  # Gets parameter values from a Revit element.
string_13 = StringInput("Number of Poles")
getParameterValueByName_10 = Element.GetParameterValueByName(element=watch_2, parameterName=string_13)
getParameterValueByName_11 = Element.GetParameterValueByName(element=watch_2, parameterName=string_12)
number_7 = DoubleInput(0.0929)
code_block_6 = CodeBlock(x=getParameterValueByName_11, y=number_7) { x*y; }
round_2 = Math.Round(code_block_6)
string_14 = StringInput("Panel")
lunchbox_get_parameter_value_2 = Custom[LunchBox Get Parameter Value](Element=watch_2, ParamName=string_14)
string_15 = StringInput("Circuit Number")
lunchbox_get_parameter_value_3 = Custom[LunchBox Get Parameter Value](Element=watch_2, ParamName=string_15)
code_block_7 = CodeBlock(a=lunchbox_get_parameter_value_2, b=lunchbox_get_parameter_value_3) { a+" - "+b; }

# group: WRITE ELECTRICAL PARAMETERS TO EXCEL
string_16 = StringInput("Elec Data")
code_block_8 = CodeBlock { 0; true; }
code_block_9 = CodeBlock { "Elec Equip"; "Elec Poles"; "Elec Volts"; "Circuit Panel"; "Duplicates"; }
create_4 = List.Create(code_block_9.out0, code_block_9.out1, code_block_9.out2, code_block_9.out3, code_block_9.out4)
create_5 = List.Create(removeItemAtIndex, getParameterValueByName_10, round_2, code_block_7, countOccurences.count)
transpose_2 = List.Transpose(create_5)
addItemToFront_2 = List.AddItemToFront(item=create_4, list=transpose_2)
writeToFile_2 = Excel.WriteToFile(filePath=file_path, sheetName=string_16, startRow=code_block_8.out0, startCol=code_block_8.out0, data=addItemToFront_2, overWrite=code_block_8.out1)
