# Dynamo graph 1.3.1 LinkedMechToElec.dyn (Dynamo 1.3.2.2480)

file_path = Filename(".\Equipment Check.xlsm")
string = StringInput("Data")
code_block = CodeBlock { 0; true; }
code_block_2 = CodeBlock { "Mech Equip"; "Elec Equip"; "Mech Poles"; "Elec Poles"; "Mech Volts"; "Elec Volts"; "Circuit Panel"; "Duplicates"; }
create = List.Create(code_block_2.out0, code_block_2.out1, code_block_2.out2, code_block_2.out3, code_block_2.out4, code_block_2.out5, code_block_2.out6, code_block_2.out7)

# group: Get Links
get_documents = Custom[Get Documents]()  # Queries all linked Revit files and retrieves their Name, LinkInstance and Document properties.

categories = Categories("MechanicalEquipment")
linkedInstanceElements = Custom[Springs.Collector.LinkedInstanceElements](linkInstance=get_documents.Link_Instance, category=categories)  # Extract elements by category from the selected linked instances. The transform CS can be used to get the exact location of the elements in the host file. If an error occurs or the linked document is unloaded, an error will be returned in the elements output and the appropriate transform will be a null. You can use those nulls to filter out the errors.
number = DoubleInput(1)
flatten = List.Flatten(list=linkedInstanceElements.elements, amt=number)
string_2 = StringInput("Number")
getParameterValueByName = Element.GetParameterValueByName(element=flatten, parameterName=string_2)
family_types = FamilyTypes("ID JUNCTION BOX - MECH EQUIP:MECHANICAL CONNECTION")
all_elements_of_family_type = ElementsOfFamilyType(family_types)
string_3 = StringInput("EQUIPMENT NAME_IDG")
getParameterValueByName_2 = Element.GetParameterValueByName(element=all_elements_of_family_type, parameterName=string_3)
groupByKey = List.GroupByKey(list=all_elements_of_family_type, keys=getParameterValueByName_2)
number_2 = DoubleInput(1)
flatten_2 = List.Flatten(list=groupByKey.groups, amt=number_2)
getParameterValueByName_3 = Element.GetParameterValueByName(element=flatten_2, parameterName=string_3)
duplicateItemIndicies = archilab.Lists.Lists.DuplicateItemIndicies(getParameterValueByName_3)
removeItemAtIndex = List.RemoveItemAtIndex(list=getParameterValueByName_3, indices=duplicateItemIndicies.out1)
setIntersection = SetIntersection(getParameterValueByName, removeItemAtIndex)
containsItem = List.ContainsItem(list=setIntersection, item=getParameterValueByName)
filterByBoolMask = List.FilterByBoolMask(list=getParameterValueByName, mask=containsItem)
join = List.Join(filterByBoolMask.in, filterByBoolMask.out)
filterByBoolMask_2 = List.FilterByBoolMask(list=flatten, mask=containsItem)
join_2 = List.Join(filterByBoolMask_2.in, filterByBoolMask_2.out)
watch = Watch(join_2)
type = archilab.Revit.Elements.WarningElement.Type(watch)
string_4 = StringInput("Phase")
getParameterValueByName_4 = Element.GetParameterValueByName(element=type, parameterName=string_4)
getParameterValueByName_5 = Element.GetParameterValueByName(element=watch, parameterName=string_4)
code_block_3 = CodeBlock(a=getParameterValueByName_4, b=getParameterValueByName_5) { a+b; }
toNumber = String.ToNumber(code_block_3)
removeItemAtIndex_2 = List.RemoveItemAtIndex(list=flatten_2, indices=duplicateItemIndicies.out1)
watch_2 = Watch(removeItemAtIndex_2)
string_5 = StringInput("Number of Poles")
getParameterValueByName_6 = Element.GetParameterValueByName(element=watch_2, parameterName=string_5)
string_6 = StringInput("Volts")
getParameterValueByName_7 = Element.GetParameterValueByName(element=type, parameterName=string_6)
getParameterValueByName_8 = Element.GetParameterValueByName(element=watch, parameterName=string_6)
code_block_4 = CodeBlock(a=getParameterValueByName_7, b=getParameterValueByName_8) { a+b; }
toNumber_2 = String.ToNumber(code_block_4)
number_3 = DoubleInput(0.0929)
code_block_5 = CodeBlock(x=toNumber_2, y=number_3) { x*y; }
round = Math.Round(code_block_5)
string_7 = StringInput("Volts")
getParameterValueByName_9 = Element.GetParameterValueByName(element=watch_2, parameterName=string_7)
number_4 = DoubleInput(0.0929)
code_block_6 = CodeBlock(x=getParameterValueByName_9, y=number_4) { x*y; }
round_2 = Math.Round(code_block_6)
string_8 = StringInput("Panel")
lunchbox_get_parameter_value = Custom[LunchBox Get Parameter Value](Element=watch_2, ParamName=string_8)  # Gets parameter values from a Revit element.
string_9 = StringInput("Circuit Number")
lunchbox_get_parameter_value_2 = Custom[LunchBox Get Parameter Value](Element=watch_2, ParamName=string_9)
code_block_7 = CodeBlock(a=lunchbox_get_parameter_value, b=lunchbox_get_parameter_value_2) { a+" - "+b; }
countOccurences = Custom[List.CountOccurences](seq=getParameterValueByName_3)  # Counts the number of occurences of each unique element in a given list
create_2 = List.Create(join, removeItemAtIndex, toNumber, getParameterValueByName_6, round, round_2, code_block_7, countOccurences.count)
transpose = List.Transpose(create_2)
addItemToFront = List.AddItemToFront(item=create, list=transpose)
writeToFile = Excel.WriteToFile(filePath=file_path, sheetName=string, startRow=code_block.out0, startCol=code_block.out0, data=addItemToFront, overWrite=code_block.out1)
setParameterByName = Element.SetParameterByName(element=watch_2, parameterName=string_5, value=toNumber)
setParameterByName_2 = Element.SetParameterByName(element=watch_2, parameterName=string_7, value=toNumber_2)
lunchbox_get_parameter_value_3 = Custom[LunchBox Get Parameter Value](Element=watch_2, ParamName=string_7)
