# Dynamo graph 1.3.1 LinkedMechToElec2.0.dyn (Dynamo 1.3.2.2480)

file_path = Filename("C:\Users\dcleary\Desktop\Copy of Equipment CheckNew.xlsm")
string = StringInput("Tag")
string_2 = StringInput("L124-")

# group: GET MECHANICAL CONNECTIONS
family_types = FamilyTypes("ID MECH CONNECTION:MECHANICAL CONNECTION")
all_elements_of_family_type = ElementsOfFamilyType(family_types)
string_3 = StringInput("EQUIPMENT NAME_IDG")
number = DoubleInput(1)
code_block = CodeBlock {  }

select_phase = RevitPhases("Suite 124")
byPhaseCreated = Revit.ElementFilter.ByPhaseCreated(all_elements_of_family_type, select_phase)

# group (continued): GET MECHANICAL CONNECTIONS
getParameterValueByName = Element.GetParameterValueByName(element=byPhaseCreated, parameterName=string_3)
groupByKey = List.GroupByKey(list=byPhaseCreated, keys=getParameterValueByName)
flatten = List.Flatten(list=groupByKey.groups, amt=number)
getParameterValueByName_2 = Element.GetParameterValueByName(element=flatten, parameterName=string_3)
duplicateItemIndicies = archilab.Lists.Lists.DuplicateItemIndicies(getParameterValueByName_2)
removeItemAtIndex = List.RemoveItemAtIndex(list=getParameterValueByName_2, indices=duplicateItemIndicies.out1)
removeItemAtIndex_2 = List.RemoveItemAtIndex(list=flatten, indices=duplicateItemIndicies.out1)
countOccurences = Custom[List.CountOccurences](seq=getParameterValueByName_2)  # Counts the number of occurences of each unique element in a given list
removeItemAtIndex_3 = List.RemoveItemAtIndex(list=getParameterValueByName_2, indices=duplicateItemIndicies.out0)
eq = countOccurences.uniqueElements == removeItemAtIndex_3

# group: GET MECHANICAL EQUIPMENT
get_documents = Custom[Get Documents]()  # Queries all linked Revit files and retrieves their Name, LinkInstance and Document properties.
categories = Categories("MechanicalEquipment")
linkedInstanceElements = Custom[Springs.Collector.LinkedInstanceElements](linkInstance=get_documents.Link_Instance, category=categories)  # Extract elements by category from the selected linked instances. The transform CS can be used to get the exact location of the elements in the host file. If an error occurs or the linked document is unloaded, an error will be returned in the elements output and the appropriate transform will be a null. You can use those nulls to filter out the errors.
number_2 = DoubleInput(1)
flatten_2 = List.Flatten(list=linkedInstanceElements.elements, amt=number_2)
string_4 = StringInput("Number")

restOfItems = List.RestOfItems(flatten_2)
getParameterValueByName_3 = Element.GetParameterValueByName(element=restOfItems, parameterName=string)
eq_2 = getParameterValueByName_3 == string_2
filterByBoolMask = List.FilterByBoolMask(list=restOfItems, mask=eq_2)

# group (continued): GET MECHANICAL EQUIPMENT
getParameterValueByName_4 = Element.GetParameterValueByName(element=filterByBoolMask.in, parameterName=string_4)
setIntersection = SetIntersection(getParameterValueByName_4, removeItemAtIndex)
containsItem = List.ContainsItem(list=setIntersection, item=getParameterValueByName_4)
filterByBoolMask_2 = List.FilterByBoolMask(list=getParameterValueByName_4, mask=containsItem)
filterByBoolMask_3 = List.FilterByBoolMask(list=filterByBoolMask.in, mask=containsItem)
join = List.Join(filterByBoolMask_3.in, filterByBoolMask_3.out)

watch = Watch(join)
watch_2 = Watch(removeItemAtIndex_2)

# group: GET MECHANICAL VOLTS ALSO SET VOLTAGE TO CORRESPONDING UNPOWERED ELECTRICAL CONNECTION
type = archilab.Revit.Elements.WarningElement.Type(watch)
string_5 = StringInput("Volts")
getParameterValueByName_5 = Element.GetParameterValueByName(element=type, parameterName=string_5)
getParameterValueByName_6 = Element.GetParameterValueByName(element=watch, parameterName=string_5)
code_block_2 = CodeBlock(a=getParameterValueByName_5, b=getParameterValueByName_6) { a+b; }
toNumber = String.ToNumber(code_block_2)
number_3 = DoubleInput(0)
replaceNull = Custom[List.ReplaceNull](seq=toNumber, replacement=number_3)  # Replaces all null values within a given list with a substitute
number_4 = DoubleInput(0.0929)
code_block_3 = CodeBlock(x=replaceNull, y=number_4) { x*y; }
round = Math.Round(code_block_3)
string_6 = StringInput("Volts")
setParameterByName = Element.SetParameterByName(element=watch_2, parameterName=string_6, value=replaceNull)

# group: GET MECHANICAL PHASE ALSO SET PHASE TO CORRESPONDING UNPOWERED ELECTRICAL CONNECTION
string_7 = StringInput("Phase")
getParameterValueByName_7 = Element.GetParameterValueByName(element=type, parameterName=string_7)
getParameterValueByName_8 = Element.GetParameterValueByName(element=watch, parameterName=string_7)
code_block_4 = CodeBlock(a=getParameterValueByName_7, b=getParameterValueByName_8) { a+b; }
toNumber_2 = String.ToNumber(code_block_4)
number_5 = DoubleInput(0)
replaceNull_2 = Custom[List.ReplaceNull](seq=toNumber_2, replacement=number_5)
string_8 = StringInput("Number of Poles")
setParameterByName_2 = Element.SetParameterByName(element=watch_2, parameterName=string_8, value=replaceNull_2)

# group: WRITE MECHANICAL PARAMETERS TO EXCEL
string_9 = StringInput("Mech Data")
code_block_5 = CodeBlock { 0; true; }
code_block_6 = CodeBlock { "Mech Equip"; "Mech Poles"; "Mech Volts"; "Duplicates"; }
create = List.Create(code_block_6.out0, code_block_6.out1, code_block_6.out2, code_block_6.out3)
join_2 = List.Join(filterByBoolMask_2.in, filterByBoolMask_2.out)
create_2 = List.Create(join_2, replaceNull_2, round)
transpose = List.Transpose(create_2)
addItemToFront = List.AddItemToFront(item=create, list=transpose)
writeToFile = Excel.WriteToFile(filePath=file_path, sheetName=string_9, startRow=code_block_5.out0, startCol=code_block_5.out0, data=addItemToFront, overWrite=code_block_5.out1)

# group: GET ELECTRICAL PARAMETERS
string_10 = StringInput("Volts")
lunchbox_get_parameter_value = Custom[LunchBox Get Parameter Value](Element=watch_2, ParamName=string_10)  # Gets parameter values from a Revit element.
string_11 = StringInput("Number of Poles")
getParameterValueByName_9 = Element.GetParameterValueByName(element=watch_2, parameterName=string_11)
getParameterValueByName_10 = Element.GetParameterValueByName(element=watch_2, parameterName=string_10)
number_6 = DoubleInput(0.0929)
code_block_7 = CodeBlock(x=getParameterValueByName_10, y=number_6) { x*y; }
round_2 = Math.Round(code_block_7)
string_12 = StringInput("Panel")
lunchbox_get_parameter_value_2 = Custom[LunchBox Get Parameter Value](Element=watch_2, ParamName=string_12)
string_13 = StringInput("Circuit Number")
lunchbox_get_parameter_value_3 = Custom[LunchBox Get Parameter Value](Element=watch_2, ParamName=string_13)
code_block_8 = CodeBlock(a=lunchbox_get_parameter_value_2, b=lunchbox_get_parameter_value_3) { a+" - "+b; }

# group: WRITE ELECTRICAL PARAMETERS TO EXCEL
string_14 = StringInput("Elec Data")
code_block_9 = CodeBlock { 0; true; }
code_block_10 = CodeBlock { "Elec Equip"; "Elec Poles"; "Elec Volts"; "Circuit Panel"; "Duplicates"; }
create_3 = List.Create(code_block_10.out0, code_block_10.out1, code_block_10.out2, code_block_10.out3, code_block_10.out4)
create_4 = List.Create(removeItemAtIndex, getParameterValueByName_9, round_2, code_block_8, countOccurences.count)
transpose_2 = List.Transpose(create_4)
addItemToFront_2 = List.AddItemToFront(item=create_3, list=transpose_2)
writeToFile_2 = Excel.WriteToFile(filePath=file_path, sheetName=string_14, startRow=code_block_9.out0, startCol=code_block_9.out0, data=addItemToFront_2, overWrite=code_block_9.out1)
