# Dynamo graph 1.3.1 Selecting Elements Through a Link.dyn (Dynamo 1.3.2.2480)

file_path = Filename("..\Documents\Add-ins\DYNAMO\test.xlsx")
string = StringInput("Data")
code_block = CodeBlock { 0; true; }
code_block_2 = CodeBlock { "Mech Equip"; "Elec Equip"; "Mech Poles"; "Elec Poles"; "Mech Volts"; "Elec Volts"; }
create = List.Create(code_block_2.out0, code_block_2.out1, code_block_2.out2, code_block_2.out3, code_block_2.out4, code_block_2.out5)

# group: Get Links
get_documents = Custom[Get Documents]()  # Queries all linked Revit files and retrieves their Name, LinkInstance and Document properties.

categories = Categories("MechanicalEquipment")
linkedInstanceElements = Custom[Springs.Collector.LinkedInstanceElements](linkInstance=get_documents.Link_Instance, category=categories)  # Extract elements by category from the selected linked instances. The transform CS can be used to get the exact location of the elements in the host file. If an error occurs or the linked document is unloaded, an error will be returned in the elements output and the appropriate transform will be a null. You can use those nulls to filter out the errors.
number = DoubleInput(1)
flatten = List.Flatten(list=linkedInstanceElements.elements, amt=number)
string_2 = StringInput("Number")
getParameterValueByName = Element.GetParameterValueByName(element=flatten, parameterName=string_2)
family_types = FamilyTypes("ID JUNCTION BOX - MECH EQUIP:MECHANICAL CONNECTION")
all_elements_of_family_type = ElementsOfFamilyType(family_types)
string_3 = StringInput("EQUIPMENT NAME_IDG")
getParameterValueByName_2 = Element.GetParameterValueByName(element=all_elements_of_family_type, parameterName=string_3)
groupByKey = List.GroupByKey(list=all_elements_of_family_type, keys=getParameterValueByName_2)
number_2 = DoubleInput(1)
flatten_2 = List.Flatten(list=groupByKey.groups, amt=number_2)
getParameterValueByName_3 = Element.GetParameterValueByName(element=flatten_2, parameterName=string_3)
setIntersection = SetIntersection(getParameterValueByName, getParameterValueByName_3)
containsItem = List.ContainsItem(list=setIntersection, item=getParameterValueByName)
filterByBoolMask = List.FilterByBoolMask(list=getParameterValueByName, mask=containsItem)
join = List.Join(filterByBoolMask.in, filterByBoolMask.out)
family_types_2 = FamilyTypes("ID JUNCTION BOX - MECH EQUIP:MECHANICAL CONNECTION")
all_elements_of_family_type_2 = ElementsOfFamilyType(family_types_2)
string_4 = StringInput("EQUIPMENT NAME_IDG")
getParameterValueByName_4 = Element.GetParameterValueByName(element=all_elements_of_family_type_2, parameterName=string_4)
filterByBoolMask_2 = List.FilterByBoolMask(list=flatten, mask=containsItem)
watch = Watch(filterByBoolMask_2.in)
type = archilab.Revit.Elements.WarningElement.Type(watch)
string_5 = StringInput("Phase")
getParameterValueByName_5 = Element.GetParameterValueByName(element=type, parameterName=string_5)
getParameterValueByName_6 = Element.GetParameterValueByName(element=watch, parameterName=string_5)
code_block_3 = CodeBlock(a=getParameterValueByName_5, b=getParameterValueByName_6) { a+b; }
toNumber = String.ToNumber(code_block_3)
groupByKey_2 = List.GroupByKey(list=all_elements_of_family_type_2, keys=getParameterValueByName_4)
number_3 = DoubleInput(1)
flatten_3 = List.Flatten(list=groupByKey_2.groups, amt=number_3)
string_6 = StringInput("Number of Poles")
getParameterValueByName_7 = Element.GetParameterValueByName(element=flatten_3, parameterName=string_6)
string_7 = StringInput("Volts")
getParameterValueByName_8 = Element.GetParameterValueByName(element=type, parameterName=string_7)
getParameterValueByName_9 = Element.GetParameterValueByName(element=watch, parameterName=string_7)
code_block_4 = CodeBlock(a=getParameterValueByName_8, b=getParameterValueByName_9) { a+b; }
toNumber_2 = String.ToNumber(code_block_4)
number_4 = DoubleInput(0.0929)
code_block_5 = CodeBlock(x=toNumber_2, y=number_4) { x*y; }
round = Math.Round(code_block_5)
string_8 = StringInput("Volts")
getParameterValueByName_10 = Element.GetParameterValueByName(element=flatten_3, parameterName=string_8)
number_5 = DoubleInput(0.0929)
code_block_6 = CodeBlock(x=getParameterValueByName_10, y=number_5) { x*y; }
round_2 = Math.Round(code_block_6)
create_2 = List.Create(join, getParameterValueByName_4, toNumber, getParameterValueByName_7, round, round_2)
transpose = List.Transpose(create_2)
addItemToFront = List.AddItemToFront(item=create, list=transpose)
writeToFile = Excel.WriteToFile(filePath=file_path, sheetName=string, startRow=code_block.out0, startCol=code_block.out0, data=addItemToFront, overWrite=code_block.out1)
watch_2 = Watch(flatten_2)
setParameterByName = Element.SetParameterByName(element=watch_2, parameterName=string_6, value=toNumber)
setParameterByName_2 = Element.SetParameterByName(element=watch_2, parameterName=string_8, value=toNumber_2)
mul = _ * _  # unwired: arg0, arg1
lunchbox_get_parameter_value = Custom[LunchBox Get Parameter Value](Element=flatten_3, ParamName=string_8)  # Gets parameter values from a Revit element.
