# Dynamo custom node 1.3.2 COPY AND POWER .DYF "1.3.2 COPY AND POWER" (Dynamo 1.3.2.2480)
# category: Electrical Design
# Copys elements froma panel and powers them to a new panel.

code_block = CodeBlock { Origin Panel; }
code_block_2 = CodeBlock { Origin Element Location; }
code_block_3 = CodeBlock { Destination Element Location; }
code_block_4 = CodeBlock { Destination Panel; }
select_model_element = DSModelElementSelection()  # 1 picked in the model

# group: GET ALL CIRCUITED ELEMENTS
categories = Categories("ElectricalCircuit")
all_elements_of_category = ElementsOfCategory(categories)
python_script = Python(IN[0]=all_elements_of_category)
# ---------- python_script.python (18 lines) ----------
import clr
clr.AddReference('ProtoGeometry')
from Autodesk.DesignScript.Geometry import *
#The inputs to this node will be stored as a list in the IN variables.
systems = UnwrapElement(IN[0])
panels = []
elements = []

for x in systems:
	panels.append(x.BaseEquipment)
	sublist = []
	elementset = x.Elements
	for x in elementset:
		sublist.append(x)
	elements.append(sublist)

#Assign your output to the OUT variable.
OUT = elements
# ----------------------------------------
watch = Watch(python_script)

# group: GET ELEMENTS ONLY CIRCUITED TO CHOSEN PANEL
string = StringInput("Panel : ")
string_2 = StringInput("Panel Name")
getParameterValueByName = Element.GetParameterValueByName(element=select_model_element, parameterName=string_2)
add = string + getParameterValueByName
string_3 = StringInput("Panel")
getParameterValueByName_2 = Element.GetParameterValueByName(element=all_elements_of_category, parameterName=string_3)
eq = getParameterValueByName == getParameterValueByName_2
filterByBoolMask = List.FilterByBoolMask(list=all_elements_of_category, mask=eq)

var = Output(add)  # "var[]..[]"

# group: SORT CIRCUIT BY CIRCUIT NUMBER
string_4 = StringInput("Circuit Number")
getParameterValueByName_3 = Element.GetParameterValueByName(element=filterByBoolMask.in, parameterName=string_4)
sortDuplicateStrings = Lists.Strings.SortDuplicateStrings(getParameterValueByName_3)
toNumber = String.ToNumber(sortDuplicateStrings.out0@L1)
sortByKey = List.SortByKey(list=filterByBoolMask.in, keys=toNumber)

python_script_2 = Python(IN[0]=sortByKey.sorted_list)  # same code as python_script
select_model_element_2 = DSModelElementSelection()  # 1 picked in the model
select_model_element_3 = DSModelElementSelection()  # 1 picked in the model

# group: COPY ELEMENTS TO FROM START POINT TO END POINT
getLocation = Element.GetLocation(select_model_element_2)
getLocation_2 = Element.GetLocation(select_model_element_3)
byTwoPoints = Vector.ByTwoPoints(start=getLocation, end=getLocation_2)
code_block_5 = CodeBlock { "true"; }
copyByVector = Custom[Element.CopyByVector](element=python_script_2@@L2, vector=byTwoPoints, rehostToClosestLevel=code_block_5)  # Copies an element or a list of elements by a given vector.

clean = List.Clean(list=copyByVector)

# group: Create new circuit on Panel and assign elementset to new circuit
python_script_3 = Python(IN[0]=clean)
# ---------- python_script_3.python (62 lines) ----------
import clr
clr.AddReference('ProtoGeometry')
from Autodesk.DesignScript.Geometry import *

clr.AddReference('RevitServices')
import RevitServices
from RevitServices.Persistence import DocumentManager
from RevitServices.Transactions import TransactionManager
from System.Collections.Generic import *

clr.AddReference('RevitNodes')
import Revit
clr.ImportExtensions(Revit.Elements)

clr.AddReference('RevitAPI')
import Autodesk
from Autodesk.Revit.DB import *
from Autodesk.Revit.DB.Electrical import *
from Autodesk.Revit.DB import MEPSystem

clr.AddReference('DSCoreNodes')
import DSCore
from DSCore.List import *

import sys
pyt_path = r'C:\Program Files (x86)\IronPython 2.7\Lib'
sys.path.append(pyt_path)

# Import List ( ICollection(ElementId) = List[ElementId]() )
clr.AddReference("System")
from System.Collections.Generic import List 

#The inputs to this node will be stored as a list in the IN variables.
input = UnwrapElement(IN[0])

ElectComponents = []
NewCircuit = []

for sublist in input:
	sub = List[ElementId]()
	ElectComponents.append(sub)
	for item in sublist:
		sub.Add(item.Id)


doc = DocumentManager.Instance.CurrentDBDocument
uiapp = DocumentManager.Instance.CurrentUIApplication
app = uiapp.Application
uidoc = DocumentManager.Instance.CurrentUIApplication.ActiveUIDocument

ListNewCircuit = []

TransactionManager.Instance.EnsureInTransaction(doc)

for e in ElectComponents:
	NewCircuit = doc.Create.NewElectricalSystem(e, ElectricalSystemType.PowerCircuit)
	ListNewCircuit.append(NewCircuit)

TransactionManager.Instance.TransactionTaskDone()


OUT = ListNewCircuit
# ----------------------------------------

select_model_element_4 = DSModelElementSelection()  # 1 picked in the model

# group: Select panel. IN[0] = Electrical System IN[1] = Panel element
python_script_4 = Python(IN[0]=python_script_3, IN[1]=select_model_element_4)
# ---------- python_script_4.python (51 lines) ----------
import clr
clr.AddReference('ProtoGeometry')
from Autodesk.DesignScript.Geometry import *

clr.AddReference('RevitServices')
import RevitServices
from RevitServices.Persistence import DocumentManager
from RevitServices.Transactions import TransactionManager
from System.Collections.Generic import *

clr.AddReference('RevitNodes')
import Revit
clr.ImportExtensions(Revit.Elements)

clr.AddReference('RevitAPI')
import Autodesk
from Autodesk.Revit.DB import *
from Autodesk.Revit.DB.Electrical import *
from Autodesk.Revit.DB import MEPSystem

clr.AddReference('DSCoreNodes')
import DSCore
from DSCore.List import *

import sys
pyt_path = r'C:\Program Files (x86)\IronPython 2.7\Lib'
sys.path.append(pyt_path)

# Import List ( ICollection(ElementId) = List[ElementId]() )
clr.AddReference("System")
from System.Collections.Generic import List 


circuit = UnwrapElement(IN[0])
panel = UnwrapElement(IN[1])

doc = DocumentManager.Instance.CurrentDBDocument
uiapp = DocumentManager.Instance.CurrentUIApplication
app = uiapp.Application
uidoc = DocumentManager.Instance.CurrentUIApplication.ActiveUIDocument

TransactionManager.Instance.EnsureInTransaction(doc)

for _ in circuit:
	_.SelectPanel(panel)

TransactionManager.Instance.TransactionTaskDone()

#Assign your output to the OUT variable.
OUT = []
OUT = circuit, panel
# ----------------------------------------

OUT = Output(python_script_4)
Output = Output(watch)  # ""
Indices = Output(sortDuplicateStrings.out1)
sorted_keys = Output(sortByKey.sorted_keys)
out = Output(filterByBoolMask.out)
string_5 = StringInput("Phase Created")
select_phase = RevitPhases("Suite 224")
setParameterByName = Element.SetParameterByName(element=clean, parameterName=string_5, value=select_phase)
Element = Output(setParameterByName)

# group: GET CIRCUIT PARAMETERS TO BE COPIED
string_6 = StringInput("Rating")
getParameterValueByName_4 = Element.GetParameterValueByName(element=sortByKey.sorted_list, parameterName=string_6)
string_7 = StringInput("Load Name")
getParameterValueByName_5 = Element.GetParameterValueByName(element=sortByKey.sorted_list, parameterName=string_7)

# group: FIND AND REPLACE CIRCUIT NAME
string_8 = StringInput("124")
string_9 = StringInput("224")
replace = String.Replace(str=getParameterValueByName_5, searchFor=string_8, replaceWith=string_9)

# group: SET RATING AND LOAD NAME FOR CIRCUITS
string_10 = StringInput("Rating")
setParameterByName_2 = Element.SetParameterByName(element=python_script_3, parameterName=string_10, value=getParameterValueByName_4)
string_11 = StringInput("Load Name")
setParameterByName_3 = Element.SetParameterByName(element=python_script_3, parameterName=string_11, value=replace)

Element_2 = Output(setParameterByName_2)  # "Element"
Element_3 = Output(setParameterByName_3)  # "Element"
string_12 = StringInput("Workset")

# group: GET WORKSET OF ELEMENTS
string_13 = StringInput("Workset")
getParameterValueByName_6 = Element.GetParameterValueByName(element=python_script_2, parameterName=string_13)

setParameterByName_4 = Element.SetParameterByName(element=clean, parameterName=string_12, value=getParameterValueByName_6)
Element_4 = Output(setParameterByName_4)  # "Element"
