# Dynamo graph 1.3.2 Get Items in Room.dyn (Dynamo 1.3.2.2480)

# group: GET MECHANICAL EQUIPMENT
string = StringInput("Number")
get_documents = Custom[Get Documents]()  # Queries all linked Revit files and retrieves their Name, LinkInstance and Document properties.
categories = Categories("Rooms")
linkedInstanceElements = Custom[Springs.Collector.LinkedInstanceElements](linkInstance=get_documents.Link_Instance, category=categories)  # Extract elements by category from the selected linked instances. The transform CS can be used to get the exact location of the elements in the host file. If an error occurs or the linked document is unloaded, an error will be returned in the elements output and the appropriate transform will be a null. You can use those nulls to filter out the errors.
number = DoubleInput(1)
flatten = List.Flatten(list=linkedInstanceElements.elements, amt=number)

watch = Watch()  # unwired: arg0
file_path = Filename("C:\Users\dcleary\Desktop\Copy of Equipment CheckNew.xlsm")

# group: FILTER BY PHASE
select_phase = RevitPhases("EFO Suite 118")
byPhaseCreated = Revit.ElementFilter.ByPhaseCreated(flatten, select_phase)
number_2 = DoubleInput(1)
flatten_2 = List.Flatten(list=byPhaseCreated, amt=number_2)

# group: GET MECHANICAL CONNECTIONS -
string_2 = StringInput("EQUIPMENT NAME_IDG")
getParameterValueByName = Element.GetParameterValueByName(element=flatten_2, parameterName=string_2)
groupByKey = List.GroupByKey(list=flatten_2, keys=getParameterValueByName)
number_3 = DoubleInput(1)
flatten_3 = List.Flatten(list=groupByKey.groups, amt=number_3)
getParameterValueByName_2 = Element.GetParameterValueByName(element=flatten_3, parameterName=string_2)
duplicateItemIndicies = archilab.Lists.Lists.DuplicateItemIndicies(getParameterValueByName_2)
removeItemAtIndex = List.RemoveItemAtIndex(list=getParameterValueByName_2, indices=duplicateItemIndicies.out1)
countOccurences = Custom[List.CountOccurences](seq=getParameterValueByName_2)  # Counts the number of occurences of each unique element in a given list
removeItemAtIndex_2 = List.RemoveItemAtIndex(list=getParameterValueByName_2, indices=duplicateItemIndicies.out0)
eq = countOccurences.uniqueElements == removeItemAtIndex_2
family_types = FamilyTypes("ID MECH CONNECTION:MECHANICAL CONNECTION (120V)")
all_elements_of_family_type = ElementsOfFamilyType(family_types)
removeItemAtIndex_3 = List.RemoveItemAtIndex(list=flatten_3, indices=duplicateItemIndicies.out1)

# group: WRITE ELECTRICAL PARAMETERS TO EXCEL
string_3 = StringInput("Elec Data")
code_block = CodeBlock { 0; true; }
code_block_2 = CodeBlock { "Elec Equip"; "Elec Poles"; "Elec Volts"; "Circuit Panel"; "Duplicates"; }
create = List.Create(code_block_2.out0, code_block_2.out1, code_block_2.out2, code_block_2.out3, code_block_2.out4)
create_2 = List.Create(removeItemAtIndex, arg4=countOccurences.count)  # unwired: arg1, arg2, arg3
transpose = List.Transpose(create_2)
addItemToFront = List.AddItemToFront(item=create, list=transpose)
writeToFile = Excel.WriteToFile(filePath=file_path, sheetName=string_3, startRow=code_block.out0, startCol=code_block.out0, data=addItemToFront, overWrite=code_block.out1)

family_types_2 = FamilyTypes("ID MECH CONNECTION:MECHANICAL CONNECTION (480V)")
all_elements_of_family_type_2 = ElementsOfFamilyType(family_types_2)
create_3 = List.Create(all_elements_of_family_type, all_elements_of_family_type_2)
watch_2 = Watch(removeItemAtIndex_3)
string_4 = StringInput("Name")
getParameterValueByName_3 = Element.GetParameterValueByName(element=flatten, parameterName=string_4)
string_5 = StringInput("Number")
getParameterValueByName_4 = Element.GetParameterValueByName(element=flatten, parameterName=string_5)
code_block_3 = CodeBlock(a=getParameterValueByName_3, b=getParameterValueByName_4) { a + " " + b; }
