# Dynamo custom node 1.3.2 NODE - COPY AND POWER.dyf (Dynamo 1.3.2.2480)
# category: Electrical Design
# Copys elements froma panel and powers them to a new panel.

select_model_element = DSModelElementSelection()  # 1 picked in the model
select_model_element_2 = DSModelElementSelection()  # 1 picked in the model
code_block = CodeBlock { Origin Element Location; }
code_block_2 = CodeBlock { Destination Element Location; }
select_model_element_3 = DSModelElementSelection()  # 1 picked in the model
code_block_3 = CodeBlock { Origin Panel; }
select_model_element_4 = DSModelElementSelection()  # 1 picked in the model
code_block_4 = CodeBlock { Destination Panel; }

# group: GET ALL CIRCUITED ELEMENTS
categories = Categories("ElectricalCircuit")
all_elements_of_category = ElementsOfCategory(categories)
python_script = Python(IN[0]=all_elements_of_category)
# ---------- python_script.python (18 lines) ----------
import clr
clr.AddReference('ProtoGeometry')
from Autodesk.DesignScript.Geometry import *
#The inputs to this node will be stored as a list in the IN variables.
systems = UnwrapElement(IN[0])
panels = []
elements = []

for x in systems:
	panels.append(x.BaseEquipment)
	sublist = []
	elementset = x.Elements
	for x in elementset:
		sublist.append(x)
	elements.append(sublist)

#Assign your output to the OUT variable.
OUT = elements
# ----------------------------------------
watch = Watch(python_script)

Origin_Panel = Input()  # ""Origin Panel""

# group: GET ELEMENTS ONLY CIRCUITED TO CHOSEN PANEL
string = StringInput("Panel Name")
getParameterValueByName = Element.GetParameterValueByName(element=Origin_Panel, parameterName=string)
string_2 = StringInput("Panel")
getParameterValueByName_2 = Element.GetParameterValueByName(element=all_elements_of_category, parameterName=string_2)
eq = getParameterValueByName == getParameterValueByName_2
filterByBoolMask = List.FilterByBoolMask(list=all_elements_of_category, mask=eq)
string_3 = StringInput("Panel : ")
add = string_3 + getParameterValueByName

# group: SORT CIRCUIT BY CIRCUIT NUMBER
string_4 = StringInput("Circuit Number")
getParameterValueByName_3 = Element.GetParameterValueByName(element=filterByBoolMask.in, parameterName=string_4)
sortDuplicateStrings = Lists.Strings.SortDuplicateStrings(getParameterValueByName_3)
toNumber = String.ToNumber(sortDuplicateStrings@L1)
sortByKey = List.SortByKey(list=filterByBoolMask.in, keys=toNumber)

python_script_2 = Python(IN[0]=sortByKey.sorted_list)  # same code as python_script
Origin_Location = Input()  # ""Origin Location""
Destination_Location = Input()  # ""Destination Location""

# group: COPY ELEMENTS TO FROM START POINT TO END POINT
getLocation = Element.GetLocation(Origin_Location)
getLocation_2 = Element.GetLocation(Destination_Location)
byTwoPoints = Vector.ByTwoPoints(start=getLocation, end=getLocation_2)
code_block_5 = CodeBlock { "true"; }
copyByVector = Custom[Element.CopyByVector](element=python_script_2@@L2, vector=byTwoPoints, rehostToClosestLevel=code_block_5)  # Copies an element or a list of elements by a given vector.

clean = List.Clean(list=copyByVector)

# group: Create new circuit on Panel and assign elementset to new circuit
python_script_3 = Python(IN[0]=clean)
# ---------- python_script_3.python (62 lines) ----------
import clr
clr.AddReference('ProtoGeometry')
from Autodesk.DesignScript.Geometry import *

clr.AddReference('RevitServices')
import RevitServices
from RevitServices.Persistence import DocumentManager
from RevitServices.Transactions import TransactionManager
from System.Collections.Generic import *

clr.AddReference('RevitNodes')
import Revit
clr.ImportExtensions(Revit.Elements)

clr.AddReference('RevitAPI')
import Autodesk
from Autodesk.Revit.DB import *
from Autodesk.Revit.DB.Electrical import *
from Autodesk.Revit.DB import MEPSystem

clr.AddReference('DSCoreNodes')
import DSCore
from DSCore.List import *

import sys
pyt_path = r'C:\Program Files (x86)\IronPython 2.7\Lib'
sys.path.append(pyt_path)

# Import List ( ICollection(ElementId) = List[ElementId]() )
clr.AddReference("System")
from System.Collections.Generic import List 

#The inputs to this node will be stored as a list in the IN variables.
input = UnwrapElement(IN[0])

ElectComponents = []
NewCircuit = []

for sublist in input:
	sub = List[ElementId]()
	ElectComponents.append(sub)
	for item in sublist:
		sub.Add(item.Id)


doc = DocumentManager.Instance.CurrentDBDocument
uiapp = DocumentManager.Instance.CurrentUIApplication
app = uiapp.Application
uidoc = DocumentManager.Instance.CurrentUIApplication.ActiveUIDocument

ListNewCircuit = []

TransactionManager.Instance.EnsureInTransaction(doc)

for e in ElectComponents:
	NewCircuit = doc.Create.NewElectricalSystem(e, ElectricalSystemType.PowerCircuit)
	ListNewCircuit.append(NewCircuit)

TransactionManager.Instance.TransactionTaskDone()


OUT = ListNewCircuit
# ----------------------------------------

Destination_Panel = Input()  # ""Destination Panel""

# group: Select panel. IN[0] = Electrical System IN[1] = Panel element
python_script_4 = Python(IN[0]=python_script_3, IN[1]=Destination_Panel)
# ---------- python_script_4.python (51 lines) ----------
import clr
clr.AddReference('ProtoGeometry')
from Autodesk.DesignScript.Geometry import *

clr.AddReference('RevitServices')
import RevitServices
from RevitServices.Persistence import DocumentManager
from RevitServices.Transactions import TransactionManager
from System.Collections.Generic import *

clr.AddReference('RevitNodes')
import Revit
clr.ImportExtensions(Revit.Elements)

clr.AddReference('RevitAPI')
import Autodesk
from Autodesk.Revit.DB import *
from Autodesk.Revit.DB.Electrical import *
from Autodesk.Revit.DB import MEPSystem

clr.AddReference('DSCoreNodes')
import DSCore
from DSCore.List import *

import sys
pyt_path = r'C:\Program Files (x86)\IronPython 2.7\Lib'
sys.path.append(pyt_path)

# Import List ( ICollection(ElementId) = List[ElementId]() )
clr.AddReference("System")
from System.Collections.Generic import List 


circuit = UnwrapElement(IN[0])
panel = UnwrapElement(IN[1])

doc = DocumentManager.Instance.CurrentDBDocument
uiapp = DocumentManager.Instance.CurrentUIApplication
app = uiapp.Application
uidoc = DocumentManager.Instance.CurrentUIApplication.ActiveUIDocument

TransactionManager.Instance.EnsureInTransaction(doc)

for _ in circuit:
	_.SelectPanel(panel)

TransactionManager.Instance.TransactionTaskDone()

#Assign your output to the OUT variable.
OUT = []
OUT = circuit, panel
# ----------------------------------------

# group: GET CIRCUIT PARAMETERS TO BE COPIED
string_5 = StringInput("Rating")
getParameterValueByName_4 = Element.GetParameterValueByName(element=sortByKey.sorted_list, parameterName=string_5)
string_6 = StringInput("Load Name")
getParameterValueByName_5 = Element.GetParameterValueByName(element=sortByKey.sorted_list, parameterName=string_6)

Load_Name_Search_For = Input()  # ""Load Name - Search For""
Load_Name_Replace_With = Input()  # ""Load Name - Replace With""

# group: FIND AND REPLACE CIRCUIT NAME
string_7 = StringInput("224")
string_8 = StringInput("230")
replace = String.Replace(str=getParameterValueByName_5, searchFor=Load_Name_Search_For, replaceWith=Load_Name_Replace_With)

# group: SET RATING AND LOAD NAME FOR CIRCUITS
string_9 = StringInput("Rating")
setParameterByName = Element.SetParameterByName(element=python_script_3, parameterName=string_9, value=getParameterValueByName_4)
string_10 = StringInput("Load Name")
setParameterByName_2 = Element.SetParameterByName(element=python_script_3, parameterName=string_10, value=replace)

select_phase = RevitPhases("Suite 230")
string_11 = StringInput("Phase Created")
Set_Phase = Input()  # ""Set Phase""
setParameterByName_3 = Element.SetParameterByName(element=clean, parameterName=string_11, value=Set_Phase)
string_12 = StringInput("Workset")

# group: GET WORKSET OF ELEMENTS
string_13 = StringInput("Workset")
getParameterValueByName_6 = Element.GetParameterValueByName(element=python_script_2, parameterName=string_13)

setParameterByName_4 = Element.SetParameterByName(element=clean, parameterName=string_12, value=getParameterValueByName_6)
Out_Elements = Output(clean)  # "Out "Elements""
Out_Circuits = Output(python_script_3)  # "Out "Circuits""
