# Dynamo graph 1.3.2 POWER COPIED ELEMENTS (DYNAMO PLAYER).dyn (Dynamo 1.3.2.2480)

set_phase = RevitPhases("Suite 230")

# group: FIND REPLACE
load_name_search_for = StringInput("224")
load_name_replace_with = StringInput("230")

# group: ORIGIN AND DESTINATION PANELS
origin_panel = DSModelElementSelection()  # 1 picked in the model
destination_panel = DSModelElementSelection()  # 1 picked in the model

# group: ORIGIN AND DESTINATION LOCATIONS
origin_location = DSModelElementSelection()  # 1 picked in the model
destination_location = DSModelElementSelection()  # 1 picked in the model

n1_3_2_node_copy_and_power = Custom[1.3.2 NODE - COPY AND POWER (NODE TO CODE)](Set_Phase=set_phase, Load_Name_Search_For=load_name_search_for, Load_Name_Replace_With=load_name_replace_with, Origin_Location=origin_panel, Destination_Location=destination_panel, Origin_Panel=origin_location, Destination_Panel=destination_location)  # "1.3.2 NODE - COPY AND POWER"; Copys elements froma panel and powers them to a new panel.
watch = Watch(n1_3_2_node_copy_and_power.Circuits)
watch_2 = Watch(n1_3_2_node_copy_and_power.Elements)
