# Dynamo graph 1.3.2 POWER COPIED ELEMENTS (EASY).dyn (Dynamo 1.3.2.2480)

select_phase = RevitPhases("Suite 230")

# group: FIND REPLACE
string = StringInput("224")
string_2 = StringInput("230")

# group: ORIGIN AND DESTINATION PANELS
select_model_element = DSModelElementSelection()  # 1 picked in the model
select_model_element_2 = DSModelElementSelection()  # 1 picked in the model

# group: ORIGIN AND DESTINATION LOCATIONS
select_model_element_3 = DSModelElementSelection()  # 1 picked in the model
select_model_element_4 = DSModelElementSelection()  # 1 picked in the model

n1_3_2_node_copy_and_power = Custom[1.3.2 NODE - COPY AND POWER](Set_Phase=select_phase, Load_Name_Search_For=string, Load_Name_Replace_With=string_2, Origin_Location=select_model_element, Destination_Location=select_model_element_2, Origin_Panel=select_model_element_3, Destination_Panel=select_model_element_4)  # Copys elements froma panel and powers them to a new panel.
