# Dynamo graph 1.3.2 POWER COPIED ELEMENTS - (WITH TAGS EXPERIMENT).dyn (Dynamo 1.3.2.2480)

code_block = CodeBlock { Origin Panel; }
select_model_element = DSModelElementSelection()  # 1 picked in the model
code_block_2 = CodeBlock { Origin Element Location; }
code_block_3 = CodeBlock { Destination Element Location; }

# group: GET ALL CIRCUITED ELEMENTS
categories = Categories("ElectricalCircuit")
all_elements_of_category = ElementsOfCategory(categories)
python_script = Python(IN[0]=all_elements_of_category)
# ---------- python_script.python (18 lines) ----------
import clr
clr.AddReference('ProtoGeometry')
from Autodesk.DesignScript.Geometry import *
#The inputs to this node will be stored as a list in the IN variables.
systems = UnwrapElement(IN[0])
panels = []
elements = []

for x in systems:
	panels.append(x.BaseEquipment)
	sublist = []
	elementset = x.Elements
	for x in elementset:
		sublist.append(x)
	elements.append(sublist)

#Assign your output to the OUT variable.
OUT = elements
# ----------------------------------------
watch = Watch(python_script)

# group: GET ELEMENTS ONLY CIRCUITED TO CHOSEN PANEL
string = StringInput("Panel : ")
string_2 = StringInput("Panel Name")
getParameterValueByName = Element.GetParameterValueByName(element=select_model_element, parameterName=string_2)
add = string + getParameterValueByName
string_3 = StringInput("Panel")
getParameterValueByName_2 = Element.GetParameterValueByName(element=all_elements_of_category, parameterName=string_3)
eq = getParameterValueByName == getParameterValueByName_2
filterByBoolMask = List.FilterByBoolMask(list=all_elements_of_category, mask=eq)

# group: SORT CIRCUIT BY CIRCUIT NUMBER
string_4 = StringInput("Circuit Number")
getParameterValueByName_3 = Element.GetParameterValueByName(element=filterByBoolMask.in, parameterName=string_4)
sortDuplicateStrings = Lists.Strings.SortDuplicateStrings(getParameterValueByName_3)
toNumber = String.ToNumber(sortDuplicateStrings@L1)
sortByKey = List.SortByKey(list=filterByBoolMask.in, keys=toNumber)

python_script_2 = Python(IN[0]=sortByKey.sorted_list)  # same code as python_script
select_model_element_2 = DSModelElementSelection()  # 1 picked in the model
select_model_element_3 = DSModelElementSelection()  # 1 picked in the model

# group: COPY ELEMENTS TO FROM START POINT TO END POINT
getLocation = Element.GetLocation(select_model_element_2)
getLocation_2 = Element.GetLocation(select_model_element_3)
byTwoPoints = Vector.ByTwoPoints(start=getLocation, end=getLocation_2)
code_block_4 = CodeBlock { "true"; }
copyByVector = Custom[Element.CopyByVector](element=python_script_2@@L2, vector=byTwoPoints, rehostToClosestLevel=code_block_4)  # Copies an element or a list of elements by a given vector.

clean = List.Clean(list=copyByVector)

# group: SET PHASE
select_phase = RevitPhases("Suite 236")

code_block_5 = CodeBlock { Destination Panel; }

# group: Create new circuit on Panel and assign elementset to new circuit
python_script_3 = Python(IN[0]=clean)
# ---------- python_script_3.python (62 lines) ----------
import clr
clr.AddReference('ProtoGeometry')
from Autodesk.DesignScript.Geometry import *

clr.AddReference('RevitServices')
import RevitServices
from RevitServices.Persistence import DocumentManager
from RevitServices.Transactions import TransactionManager
from System.Collections.Generic import *

clr.AddReference('RevitNodes')
import Revit
clr.ImportExtensions(Revit.Elements)

clr.AddReference('RevitAPI')
import Autodesk
from Autodesk.Revit.DB import *
from Autodesk.Revit.DB.Electrical import *
from Autodesk.Revit.DB import MEPSystem

clr.AddReference('DSCoreNodes')
import DSCore
from DSCore.List import *

import sys
pyt_path = r'C:\Program Files (x86)\IronPython 2.7\Lib'
sys.path.append(pyt_path)

# Import List ( ICollection(ElementId) = List[ElementId]() )
clr.AddReference("System")
from System.Collections.Generic import List 

#The inputs to this node will be stored as a list in the IN variables.
input = UnwrapElement(IN[0])

ElectComponents = []
NewCircuit = []

for sublist in input:
	sub = List[ElementId]()
	ElectComponents.append(sub)
	for item in sublist:
		sub.Add(item.Id)


doc = DocumentManager.Instance.CurrentDBDocument
uiapp = DocumentManager.Instance.CurrentUIApplication
app = uiapp.Application
uidoc = DocumentManager.Instance.CurrentUIApplication.ActiveUIDocument

ListNewCircuit = []

TransactionManager.Instance.EnsureInTransaction(doc)

for e in ElectComponents:
	NewCircuit = doc.Create.NewElectricalSystem(e, ElectricalSystemType.PowerCircuit)
	ListNewCircuit.append(NewCircuit)

TransactionManager.Instance.TransactionTaskDone()


OUT = ListNewCircuit
# ----------------------------------------

select_model_element_4 = DSModelElementSelection()  # 1 picked in the model

# group: Select panel. IN[0] = Electrical System IN[1] = Panel element
python_script_4 = Python(IN[0]=python_script_3, IN[1]=select_model_element_4)
# ---------- python_script_4.python (51 lines) ----------
import clr
clr.AddReference('ProtoGeometry')
from Autodesk.DesignScript.Geometry import *

clr.AddReference('RevitServices')
import RevitServices
from RevitServices.Persistence import DocumentManager
from RevitServices.Transactions import TransactionManager
from System.Collections.Generic import *

clr.AddReference('RevitNodes')
import Revit
clr.ImportExtensions(Revit.Elements)

clr.AddReference('RevitAPI')
import Autodesk
from Autodesk.Revit.DB import *
from Autodesk.Revit.DB.Electrical import *
from Autodesk.Revit.DB import MEPSystem

clr.AddReference('DSCoreNodes')
import DSCore
from DSCore.List import *

import sys
pyt_path = r'C:\Program Files (x86)\IronPython 2.7\Lib'
sys.path.append(pyt_path)

# Import List ( ICollection(ElementId) = List[ElementId]() )
clr.AddReference("System")
from System.Collections.Generic import List 


circuit = UnwrapElement(IN[0])
panel = UnwrapElement(IN[1])

doc = DocumentManager.Instance.CurrentDBDocument
uiapp = DocumentManager.Instance.CurrentUIApplication
app = uiapp.Application
uidoc = DocumentManager.Instance.CurrentUIApplication.ActiveUIDocument

TransactionManager.Instance.EnsureInTransaction(doc)

for _ in circuit:
	_.SelectPanel(panel)

TransactionManager.Instance.TransactionTaskDone()

#Assign your output to the OUT variable.
OUT = []
OUT = circuit, panel
# ----------------------------------------

# group: GET CIRCUIT PARAMETERS TO BE COPIED
string_5 = StringInput("Rating")
getParameterValueByName_4 = Element.GetParameterValueByName(element=sortByKey.sorted_list, parameterName=string_5)
string_6 = StringInput("Load Name")
getParameterValueByName_5 = Element.GetParameterValueByName(element=sortByKey.sorted_list, parameterName=string_6)

# group: FIND AND REPLACE CIRCUIT NAME
string_7 = StringInput("224")
string_8 = StringInput("236")
replace = String.Replace(str=getParameterValueByName_5, searchFor=string_7, replaceWith=string_8)

# group: SET RATING AND LOAD NAME FOR CIRCUITS
string_9 = StringInput("Rating")
setParameterByName = Element.SetParameterByName(element=python_script_3, parameterName=string_9, value=getParameterValueByName_4)
string_10 = StringInput("Load Name")
setParameterByName_2 = Element.SetParameterByName(element=python_script_3, parameterName=string_10, value=replace)

# group: GET WORKSET OF ELEMENTS
string_11 = StringInput("Workset")
getParameterValueByName_6 = Element.GetParameterValueByName(element=python_script_2, parameterName=string_11)

# group: SET PHASE AND WORKSET
string_12 = StringInput("Phase Created")
setParameterByName_3 = Element.SetParameterByName(element=clean, parameterName=string_12, value=select_phase)
string_13 = StringInput("Workset")
setParameterByName_4 = Element.SetParameterByName(element=clean, parameterName=string_13, value=getParameterValueByName_6)

select_model_elements = DSModelElementsSelection()  # 4 picked in the model
watch_2 = Watch(python_script_2)
getCategory = Element.GetCategory(watch_2)
uniqueItems = List.UniqueItems(getCategory)
string_from_object = FromObject(uniqueItems)
code_block_6 = CodeBlock { -1; }
code_block_7 = CodeBlock { 1; }
remove = String.Remove(str=string_from_object, startIndex=code_block_6, count=code_block_7)
sortDuplicateStrings_2 = Lists.Strings.SortDuplicateStrings(remove)
code_block_8 = CodeBlock { " Tags"; }
add_2 = sortDuplicateStrings_2 + code_block_8
byName = Category.ByName(add_2@L1)
all_elements_of_category_2 = ElementsOfCategory(byName)
flatten = Flatten(all_elements_of_category_2@L1)

# group: Obtain all the elements the tags are tagging and their element id
taggedElement = Tag.TaggedElement(flatten)
id = Element.Id(taggedElement)

# group: Group the tags by the element ids (this is for when something is tagged multiple times or in multiple views)
groupByKey = List.GroupByKey(list=flatten, keys=id)

# group: Dictionaries provide a way to look stuff up by a given key
code_block_9 = CodeBlock(taggedElement=groupByKey.groups, tag=groupByKey.unique_keys)
# ---------- code_block_9.designscript (4 lines) ----------
//declare a new dictionary to store this in
tagDictionary = {};
//dictionary[whatToLookUpBy] = tagElement
tagDictionary[taggedElement] = tag;
# ----------------------------------------

# group: Sample element selected manually to get the tags for
id_2 = Element.Id(watch_2)

# group: Retrieve the related tags for the given element from the dictionary
code_block_10 = CodeBlock(tagDictionary=code_block_9.tagDictionary, taggedElement=id_2) { tagDictionary[taggedElement]; }
