# Dynamo graph 1.3.2 POWER COPIED ELEMENTS - (WITH TAGS).dyn (Dynamo 1.3.2.2480)

code_block = CodeBlock { Origin Panel; }
code_block_2 = CodeBlock { Destination Panel; }
select_model_element = DSModelElementSelection()  # 1 picked in the model
code_block_3 = CodeBlock { Origin Element Location; }
code_block_4 = CodeBlock { Destination Element Location; }

# group: GET ALL CIRCUITED ELEMENTS
categories = Categories("ElectricalCircuit")
all_elements_of_category = ElementsOfCategory(categories)
watch = Watch(all_elements_of_category)

# group: GET ELEMENTS ONLY CIRCUITED TO CHOSEN PANEL
string = StringInput("Panel : ")
string_2 = StringInput("Panel Name")
getParameterValueByName = Element.GetParameterValueByName(element=select_model_element, parameterName=string_2)
add = string + getParameterValueByName
string_3 = StringInput("Panel")
getParameterValueByName_2 = Element.GetParameterValueByName(element=watch, parameterName=string_3)
eq = getParameterValueByName == getParameterValueByName_2
filterByBoolMask = List.FilterByBoolMask(list=watch, mask=eq)

# group: SORT CIRCUIT BY CIRCUIT NUMBER
string_4 = StringInput("Circuit Number")
getParameterValueByName_3 = Element.GetParameterValueByName(element=filterByBoolMask.in, parameterName=string_4)
sortDuplicateStrings = Lists.Strings.SortDuplicateStrings(getParameterValueByName_3)
toNumber = String.ToNumber(sortDuplicateStrings@L1)
sortByKey = List.SortByKey(list=filterByBoolMask.in, keys=toNumber)

# group: GET ELEMENT GROUPS FROM CIRCUITS
python_script = Python(IN[0]=sortByKey.sorted_list)
# ---------- python_script.python (18 lines) ----------
import clr
clr.AddReference('ProtoGeometry')
from Autodesk.DesignScript.Geometry import *
#The inputs to this node will be stored as a list in the IN variables.
systems = UnwrapElement(IN[0])
panels = []
elements = []

for x in systems:
	panels.append(x.BaseEquipment)
	sublist = []
	elementset = x.Elements
	for x in elementset:
		sublist.append(x)
	elements.append(sublist)

#Assign your output to the OUT variable.
OUT = elements
# ----------------------------------------

select_model_element_2 = DSModelElementSelection()  # 1 picked in the model
select_model_element_3 = DSModelElementSelection()  # 1 picked in the model

# group: COPY ELEMENTS TO FROM START POINT TO END POINT
getLocation = Element.GetLocation(select_model_element_2)
getLocation_2 = Element.GetLocation(select_model_element_3)
byTwoPoints = Vector.ByTwoPoints(start=getLocation, end=getLocation_2)
code_block_5 = CodeBlock { "true"; }
copyByVector = Custom[Element.CopyByVector](element=python_script@@L2, vector=byTwoPoints, rehostToClosestLevel=code_block_5)  # Copies an element or a list of elements by a given vector.

clean = List.Clean(list=copyByVector)

# group: SET PHASE
select_phase = RevitPhases("Suite 236")

# group: GET WORKSET OF ELEMENTS
string_5 = StringInput("Workset")
getParameterValueByName_4 = Element.GetParameterValueByName(element=python_script, parameterName=string_5)

# group: SET PHASE AND WORKSET
string_6 = StringInput("Phase Created")
setParameterByName = Element.SetParameterByName(element=clean, parameterName=string_6, value=select_phase)
string_7 = StringInput("Workset")
setParameterByName_2 = Element.SetParameterByName(element=clean, parameterName=string_7, value=getParameterValueByName_4)

# group: Create new circuit on Panel and assign elementset to new circuit
python_script_2 = Python(IN[0]=clean)
# ---------- python_script_2.python (62 lines) ----------
import clr
clr.AddReference('ProtoGeometry')
from Autodesk.DesignScript.Geometry import *

clr.AddReference('RevitServices')
import RevitServices
from RevitServices.Persistence import DocumentManager
from RevitServices.Transactions import TransactionManager
from System.Collections.Generic import *

clr.AddReference('RevitNodes')
import Revit
clr.ImportExtensions(Revit.Elements)

clr.AddReference('RevitAPI')
import Autodesk
from Autodesk.Revit.DB import *
from Autodesk.Revit.DB.Electrical import *
from Autodesk.Revit.DB import MEPSystem

clr.AddReference('DSCoreNodes')
import DSCore
from DSCore.List import *

import sys
pyt_path = r'C:\Program Files (x86)\IronPython 2.7\Lib'
sys.path.append(pyt_path)

# Import List ( ICollection(ElementId) = List[ElementId]() )
clr.AddReference("System")
from System.Collections.Generic import List 

#The inputs to this node will be stored as a list in the IN variables.
input = UnwrapElement(IN[0])

ElectComponents = []
NewCircuit = []

for sublist in input:
	sub = List[ElementId]()
	ElectComponents.append(sub)
	for item in sublist:
		sub.Add(item.Id)


doc = DocumentManager.Instance.CurrentDBDocument
uiapp = DocumentManager.Instance.CurrentUIApplication
app = uiapp.Application
uidoc = DocumentManager.Instance.CurrentUIApplication.ActiveUIDocument

ListNewCircuit = []

TransactionManager.Instance.EnsureInTransaction(doc)

for e in ElectComponents:
	NewCircuit = doc.Create.NewElectricalSystem(e, ElectricalSystemType.PowerCircuit)
	ListNewCircuit.append(NewCircuit)

TransactionManager.Instance.TransactionTaskDone()


OUT = ListNewCircuit
# ----------------------------------------

# group: GET CIRCUIT PARAMETERS TO BE COPIED
string_8 = StringInput("Rating")
getParameterValueByName_5 = Element.GetParameterValueByName(element=sortByKey.sorted_list, parameterName=string_8)
string_9 = StringInput("Load Name")
getParameterValueByName_6 = Element.GetParameterValueByName(element=sortByKey.sorted_list, parameterName=string_9)

# group: FIND AND REPLACE CIRCUIT NAME
string_10 = StringInput("230")
string_11 = StringInput("236")
replace = String.Replace(str=getParameterValueByName_6, searchFor=string_10, replaceWith=string_11)

# group: SET RATING AND LOAD NAME FOR CIRCUITS
string_12 = StringInput("Rating")
setParameterByName_3 = Element.SetParameterByName(element=python_script_2, parameterName=string_12, value=getParameterValueByName_5)
string_13 = StringInput("Load Name")
setParameterByName_4 = Element.SetParameterByName(element=python_script_2, parameterName=string_13, value=replace)

select_model_element_4 = DSModelElementSelection()  # 1 picked in the model

# group: Select panel. IN[1] = Electrical System IN[0] = Panel element
python_script_3 = Python(IN[0]=select_model_element_4, IN[1]=python_script_2)
# ---------- python_script_3.python (45 lines) ----------
import clr

clr.AddReference("RevitServices")
import RevitServices
from RevitServices.Persistence import DocumentManager
from RevitServices.Transactions import TransactionManager
doc = DocumentManager.Instance.CurrentDBDocument

clr.AddReference("RevitAPI")
import Autodesk
from Autodesk.Revit.DB import *

clr.AddReference("RevitNodes")
import Revit
clr.ImportExtensions(Revit.Elements)
clr.ImportExtensions(Revit.GeometryConversion)

succes = []
failed = []

def AddToPanel(panel,circuits):
	TransactionManager.Instance.EnsureInTransaction(doc)
	if hasattr(circuits, "__iter__"):
		for circuit in circuits:
			try:
				circuit.SelectPanel(panel)
				succes.append(circuit.ToDSType(True))
			except:
				failed.append(circuit.ToDSType(True))
	else:
		try:
			circuits.SelectPanel(panel)
			succes.append(circuits.ToDSType(True))
		except:
			failed.append(circuits.ToDSType(True))
	TransactionManager.Instance.TransactionTaskDone()
	

if isinstance(IN[0], list):
	for i,sys in enumerate(UnwrapElement(IN[0])):
		AddToPanel(sys,UnwrapElement(IN[1])[i])
else:
	AddToPanel(UnwrapElement(IN[0]),UnwrapElement(IN[1]))

OUT = succes, failed
# ----------------------------------------

# group: CIRCUIT FILTER
code_block_6 = CodeBlock { "Load Classification"; }
getParameterValueByName_7 = Element.GetParameterValueByName(element=all_elements_of_category, parameterName=code_block_6)
code_block_7 = CodeBlock { "Lighting"; }
eq_2 = getParameterValueByName_7 == code_block_7
filterByBoolMask_2 = List.FilterByBoolMask(list=all_elements_of_category, mask=eq_2)

# group: Select annotation in origin view
select_annotation_in_origin_view = DSModelElementSelection()  # 1 picked in the model
python_script_4 = Python(IN[0]=select_annotation_in_origin_view)
# ---------- python_script_4.python (21 lines) ----------
import clr

clr.AddReference("RevitServices")
import RevitServices
from RevitServices.Persistence import DocumentManager
doc =  DocumentManager.Instance.CurrentDBDocument

if isinstance(IN[0], list):
	tags = UnwrapElement(IN[0])
else:
	tags = [UnwrapElement(IN[0])]

listout = []

for x in tags:
	Id = x.OwnerViewId
	view = doc.GetElement(Id)
	listout.append(view)


OUT = listout
# ----------------------------------------

# group: Select annotation in Destination view
select_annotation_in_destination = DSModelElementSelection()  # "Select annotation in Destination view"; 1 picked in the model
python_script_5 = Python(IN[0]=select_annotation_in_destination)  # same code as python_script_4

watch_2 = Watch()  # unwired: arg0
flatten = Flatten(watch_2)
getCategory = Element.GetCategory(flatten)
uniqueItems = List.UniqueItems(getCategory)
string_from_object = FromObject(uniqueItems)
code_block_8 = CodeBlock { -1; }
code_block_9 = CodeBlock { 1; }
remove = String.Remove(str=string_from_object, startIndex=code_block_8, count=code_block_9)
sortDuplicateStrings_2 = Lists.Strings.SortDuplicateStrings(remove)
code_block_10 = CodeBlock { " Tags"; }
add_2 = sortDuplicateStrings_2 + code_block_10
byName = Category.ByName(add_2@L1)
all_elements_of_category_2 = ElementsOfCategory(byName)
flatten_2 = Flatten(all_elements_of_category_2@L1)

# group: Obtain all the elements the tags are tagging and their element id
taggedElement = Tag.TaggedElement(flatten_2)
id = Element.Id(taggedElement)

# group: Group the tags by the element ids (this is for when something is tagged multiple times or in multiple views)
groupByKey = List.GroupByKey(list=flatten_2, keys=id)

# group: Dictionaries provide a way to look stuff up by a given key
code_block_11 = CodeBlock(taggedElement=groupByKey.groups, tag=groupByKey.unique_keys)
# ---------- code_block_11.designscript (4 lines) ----------
//declare a new dictionary to store this in
tagDictionary = {};
//dictionary[whatToLookUpBy] = tagElement
tagDictionary[taggedElement] = tag;
# ----------------------------------------

# group: Sample element selected manually to get the tags for
id_2 = Element.Id(flatten)

# group: Retrieve the related tags for the given element from the dictionary
code_block_12 = CodeBlock(tagDictionary=code_block_11.tagDictionary, taggedElement=id_2) { tagDictionary[taggedElement]; }

flatten_3 = Flatten(code_block_12)
removeNulls = Lists.Manage.RemoveNulls(flatten_3)
id_3 = Element.Id(python_script_4)
python_script_6 = Python(IN[0]=removeNulls)  # same code as python_script_4
id_4 = Element.Id(python_script_6)
eq_3 = id_3 == id_4@L1
flatten_4 = Flatten(eq_3)

# group: TAG VIEW FILTER
filterByBoolMask_3 = List.FilterByBoolMask(list=removeNulls, mask=flatten_4)

asPoint = Vector.AsPoint(byTwoPoints)
byOrigin = CoordinateSystem.ByOrigin(asPoint)

# group: Copy tags from Origin View to Destination View
python_script_7 = Python(IN[0]=python_script_4, IN[1]=python_script_5, IN[2]=filterByBoolMask_3.in, IN[3]=byOrigin)
# ---------- python_script_7.python (41 lines) ----------
import clr

clr.AddReference('RevitServices')
from RevitServices.Persistence import DocumentManager
from RevitServices.Transactions import TransactionManager
doc = DocumentManager.Instance.CurrentDBDocument

clr.AddReference('RevitAPI')
from Autodesk.Revit.DB import *

from System.Collections.Generic import List

clr.AddReference('RevitNodes')
import Revit
clr.ImportExtensions(Revit.Elements)
clr.ImportExtensions(Revit.GeometryConversion)

def singleton(x):
	if hasattr(x,'__iter__'): return x[0]
	else : return x

def tolist(x):
	if hasattr(x,'__iter__'): return x
	else : return [x]

source = UnwrapElement(singleton(IN[0]) )
dest = UnwrapElement(singleton(IN[1]) )
elements = UnwrapElement(tolist(IN[2]) )
tf1 = singleton(IN[3])

if tf1 is not None:
	tf1 = tf1.ToTransform(True)

eId = List[ElementId](e.Id for e in elements if hasattr(e, "Id") )

TransactionManager.Instance.EnsureInTransaction(doc)
copy = ElementTransformUtils.CopyElements(source, eId, dest, tf1, None)
TransactionManager.Instance.TransactionTaskDone()

#OUT = [doc.GetElement(i).ToDSType(False) for i in copy]
OUT = copy
# ----------------------------------------

byElementId = archilab.Revit.Selection.Select.ByElementId(python_script_7)
python_script_8 = Python()  # unwired: IN[0], IN[1]
# ---------- python_script_8.python (51 lines) ----------
import clr
clr.AddReference('ProtoGeometry')
from Autodesk.DesignScript.Geometry import *

clr.AddReference('RevitServices')
import RevitServices
from RevitServices.Persistence import DocumentManager
from RevitServices.Transactions import TransactionManager
from System.Collections.Generic import *

clr.AddReference('RevitNodes')
import Revit
clr.ImportExtensions(Revit.Elements)

clr.AddReference('RevitAPI')
import Autodesk
from Autodesk.Revit.DB import *
from Autodesk.Revit.DB.Electrical import *
from Autodesk.Revit.DB import MEPSystem

clr.AddReference('DSCoreNodes')
import DSCore
from DSCore.List import *

import sys
pyt_path = r'C:\Program Files (x86)\IronPython 2.7\Lib'
sys.path.append(pyt_path)

# Import List ( ICollection(ElementId) = List[ElementId]() )
clr.AddReference("System")
from System.Collections.Generic import List 


circuit = UnwrapElement(IN[0])
panel = UnwrapElement(IN[1])

doc = DocumentManager.Instance.CurrentDBDocument
uiapp = DocumentManager.Instance.CurrentUIApplication
app = uiapp.Application
uidoc = DocumentManager.Instance.CurrentUIApplication.ActiveUIDocument

TransactionManager.Instance.EnsureInTransaction(doc)

for _ in circuit:
	_.SelectPanel(panel)

TransactionManager.Instance.TransactionTaskDone()

#Assign your output to the OUT variable.
OUT = []
OUT = circuit, panel
# ----------------------------------------
