# Dynamo graph 1.3.2 POWER COPIED ELEMENTS - Tag experiment.dyn (Dynamo 1.3.2.2480)

code_block = CodeBlock { Origin Element Location; }
code_block_2 = CodeBlock { Destination Element Location; }
select_model_elements = DSModelElementsSelection()  # 3 picked in the model
select_model_element = DSModelElementSelection()  # 1 picked in the model
select_model_element_2 = DSModelElementSelection()  # 1 picked in the model

# group: COPY ELEMENTS TO FROM START POINT TO END POINT
getLocation = Element.GetLocation(select_model_element)
getLocation_2 = Element.GetLocation(select_model_element_2)
byTwoPoints = Vector.ByTwoPoints(start=getLocation, end=getLocation_2)
code_block_3 = CodeBlock { "true"; }
copyByVector = Custom[Element.CopyByVector](element=select_model_elements@@L2, vector=byTwoPoints, rehostToClosestLevel=code_block_3)  # Copies an element or a list of elements by a given vector.

select_model_elements_2 = DSModelElementsSelection()  # 4 picked in the model
watch = Watch(select_model_elements)
getCategory = Element.GetCategory(watch)
uniqueItems = List.UniqueItems(getCategory)
string_from_object = FromObject(uniqueItems)
code_block_4 = CodeBlock { -1; }
code_block_5 = CodeBlock { 1; }
remove = String.Remove(str=string_from_object, startIndex=code_block_4, count=code_block_5)
sortDuplicateStrings = Lists.Strings.SortDuplicateStrings(remove)
code_block_6 = CodeBlock { " Tags"; }
add = sortDuplicateStrings + code_block_6
byName = Category.ByName(add@L1)
all_elements_of_category = ElementsOfCategory(byName)
flatten = Flatten(all_elements_of_category@L1)

# group: Obtain all the elements the tags are tagging and their element id
taggedElement = Tag.TaggedElement(flatten)
id = Element.Id(taggedElement)

# group: Group the tags by the element ids (this is for when something is tagged multiple times or in multiple views)
groupByKey = List.GroupByKey(list=flatten, keys=id)

# group: Dictionaries provide a way to look stuff up by a given key
code_block_7 = CodeBlock(taggedElement=groupByKey.groups, tag=groupByKey.unique_keys)
# ---------- code_block_7.designscript (4 lines) ----------
//declare a new dictionary to store this in
tagDictionary = {};
//dictionary[whatToLookUpBy] = tagElement
tagDictionary[taggedElement] = tag;
# ----------------------------------------

# group: Sample element selected manually to get the tags for
id_2 = Element.Id(watch)

# group: Retrieve the related tags for the given element from the dictionary
code_block_8 = CodeBlock(tagDictionary=code_block_7.tagDictionary, taggedElement=id_2) { tagDictionary[taggedElement]; }

# group: COPY ELEMENTS TO FROM START POINT TO END POINT
getLocation_3 = Element.GetLocation(select_model_element)
getLocation_4 = Element.GetLocation(select_model_element_2)
byTwoPoints_2 = Vector.ByTwoPoints(start=getLocation_3, end=getLocation_4)
code_block_9 = CodeBlock { "true"; }
copyByVector_2 = Custom[Element.CopyByVector](element=code_block_8@@L2, vector=byTwoPoints_2, rehostToClosestLevel=code_block_9)
