# Dynamo graph 1.3.2 POWER COPIED ELEMENTS.dyn (Dynamo 1.3.2.2480)

code_block = CodeBlock { Origin Panel; }
select_model_element = DSModelElementSelection()
code_block_2 = CodeBlock { Origin Element Location; }
code_block_3 = CodeBlock { Destination Element Location; }

# group: GET ALL CIRCUITED ELEMENTS
categories = Categories("ElectricalCircuit")
all_elements_of_category = ElementsOfCategory(categories)
python_script = Python(IN[0]=all_elements_of_category)
# ---------- python_script.python (18 lines) ----------
import clr
clr.AddReference('ProtoGeometry')
from Autodesk.DesignScript.Geometry import *
#The inputs to this node will be stored as a list in the IN variables.
systems = UnwrapElement(IN[0])
panels = []
elements = []

for x in systems:
	panels.append(x.BaseEquipment)
	sublist = []
	elementset = x.Elements
	for x in elementset:
		sublist.append(x)
	elements.append(sublist)

#Assign your output to the OUT variable.
OUT = elements
# ----------------------------------------
watch = Watch(python_script)

# group: GET ELEMENTS ONLY CIRCUITED TO CHOSEN PANEL
string = StringInput("Panel : ")
string_2 = StringInput("Panel Name")
getParameterValueByName = Element.GetParameterValueByName(element=select_model_element, parameterName=string_2)
add = string + getParameterValueByName
string_3 = StringInput("Panel")
getParameterValueByName_2 = Element.GetParameterValueByName(element=all_elements_of_category, parameterName=string_3)
eq = getParameterValueByName == getParameterValueByName_2
filterByBoolMask = List.FilterByBoolMask(list=all_elements_of_category, mask=eq)

# group: SORT CIRCUIT BY CIRCUIT NUMBER
string_4 = StringInput("Circuit Number")
getParameterValueByName_3 = Element.GetParameterValueByName(element=filterByBoolMask.in, parameterName=string_4)
sortDuplicateStrings = Lists.Strings.SortDuplicateStrings(getParameterValueByName_3)
toNumber = String.ToNumber(sortDuplicateStrings@L1)
sortByKey = List.SortByKey(list=filterByBoolMask.in, keys=toNumber)

python_script_2 = Python(IN[0]=sortByKey.sorted_list)  # same code as python_script
select_model_element_2 = DSModelElementSelection()
select_model_element_3 = DSModelElementSelection()

# group: COPY ELEMENTS TO FROM START POINT TO END POINT
getLocation = Element.GetLocation(select_model_element_2)
getLocation_2 = Element.GetLocation(select_model_element_3)
byTwoPoints = Vector.ByTwoPoints(start=getLocation, end=getLocation_2)
code_block_4 = CodeBlock { "true"; }
copyByVector = Custom[Element.CopyByVector](element=python_script_2@@L2, vector=byTwoPoints, rehostToClosestLevel=code_block_4)  # Copies an element or a list of elements by a given vector.

clean = List.Clean(list=copyByVector)

# group: SET PHASE
select_phase = RevitPhases()

code_block_5 = CodeBlock { Destination Panel; }

# group: Create new circuit on Panel and assign elementset to new circuit
python_script_3 = Python(IN[0]=clean)
# ---------- python_script_3.python (62 lines) ----------
import clr
clr.AddReference('ProtoGeometry')
from Autodesk.DesignScript.Geometry import *

clr.AddReference('RevitServices')
import RevitServices
from RevitServices.Persistence import DocumentManager
from RevitServices.Transactions import TransactionManager
from System.Collections.Generic import *

clr.AddReference('RevitNodes')
import Revit
clr.ImportExtensions(Revit.Elements)

clr.AddReference('RevitAPI')
import Autodesk
from Autodesk.Revit.DB import *
from Autodesk.Revit.DB.Electrical import *
from Autodesk.Revit.DB import MEPSystem

clr.AddReference('DSCoreNodes')
import DSCore
from DSCore.List import *

import sys
pyt_path = r'C:\Program Files (x86)\IronPython 2.7\Lib'
sys.path.append(pyt_path)

# Import List ( ICollection(ElementId) = List[ElementId]() )
clr.AddReference("System")
from System.Collections.Generic import List 

#The inputs to this node will be stored as a list in the IN variables.
input = UnwrapElement(IN[0])

ElectComponents = []
NewCircuit = []

for sublist in input:
	sub = List[ElementId]()
	ElectComponents.append(sub)
	for item in sublist:
		sub.Add(item.Id)


doc = DocumentManager.Instance.CurrentDBDocument
uiapp = DocumentManager.Instance.CurrentUIApplication
app = uiapp.Application
uidoc = DocumentManager.Instance.CurrentUIApplication.ActiveUIDocument

ListNewCircuit = []

TransactionManager.Instance.EnsureInTransaction(doc)

for e in ElectComponents:
	NewCircuit = doc.Create.NewElectricalSystem(e, ElectricalSystemType.PowerCircuit)
	ListNewCircuit.append(NewCircuit)

TransactionManager.Instance.TransactionTaskDone()


OUT = ListNewCircuit
# ----------------------------------------

# group: GET CIRCUIT PARAMETERS TO BE COPIED
string_5 = StringInput("Rating")
getParameterValueByName_4 = Element.GetParameterValueByName(element=sortByKey.sorted_list, parameterName=string_5)
string_6 = StringInput("Load Name")
getParameterValueByName_5 = Element.GetParameterValueByName(element=sortByKey.sorted_list, parameterName=string_6)

# group: FIND AND REPLACE CIRCUIT NAME
string_7 = StringInput("142")
string_8 = StringInput("242")
replace = String.Replace(str=getParameterValueByName_5, searchFor=string_7, replaceWith=string_8)

# group: SET RATING AND LOAD NAME FOR CIRCUITS
string_9 = StringInput("Rating")
setParameterByName = Element.SetParameterByName(element=python_script_3, parameterName=string_9, value=getParameterValueByName_4)
string_10 = StringInput("Load Name")
setParameterByName_2 = Element.SetParameterByName(element=python_script_3, parameterName=string_10, value=replace)

# group: GET WORKSET OF ELEMENTS
string_11 = StringInput("Workset")
getParameterValueByName_6 = Element.GetParameterValueByName(element=python_script_2, parameterName=string_11)

# group: SET PHASE AND WORKSET
string_12 = StringInput("Phase Created")
setParameterByName_3 = Element.SetParameterByName(element=clean, parameterName=string_12, value=select_phase)
string_13 = StringInput("Workset")
setParameterByName_4 = Element.SetParameterByName(element=clean, parameterName=string_13, value=getParameterValueByName_6)

select_model_element_4 = DSModelElementSelection()

# group: Select panel. IN[1] = Electrical System IN[0] = Panel element
python_script_4 = Python(IN[0]=select_model_element_4, IN[1]=python_script_3)
# ---------- python_script_4.python (45 lines) ----------
import clr

clr.AddReference("RevitServices")
import RevitServices
from RevitServices.Persistence import DocumentManager
from RevitServices.Transactions import TransactionManager
doc = DocumentManager.Instance.CurrentDBDocument

clr.AddReference("RevitAPI")
import Autodesk
from Autodesk.Revit.DB import *

clr.AddReference("RevitNodes")
import Revit
clr.ImportExtensions(Revit.Elements)
clr.ImportExtensions(Revit.GeometryConversion)

succes = []
failed = []

def AddToPanel(panel,circuits):
	TransactionManager.Instance.EnsureInTransaction(doc)
	if hasattr(circuits, "__iter__"):
		for circuit in circuits:
			try:
				circuit.SelectPanel(panel)
				succes.append(circuit.ToDSType(True))
			except:
				failed.append(circuit.ToDSType(True))
	else:
		try:
			circuits.SelectPanel(panel)
			succes.append(circuits.ToDSType(True))
		except:
			failed.append(circuits.ToDSType(True))
	TransactionManager.Instance.TransactionTaskDone()
	

if isinstance(IN[0], list):
	for i,sys in enumerate(UnwrapElement(IN[0])):
		AddToPanel(sys,UnwrapElement(IN[1])[i])
else:
	AddToPanel(UnwrapElement(IN[0]),UnwrapElement(IN[1]))

OUT = succes, failed
# ----------------------------------------

# group: optional
string_14 = StringInput("PHASE BY SUITE")
setParameterByName_5 = Element.SetParameterByName(element=clean, parameterName=string_14, value=string_8)
string_15 = StringInput("Location")
string_16 = StringInput("Location")
getParameterValueByName_7 = Element.GetParameterValueByName(element=python_script_2, parameterName=string_16)
replace_2 = String.Replace(str=getParameterValueByName_7, searchFor=string_7, replaceWith=string_8)
setParameterByName_6 = Element.SetParameterByName(element=clean, parameterName=string_15, value=replace_2)
