# Dynamo graph 1.3.2 TAG COPIED ELEMENTS.dyn (Dynamo 1.3.2.2480)

# group: Select Destination View
views = Views("Level 1 Duplicate Elements and tags")

# group: Select Origin View
views_2 = Views("Level 1 Orignal")

# group: Select annotation in origin view
select_annotation_in_origin_view = DSModelElementSelection()  # 1 picked in the model
python_script = Python(IN[0]=select_annotation_in_origin_view)
# ---------- python_script.python (21 lines) ----------
import clr

clr.AddReference("RevitServices")
import RevitServices
from RevitServices.Persistence import DocumentManager
doc =  DocumentManager.Instance.CurrentDBDocument

if isinstance(IN[0], list):
	tags = UnwrapElement(IN[0])
else:
	tags = [UnwrapElement(IN[0])]

listout = []

for x in tags:
	Id = x.OwnerViewId
	view = doc.GetElement(Id)
	listout.append(view)


OUT = listout
# ----------------------------------------

# group: Select annotation in Destination view
select_annotation_in_destination = DSModelElementSelection()  # "Select annotation in Destination view"; 1 picked in the model
python_script_2 = Python(IN[0]=select_annotation_in_destination)  # same code as python_script

# group: GET ALL CIRCUITED ELEMENTS
categories = Categories("ElectricalCircuit")
all_elements_of_category = ElementsOfCategory(categories)
python_script_3 = Python(IN[0]=all_elements_of_category)
# ---------- python_script_3.python (18 lines) ----------
import clr
clr.AddReference('ProtoGeometry')
from Autodesk.DesignScript.Geometry import *
#The inputs to this node will be stored as a list in the IN variables.
systems = UnwrapElement(IN[0])
panels = []
elements = []

for x in systems:
	panels.append(x.BaseEquipment)
	sublist = []
	elementset = x.Elements
	for x in elementset:
		sublist.append(x)
	elements.append(sublist)

#Assign your output to the OUT variable.
OUT = elements
# ----------------------------------------
watch = Watch(python_script_3)

select_model_element = DSModelElementSelection()  # 1 picked in the model

# group: GET ELEMENTS ONLY CIRCUITED TO CHOSEN PANEL
string = StringInput("Panel Name")
getParameterValueByName = Element.GetParameterValueByName(element=select_model_element, parameterName=string)
string_2 = StringInput("Panel")
getParameterValueByName_2 = Element.GetParameterValueByName(element=all_elements_of_category, parameterName=string_2)
eq = getParameterValueByName == getParameterValueByName_2
filterByBoolMask = List.FilterByBoolMask(list=all_elements_of_category, mask=eq)
string_3 = StringInput("Panel : ")
add = string_3 + getParameterValueByName

# group: SORT CIRCUIT BY CIRCUIT NUMBER
string_4 = StringInput("Circuit Number")
getParameterValueByName_3 = Element.GetParameterValueByName(element=filterByBoolMask.in, parameterName=string_4)
sortDuplicateStrings = Lists.Strings.SortDuplicateStrings(getParameterValueByName_3)
toNumber = String.ToNumber(sortDuplicateStrings@L1)
sortByKey = List.SortByKey(list=filterByBoolMask.in, keys=toNumber)

python_script_4 = Python(IN[0]=sortByKey.sorted_list)  # same code as python_script_3
watch_2 = Watch(python_script_4)
getCategory = Element.GetCategory(watch_2)
uniqueItems = List.UniqueItems(getCategory)
string_from_object = FromObject(uniqueItems)
code_block = CodeBlock { -1; }
code_block_2 = CodeBlock { 1; }
remove = String.Remove(str=string_from_object, startIndex=code_block, count=code_block_2)
sortDuplicateStrings_2 = Lists.Strings.SortDuplicateStrings(remove)
code_block_3 = CodeBlock { " Tags"; }
add_2 = sortDuplicateStrings_2 + code_block_3
byName = Category.ByName(add_2@L1)
all_elements_of_category_2 = ElementsOfCategory(byName)
flatten = Flatten(all_elements_of_category_2@L1)

# group: Obtain all the elements the tags are tagging and their element id
taggedElement = Tag.TaggedElement(flatten)
id = Element.Id(taggedElement)

# group: Group the tags by the element ids (this is for when something is tagged multiple times or in multiple views)
groupByKey = List.GroupByKey(list=flatten, keys=id)

# group: Dictionaries provide a way to look stuff up by a given key
code_block_4 = CodeBlock(taggedElement=groupByKey.groups, tag=groupByKey.unique_keys)
# ---------- code_block_4.designscript (4 lines) ----------
//declare a new dictionary to store this in
tagDictionary = {};
//dictionary[whatToLookUpBy] = tagElement
tagDictionary[taggedElement] = tag;
# ----------------------------------------

# group: Sample element selected manually to get the tags for
id_2 = Element.Id(watch_2)

# group: Retrieve the related tags for the given element from the dictionary
code_block_5 = CodeBlock(tagDictionary=code_block_4.tagDictionary, taggedElement=id_2) { tagDictionary[taggedElement]; }

flatten_2 = Flatten(code_block_5)

# group: Origin Location Element
select_model_element_2 = DSModelElementSelection()  # 1 picked in the model

# group: Destination Location Element
select_model_element_3 = DSModelElementSelection()  # 1 picked in the model

# group: COPY ELEMENTS TO FROM START POINT TO END POINT
getLocation = Element.GetLocation(select_model_element_2)
getLocation_2 = Element.GetLocation(select_model_element_3)
byTwoPoints = Vector.ByTwoPoints(start=getLocation, end=getLocation_2)

asPoint = Vector.AsPoint(byTwoPoints)
byOrigin = CoordinateSystem.ByOrigin(asPoint)

# group: Copy tags from Origin View to Destination View
python_script_5 = Python(IN[0]=python_script, IN[1]=python_script_2, IN[2]=flatten_2, IN[3]=byOrigin)
# ---------- python_script_5.python (41 lines) ----------
import clr

clr.AddReference('RevitServices')
from RevitServices.Persistence import DocumentManager
from RevitServices.Transactions import TransactionManager
doc = DocumentManager.Instance.CurrentDBDocument

clr.AddReference('RevitAPI')
from Autodesk.Revit.DB import *

from System.Collections.Generic import List

clr.AddReference('RevitNodes')
import Revit
clr.ImportExtensions(Revit.Elements)
clr.ImportExtensions(Revit.GeometryConversion)

def singleton(x):
	if hasattr(x,'__iter__'): return x[0]
	else : return x

def tolist(x):
	if hasattr(x,'__iter__'): return x
	else : return [x]

source = UnwrapElement(singleton(IN[0]) )
dest = UnwrapElement(singleton(IN[1]) )
elements = UnwrapElement(tolist(IN[2]) )
tf1 = singleton(IN[3])

if tf1 is not None:
	tf1 = tf1.ToTransform(True)

eId = List[ElementId](e.Id for e in elements if hasattr(e, "Id") )

TransactionManager.Instance.EnsureInTransaction(doc)
copy = ElementTransformUtils.CopyElements(source, eId, dest, tf1, None)
TransactionManager.Instance.TransactionTaskDone()

#OUT = [doc.GetElement(i).ToDSType(False) for i in copy]
OUT = copy
# ----------------------------------------

byElementId = archilab.Revit.Selection.Select.ByElementId(python_script_5)
create = List.Create()  # unwired: arg0
code_block_6 = CodeBlock { Origin Panel; }
select_model_element_4 = DSModelElementSelection()  # 1 picked in the model
code_block_7 = CodeBlock { Destination Panel; }
