# Dynamo graph 4.16-0041_create areaplans incl. viewtemplate and scopebox.dyn (Dynamo 1.3.2.2480)

categories = Categories("Levels")
all_elements_of_category = ElementsOfCategory(categories)

# group: Viewtemplate
name = Element.Name(all_elements_of_category)
code_block = CodeBlock { "_BVO"; }
code_block_2 = CodeBlock(a=name, b=code_block) { a+b; }
code_block_3 = CodeBlock { "View Name"; }
code_block_4 = CodeBlock { "05.01_BM_area plan oppervlakten_BVO"; }

element_types = ElementTypes("AreaScheme")
all_elements_of_type = ElementsOfType(element_types)
name_2 = Element.Name(all_elements_of_type)

# group: Areaplan
code_block_5 = CodeBlock { 2; }
getItemAtIndex = List.GetItemAtIndex(list=name_2, index=code_block_5)
byLevelName = Custom[AreaPlan.ByLevelName](level=all_elements_of_category, name=code_block_2, schemeName=getItemAtIndex, lacing=Longest)  # "Springs.AreaPlan.ByLevelName"; Creates an area plan at the designated levels. Each new view needs a name. An area scheme must first be activated before it can be used. To activate a scheme, place one view of that type in the project(you can then delete it). If a view with the same scheme and name exists, you'll get a null instead.

# group (continued): Viewtemplate
setParameterByName = Element.SetParameterByName(element=byLevelName, parameterName=code_block_3, value=code_block_2)
apply_viewtemplate = Custom[Apply ViewTemplate](Views=setParameterByName, TempNames=code_block_4)  # Apply ViewTemplate(s) to selected view(s).

# group: Viewtemplate
name_3 = Element.Name(all_elements_of_category)
code_block_6 = CodeBlock { "_VVO"; }
code_block_7 = CodeBlock(a=name_3, b=code_block_6) { a+b; }
code_block_8 = CodeBlock { "View Name"; }
code_block_9 = CodeBlock { "05.21_BM_area plan oppervlakten_VVO"; }

# group: Areaplan
code_block_10 = CodeBlock { 3; }
getItemAtIndex_2 = List.GetItemAtIndex(list=name_2, index=code_block_10)
byLevelName_2 = Custom[AreaPlan.ByLevelName](level=all_elements_of_category, name=code_block_7, schemeName=getItemAtIndex_2, lacing=Longest)  # "Springs.AreaPlan.ByLevelName"

# group (continued): Viewtemplate
setParameterByName_2 = Element.SetParameterByName(element=byLevelName_2, parameterName=code_block_8, value=code_block_7)
apply_viewtemplate_2 = Custom[Apply ViewTemplate](Views=setParameterByName_2, TempNames=code_block_9)

# group: Viewtemplate
name_4 = Element.Name(all_elements_of_category)
code_block_11 = CodeBlock { "_GO"; }
code_block_12 = CodeBlock(a=name_4, b=code_block_11) { a+b; }
code_block_13 = CodeBlock { "View Name"; }
code_block_14 = CodeBlock { "05.31_BM_area plan oppervlakten_GO"; }

# group: Areaplan
code_block_15 = CodeBlock { 4; }
getItemAtIndex_3 = List.GetItemAtIndex(list=name_2, index=code_block_15)
byLevelName_3 = Custom[AreaPlan.ByLevelName](level=all_elements_of_category, name=code_block_12, schemeName=getItemAtIndex_3, lacing=Longest)  # "Springs.AreaPlan.ByLevelName"

# group (continued): Viewtemplate
setParameterByName_3 = Element.SetParameterByName(element=byLevelName_3, parameterName=code_block_13, value=code_block_12)
apply_viewtemplate_3 = Custom[Apply ViewTemplate](Views=setParameterByName_3, TempNames=code_block_14)

# group: Viewtemplate
code_block_16 = CodeBlock { "View Name"; }
name_5 = Element.Name(all_elements_of_category)
code_block_17 = CodeBlock { "_VG"; }
code_block_18 = CodeBlock(a=name_5, b=code_block_17) { a+b; }
setParameterByName_4 = Element.SetParameterByName(parameterName=code_block_16, value=code_block_18)  # unwired: element
code_block_19 = CodeBlock { "05.41_BM_area plan oppervlakten_GO"; }
apply_viewtemplate_4 = Custom[Apply ViewTemplate](Views=setParameterByName_4, TempNames=code_block_19)

# group: Scope Box
code_block_20 = CodeBlock { "Scope Box"; }
categories_2 = Categories("VolumeOfInterest")
all_elements_of_category_2 = ElementsOfCategory(categories_2)
watch = Watch(all_elements_of_category_2)
code_block_21 = CodeBlock { 0; }
getItemAtIndex_4 = List.GetItemAtIndex(list=watch, index=code_block_21)
setParameterByName_5 = Element.SetParameterByName(element=byLevelName, parameterName=code_block_20, value=getItemAtIndex_4)
name_6 = Custom[Element.Name (Universal)](element=all_elements_of_category_2)  # "Element.Name+"; Gets an element's name (Dynamo's built-in Name nodes don't work for all element types, e.g. worksets...)

# group: Scope Box
code_block_22 = CodeBlock { "Scope Box"; }
categories_3 = Categories("VolumeOfInterest")
all_elements_of_category_3 = ElementsOfCategory(categories_3)
watch_2 = Watch(all_elements_of_category_3)
code_block_23 = CodeBlock { 0; }
getItemAtIndex_5 = List.GetItemAtIndex(list=watch_2, index=code_block_23)
setParameterByName_6 = Element.SetParameterByName(element=byLevelName_2, parameterName=code_block_22, value=getItemAtIndex_5)
name_7 = Custom[Element.Name (Universal)](element=all_elements_of_category_3)  # "Element.Name+"

# group: Scope Box
code_block_24 = CodeBlock { "Scope Box"; }
categories_4 = Categories("VolumeOfInterest")
all_elements_of_category_4 = ElementsOfCategory(categories_4)
watch_3 = Watch(all_elements_of_category_4)
code_block_25 = CodeBlock { 0; }
getItemAtIndex_6 = List.GetItemAtIndex(list=watch_3, index=code_block_25)
setParameterByName_7 = Element.SetParameterByName(element=byLevelName_3, parameterName=code_block_24, value=getItemAtIndex_6)
name_8 = Custom[Element.Name (Universal)](element=all_elements_of_category_4)  # "Element.Name+"

# group: Areaplan
code_block_26 = CodeBlock { 5; }
getItemAtIndex_7 = List.GetItemAtIndex(list=name_2, index=code_block_26)
byLevelName_4 = Custom[AreaPlan.ByLevelName](level=all_elements_of_category, name=code_block_18, schemeName=getItemAtIndex_7, lacing=Longest)  # "Springs.AreaPlan.ByLevelName"

# group: Scope Box
code_block_27 = CodeBlock { "Scope Box"; }
categories_5 = Categories("VolumeOfInterest")
all_elements_of_category_5 = ElementsOfCategory(categories_5)
watch_4 = Watch(all_elements_of_category_5)
code_block_28 = CodeBlock { 0; }
getItemAtIndex_8 = List.GetItemAtIndex(list=watch_4, index=code_block_28)
setParameterByName_8 = Element.SetParameterByName(element=byLevelName_4, parameterName=code_block_27, value=getItemAtIndex_8)
name_9 = Custom[Element.Name (Universal)](element=all_elements_of_category_5)  # "Element.Name+"
