# Dynamo graph AlignFixturesinCeilingGrid.dyn (Dynamo 1.3.2.2480)

# group: DEFINE FIXTURE CATEGORY
# note: Change or add different categories to work with other types of fixtures
categories = Categories("LightingFixtures")

# group: SELECT THE CEILINGS AND FIXTURES IN THE ACTIVE REFLECTED CEILING PLAN VIEW AND LEVEL
categories_2 = Categories("Ceilings")
create = List.Create(categories, categories_2)
all_elements_of_category = ElementsOfCategory(create)
# note: Beaker
code_block = CodeBlock { "Level"; }
# note: Run the script with a Ceiling Plan as an active view.
current = Document.Current()
activeView = Document.ActiveView(current)
code_block_2 = CodeBlock { "Associated Level"; }
getParameterValueByName = Element.GetParameterValueByName(element=activeView, parameterName=code_block_2)

byParameterValueContains = Revit.ElementFilter.ByParameterValueContains(all_elements_of_category, code_block, getParameterValueByName)

# group (continued): SELECT THE CEILINGS AND FIXTURES IN THE ACTIVE REFLECTED CEILING PLAN VIEW AND LEVEL
deconstruct = List.Deconstruct(list=byParameterValueContains)

# group: ALIGN AND CENTER FIXTURES ON CEILING PATTERNS
# note: Select the Linked DWG in the drawing.
# note: by Cesar Escalante @VCDWhiz, presented at the Dynamo Block Party April 2017
# INSTRUCTIONS:
# Works with flat ceilings with orthogonal hatch patterns.  Tested for 2x2 and 2x4 ceiling grids.  Fixtures must be Face Based families only.  Won't work with families that cut openings on the ceiling surface.  Run the script in Manual mode.
# Script written in Dynamo ver 1.3.  Requires Beaker, Springs, BiMorph & Clockwork packages.
# 1.  Set a Refleted ceiling plan as your a Active View, and create a dwg export of the ceiling plan
# 2. Open the DWG in Autocad and Explode the ceiling hatch patterns; this will enable Dynamo to read the pattern lines in the layer A-CEIL-PATT.
# 3.  Link the CAD drawing in the active view (ceiling plan) as a view specific entity.
# 4.  Select the Link Imported Instance and run the script.
# 5.  If the ceiling pattern changes, re-export and replace the DWG and re-explode the elements in AutoCAD before running the script again.
select_model_element = DSModelElementSelection()

# group: IMPORT THE CEILING GRID PATTERN, PROJECT THE PATTERN TO CEILING SURFACE AND DEFINE TRIMMING ENTITIES
faces = Topology.Faces(deconstruct.rest)
# note: Clockworks (great node!)
filterByOrientation = Custom[Surface.FilterByOrientation](surfaces=faces)  # Sorts surfaces in three lists based on their orientation (vertical, horizontal up & horizontal down) and also returns three corresponding lists of booleans.
flatten = Flatten(filterByOrientation.horizontalDown)
# note: Ceiling pattern layer in DWG
code_block_3 = CodeBlock { "A-CLNG-PATT"; }
# note: BiMorphNodes
curvesFromCADLayers = CAD.CurvesFromCADLayers(select_model_element, code_block_3)
ZAxis = Vector.ZAxis()
projectInputOnto = Surface.ProjectInputOnto(flatten, curvesFromCADLayers, ZAxis, lacing=CrossProduct)
flatten_2 = Flatten(projectInputOnto@L3)
extrude = Curve.Extrude(curve=flatten_2)
code_block_4 = CodeBlock { Vector.ByCoordinates(0,0,-0.5); }
translate = Geometry.Translate(geometry=extrude, direction=code_block_4)

# group: TRIM THE CEILING SURFACE INTO CEILING PANELS
code_block_5 = CodeBlock { 0.5; }
normalAtParameter = Surface.NormalAtParameter(surface=translate, u=code_block_5, v=code_block_5)
XAxis = Vector.XAxis()
ZAxis_2 = Vector.ZAxis()
angleAboutAxis = Vector.AngleAboutAxis(normalAtParameter, XAxis, ZAxis_2)
# note: Filter hatch pattern lines by orientations
code_block_6 = CodeBlock(a=angleAboutAxis)
# ---------- code_block_6.designscript (4 lines) ----------
a>=0&&a<90?true:
a>=90&&a<180?false:
a>=180&&a<270?true:
false;
# ----------------------------------------
filterByBoolMask = List.FilterByBoolMask(list=translate, mask=code_block_6)
byJoinedSurfaces = PolySurface.ByJoinedSurfaces(filterByBoolMask.in)
# note: Split the ceiling surfaces by one of the grid directions
split = Geometry.Split(geometry=flatten, other=byJoinedSurfaces)
byJoinedSurfaces_2 = PolySurface.ByJoinedSurfaces(filterByBoolMask.out)
# note: Split the ceiling surfaces by the other grid direction
split_2 = Geometry.Split(geometry=split, other=byJoinedSurfaces_2)
flatten_3 = Flatten(split_2@L3)
# note: Join all ceiling panels as a polysurfaces
byJoinedSurfaces_3 = PolySurface.ByJoinedSurfaces(flatten_3)

# group: FINDS THE CENTERPOINT OF THE CEILING PANEL HOSTING THE FIXTURE
getLocation = Element.GetLocation(deconstruct.first)
ZAxis_3 = Vector.ZAxis()
locateSurfacesByPoint = PolySurface.LocateSurfacesByPoint(byJoinedSurfaces_3, getLocation, ZAxis_3, lacing=CrossProduct)
flatten_4 = Flatten(locateSurfacesByPoint)
code_block_7 = CodeBlock { 0.5; }
pointAtParameter = Surface.PointAtParameter(surface=flatten_4, u=code_block_7, v=code_block_7)

# group: SET THE LOCATION LOCATION POINT OF FIXTURE
identity = Object.Identity(deconstruct.first)
id = Element.Id(deconstruct.rest)
flatten_5 = Flatten(id)
getKeys = GetKeys(flatten_5)
# note: Clockwork
host = Custom[Element.Host](element=identity)  # Gets an element's host
id_2 = Element.Id(host)
# note: Springs
byKeysValues = Custom[Springs.Dictionary.ByKeysValues](keys=flatten_5, values=getKeys, searchKeys=id_2)  # Dictionaries are an incredibly powerful tool for making associative sets between two equal length lists. The first list must be of unique strings (or numbers) and will be the key and the second list will be the matching values (it can be made up of geometry, elements, even other lists) The search keys list will provide the corresponding value to the input key.; unwired: defaultValue
sortByKey = List.SortByKey(list=identity, keys=byKeysValues)
groupByKey = List.GroupByKey(list=sortByKey.sorted_list, keys=sortByKey.sorted_keys)
setLocation = Element.SetLocation(sortByKey.sorted_list, pointAtParameter)

# group: FINDS THE CEILING TILE MAJOR ORIENTATION
code_block_8 = CodeBlock { 0.45; }
pointAtParameter_2 = Surface.PointAtParameter(surface=flatten, u=code_block_8, v=code_block_8)
ZAxis_4 = Vector.ZAxis()
locateSurfacesByPoint_2 = PolySurface.LocateSurfacesByPoint(byJoinedSurfaces_3, pointAtParameter_2, ZAxis_4, lacing=CrossProduct)
flatten_6 = Flatten(locateSurfacesByPoint_2)
perimeterCurves = Surface.PerimeterCurves(flatten_6)
length = Curve.Length(perimeterCurves)
maximumItem = List.MaximumItem(length)
eq = maximumItem == length
filterByBoolMask_2 = List.FilterByBoolMask(list=perimeterCurves, mask=eq)
firstItem = List.FirstItem(filterByBoolMask_2.in@L2)
code_block_9 = CodeBlock { 0.5; }
byTangency = Line.ByTangency(firstItem, code_block_9)
direction = Line.Direction(byTangency)

# group: ALIGN THE FIXTURE WITH THE MAJOR PANEL ORIENTATION
flatten_7 = Flatten(groupByKey.groups@L2)
# note: Clockwork
passthrough = Custom[Passthrough](passThrough=flatten_7, waitFor=setLocation)  # Forces a sequential order of execution. The node wired into the output of the Passthrough node will be executed *after* the node wired into the waitFor input (e.g. important for some Revit operations). The value of the passThrough input will be passed on to the node wired into the output port of the Passthrough node.
code_block_10 = CodeBlock { Vector.ByCoordinates(1,0,0); }
angleWithVector = Vector.AngleWithVector(vector=direction, otherVector=code_block_10)
setRotation = FamilyInstance.SetRotation(familyInstance=passthrough, degree=angleWithVector, lacing=Longest)
