# Dynamo graph CHANGE LINES.dyn (Dynamo 1.3.2.2480)

code_block = CodeBlock { "Line Style"; }
line_styles = LineStyleUi("Thin Lines")
setParameterByName = Element.SetParameterByName(parameterName=code_block, value=line_styles)  # unwired: element
categories = Categories("Lines")
all_elements_of_category = ElementsOfCategory(categories)
code_block_2 = CodeBlock { "Line Style"; }
getParameterValueByName = Element.GetParameterValueByName(element=all_elements_of_category, parameterName=code_block_2)
id = Element.Id(getParameterValueByName)
line_styles_2 = LineStyleUi("Thin Lines")
id_2 = Element.Id(line_styles_2)
eq = id == id_2  # lacing=CrossProduct
flatten = Flatten(eq)
filterByBoolMask = List.FilterByBoolMask(list=all_elements_of_category, mask=flatten)
watch = Watch(filterByBoolMask.in)
