# Dynamo graph CHECK SHEET COLUMN BY REVISION.dyn (Dynamo 1.3.2.2480)

categories = Categories("Sheets")
all_elements_of_category = ElementsOfCategory(categories)
restOfItems = List.RestOfItems(all_elements_of_category)

# group: SORT SHEETS
sheetNumber = Sheet.SheetNumber(restOfItems)
code_block = CodeBlock { " "; }
add = sheetNumber + code_block
sheetName = Sheet.SheetName(restOfItems)
add_2 = add + sheetName
sortByKey = List.SortByKey(list=restOfItems, keys=add_2)

# group: FILTER FOR THIS STRING
code_block_2 = CodeBlock { "136"; }

code_block_3 = CodeBlock { "PHASE BY SUITE"; }
getParameterValueByName = Element.GetParameterValueByName(element=sortByKey.sorted_list, parameterName=code_block_3)
eq = code_block_2 == getParameterValueByName
filterByBoolMask = List.FilterByBoolMask(list=sortByKey.sorted_list, mask=eq)

# group: Select RANG OF SHEETS from list in ALL SHEETS
code_block_4 = CodeBlock { 1; }
code_block_5 = CodeBlock { 43; }

slice = List.Slice(filterByBoolMask.in, code_block_4, code_block_5)
watch = Watch(slice)
revisions = archilab.Revit.Views.Sheet.Revisions(watch)
id = Element.Id(revisions)

# group: SELECT REVISION TO BE CHECKED
select_revision = RevitRevisions("Seq. 35 - BULLETIN #1")

id_2 = Element.Id(select_revision)
eq_2 = _ == id_2  # unwired: arg0
trueForAny = TrueForAny(arg1=eq_2)  # unwired: arg0
map = List.Map(list=id, f_x=trueForAny)
filterByBoolMask_2 = List.FilterByBoolMask(list=watch, mask=map)

# group: SELECT COLUMN
code_block_6 = CodeBlock { "COLUMN_05"; }

boolean = BoolSelector(true)
setParameterByName = Element.SetParameterByName(element=filterByBoolMask_2.in, parameterName=code_block_6, value=boolean)
code_block_7 = CodeBlock(t1=filterByBoolMask.in) { t3 = t1; t2 = t3.SheetNumber; t4 = t2 + " "; t5 = t3.SheetName; t6 = t4 + t5; }

# group: ALL SHEETS
watch_2 = Watch(code_block_7.t6)

code_block_8 = CodeBlock(t1=slice) { t3 = t1; t2 = t3.SheetNumber; t4 = t2 + " "; t5 = t3.SheetName; t6 = t4 + t5; }

# group: RANGE OF SHEETS
watch_3 = Watch(code_block_8.t6)

code_block_9 = CodeBlock(t1=filterByBoolMask_2.in) { t3 = t1; t2 = t3.SheetNumber; t4 = t2 + " "; t5 = t3.SheetName; t6 = t4 + t5; }

# group: LIST OF REVISED SHEETS
watch_4 = Watch(code_block_9.t6)
