# Dynamo graph CONDUIT SCHEDULE.dyn (Dynamo 1.3.2.2480)

categories = Categories("ConduitRun")
all_elements_of_category = ElementsOfCategory(categories)
string = StringInput("CONDUIT TO")
getParameterValueByName = Element.GetParameterValueByName(element=all_elements_of_category, parameterName=string)
number = DoubleInput(11.25)
eq = _ == number  # unwired: arg0
filterByBoolMask = List.FilterByBoolMask(mask=eq)  # unwired: list
watch = Watch(filterByBoolMask.in)
string_2 = StringInput("Offset")
number_2 = DoubleInput(10.5)
setParameterByName = Element.SetParameterByName(parameterName=string_2, value=number_2)  # unwired: element
categories_2 = Categories("Conduit")
all_elements_of_category_2 = ElementsOfCategory(categories_2)
join = List.Join()  # unwired: arg0, arg1
string_3 = StringInput("Power")
setWorkset = Custom[Element.SetWorkset](workset=string_3)  # Sets the workset of a given element; unwired: element
permanentlyIsolateElement = Custom[View.PermanentlyIsolateElement]()  # Permanently isolates elements in the given view; unwired: view, element
temporarilyIsolateElement = Custom[View.TemporarilyIsolateElement]()  # Temporarily isolates elements in the given view; unwired: view, element
string_4 = StringInput("Reference Level")
getParameterValueByName_2 = Element.GetParameterValueByName(element=filterByBoolMask.in, parameterName=string_4)
string_5 = StringInput("Level(Name=FIRST FLOOR, Eleveation=0)")
eq_2 = getParameterValueByName_2 == string_5
filterByBoolMask_2 = List.FilterByBoolMask(list=filterByBoolMask.in, mask=eq_2)
category = archilab.Revit.Elements.WarningElement.Category()  # unwired: arg0
category_2 = archilab.Revit.Elements.WarningElement.Category()  # unwired: arg0
