# Dynamo graph CeilingGridCenters.dyn (Dynamo 1.3.2.2480)

family_types = FamilyTypes()
all_elements_of_family_type = ElementsOfFamilyType(family_types)
number = DoubleInput(1)

# group: Get Links
get_documents = Custom[Get Documents]()  # Queries all linked Revit files and retrieves their Name, LinkInstance and Document properties.

categories = Categories("Ceilings")
linkedInstanceElements = Custom[Springs.Collector.LinkedInstanceElements](linkInstance=get_documents.Link_Instance, category=categories)  # Extract elements by category from the selected linked instances. The transform CS can be used to get the exact location of the elements in the host file. If an error occurs or the linked document is unloaded, an error will be returned in the elements output and the appropriate transform will be a null. You can use those nulls to filter out the errors.
solids = Element.Solids(linkedInstanceElements.elements)
bySolid = PolySurface.BySolid(solids)
surfaces = PolySurface.Surfaces(bySolid)
