# Dynamo graph Change Conduit Height.dyn (Dynamo 1.3.2.2480)

string = StringInput("Offset")
number_from_feet_and_inches = LengthFromString(3.4036)
setParameterByName = Element.SetParameterByName(parameterName=string, value=number_from_feet_and_inches)  # unwired: element
categories = Categories("ConduitFitting")
all_elements_of_category = ElementsOfCategory(categories)
categories_2 = Categories("Conduit")
all_elements_of_category_2 = ElementsOfCategory(categories_2)
join = List.Join(all_elements_of_category_2)
string_2 = StringInput("Workset")
getParameterValueByName = Element.GetParameterValueByName(element=join, parameterName=string_2)
number = DoubleInput(2865)
eq = getParameterValueByName == number
filterByBoolMask = List.FilterByBoolMask(list=join, mask=eq)
string_3 = StringInput("Offset")
getParameterValueByName_2 = Element.GetParameterValueByName(element=filterByBoolMask.in, parameterName=string_3)
number_2 = DoubleInput(11.75)
eq_2 = getParameterValueByName_2 == number_2
filterByBoolMask_2 = List.FilterByBoolMask(list=join, mask=eq_2)
number_3 = DoubleInput(11.1667)
filterByParameterValueAndCondition = Custom[Elements.FilterByParameterValueAndCondition]()  # Retrieves those elements from a collection whose parameter value matches the defined condition; unwired: elements, param, func
nullSetParameter = Custom[Springs.NullSetParameter]()  # Similar to the built-in function but with the ability to handle null values. Part of the SmartCopyMon workflow.; unwired: element, parameter, value
