# Dynamo graph Circuit Lights WITH CIRCUITS.dyn (Dynamo 1.3.2.2480)

# group: Create new circuit on Panel and assign elementset to new circuit
python_script = Python()  # unwired: IN[0]
# ---------- python_script.python (62 lines) ----------
import clr
clr.AddReference('ProtoGeometry')
from Autodesk.DesignScript.Geometry import *

clr.AddReference('RevitServices')
import RevitServices
from RevitServices.Persistence import DocumentManager
from RevitServices.Transactions import TransactionManager
from System.Collections.Generic import *

clr.AddReference('RevitNodes')
import Revit
clr.ImportExtensions(Revit.Elements)

clr.AddReference('RevitAPI')
import Autodesk
from Autodesk.Revit.DB import *
from Autodesk.Revit.DB.Electrical import *
from Autodesk.Revit.DB import MEPSystem

clr.AddReference('DSCoreNodes')
import DSCore
from DSCore.List import *

import sys
pyt_path = r'C:\Program Files (x86)\IronPython 2.7\Lib'
sys.path.append(pyt_path)

# Import List ( ICollection(ElementId) = List[ElementId]() )
clr.AddReference("System")
from System.Collections.Generic import List 

#The inputs to this node will be stored as a list in the IN variables.
input = UnwrapElement(IN[0])

ElectComponents = []
NewCircuit = []

for sublist in input:
	sub = List[ElementId]()
	ElectComponents.append(sub)
	for item in sublist:
		sub.Add(item.Id)


doc = DocumentManager.Instance.CurrentDBDocument
uiapp = DocumentManager.Instance.CurrentUIApplication
app = uiapp.Application
uidoc = DocumentManager.Instance.CurrentUIApplication.ActiveUIDocument

ListNewCircuit = []

TransactionManager.Instance.EnsureInTransaction(doc)

for e in ElectComponents:
	NewCircuit = doc.Create.NewElectricalSystem(e, ElectricalSystemType.PowerCircuit)
	ListNewCircuit.append(NewCircuit)

TransactionManager.Instance.TransactionTaskDone()


OUT = ListNewCircuit
# ----------------------------------------

select_model_element = DSModelElementSelection()  # 1 picked in the model

# group: Select panel. IN[0] = Electrical System IN[1] = Panel element
python_script_2 = Python(IN[0]=python_script, IN[1]=select_model_element)
# ---------- python_script_2.python (51 lines) ----------
import clr
clr.AddReference('ProtoGeometry')
from Autodesk.DesignScript.Geometry import *

clr.AddReference('RevitServices')
import RevitServices
from RevitServices.Persistence import DocumentManager
from RevitServices.Transactions import TransactionManager
from System.Collections.Generic import *

clr.AddReference('RevitNodes')
import Revit
clr.ImportExtensions(Revit.Elements)

clr.AddReference('RevitAPI')
import Autodesk
from Autodesk.Revit.DB import *
from Autodesk.Revit.DB.Electrical import *
from Autodesk.Revit.DB import MEPSystem

clr.AddReference('DSCoreNodes')
import DSCore
from DSCore.List import *

import sys
pyt_path = r'C:\Program Files (x86)\IronPython 2.7\Lib'
sys.path.append(pyt_path)

# Import List ( ICollection(ElementId) = List[ElementId]() )
clr.AddReference("System")
from System.Collections.Generic import List 


circuit = UnwrapElement(IN[0])
panel = UnwrapElement(IN[1])

doc = DocumentManager.Instance.CurrentDBDocument
uiapp = DocumentManager.Instance.CurrentUIApplication
app = uiapp.Application
uidoc = DocumentManager.Instance.CurrentUIApplication.ActiveUIDocument

TransactionManager.Instance.EnsureInTransaction(doc)

for _ in circuit:
	_.SelectPanel(panel)

TransactionManager.Instance.TransactionTaskDone()

#Assign your output to the OUT variable.
OUT = []
OUT = circuit, panel
# ----------------------------------------

code_block = CodeBlock { "Full Emergency Lighting"; }
boolean = BoolSelector(true)
setParameterByName = Element.SetParameterByName(parameterName=code_block, value=boolean)  # unwired: element
code_block_2 = CodeBlock { "Emergency Lighting"; }
select_model_element_2 = DSModelElementSelection()  # 1 picked in the model
name = Element.Name(select_model_element_2)
select_model_element_3 = DSModelElementSelection()  # 1 picked in the model
name_2 = Element.Name(select_model_element_3)
select_model_element_4 = DSModelElementSelection()  # 1 picked in the model
name_3 = Element.Name(select_model_element_4)
select_model_element_5 = DSModelElementSelection()  # 1 picked in the model
name_4 = Element.Name(select_model_element_5)

# group: # OF LIGHTS IN A ROW
code_block_3 = CodeBlock { 12; }

# group: GROUP LIGHTS INTO ROWS BASED ON LOCATION AND ROW/COLLOUMN VALUES
select_model_elements = DSModelElementsSelection()  # 1284 picked in the model
categories = Categories("LightingFixtures")
byCategory = Revit.ElementFilter.ByCategory(select_model_elements, categories)

byName = Revit.ElementFilter.ByName(byCategory, name)
byName_2 = Revit.ElementFilter.ByName(byCategory, name_2)
byName_3 = Revit.ElementFilter.ByName(byCategory, name_3)
byName_4 = Revit.ElementFilter.ByName(byCategory, name_4)
join = List.Join(byName, byName_2, byName_3, byName_4)

# group (continued): GROUP LIGHTS INTO ROWS BASED ON LOCATION AND ROW/COLLOUMN VALUES
getLocation = Element.GetLocation(join)
Y = Point.Y(getLocation)
sortByKey = List.SortByKey(list=join, keys=Y)
chop = List.Chop(list=sortByKey.sorted_list, lengths=code_block_3)
getLocation_2 = Element.GetLocation(chop)
X = Point.X(getLocation_2)
sortByKey_2 = List.SortByKey(list=chop@@L2, keys=X@L2)

watch = Watch(sortByKey_2.sorted_list)

# group: # OF CIRCUITS
code_block_4 = CodeBlock { 4; }

# group: LIGHTING PATTERN
diagonalLeft = List.DiagonalLeft(watch, code_block_3)
code_block_5 = CodeBlock(A=code_block_4) { 0..(A-1); }
takeEveryNthItem = List.TakeEveryNthItem(diagonalLeft, code_block_4, code_block_5)

watch_2 = Watch(takeEveryNthItem)
code_block_6 = CodeBlock { 2; }
getItemAtIndex = List.GetItemAtIndex(list=takeEveryNthItem, index=code_block_6)
flatten = Flatten(getItemAtIndex)
setRevitSelection = Custom[RIE.SetRevitSelection](Elements=flatten)  # Input elements to select in Revit model

# group: FILTER LIGHT TYPE
select_model_element_6 = DSModelElementSelection()  # 1 picked in the model
name_5 = Element.Name(select_model_element_6)
byName_5 = Revit.ElementFilter.ByName(takeEveryNthItem, name_5)
select_model_element_7 = DSModelElementSelection()  # 1 picked in the model
name_6 = Element.Name(select_model_element_7)
byName_6 = Revit.ElementFilter.ByName(takeEveryNthItem, name_6)
join_2 = List.Join(byName_5, byName_6)

reverse = List.Reverse(watch)
