# Dynamo graph Circuit Lights.dyn (Dynamo 1.3.2.2480)

code_block = CodeBlock { "Full Emergency Lighting"; }
boolean = BoolSelector(true)
setParameterByName = Element.SetParameterByName(parameterName=code_block, value=boolean)  # unwired: element
select_model_element = DSModelElementSelection()  # 1 picked in the model
name = Element.Name(select_model_element)
select_model_element_2 = DSModelElementSelection()  # 1 picked in the model
name_2 = Element.Name(select_model_element_2)

# group: # OF LIGHTS IN A ROW
code_block_2 = CodeBlock { 6; }

# group: GROUP LIGHTS INTO ROWS BASED ON LOCATION AND ROW/COLLOUMN VALUES
select_model_elements = DSModelElementsSelection()  # 1284 picked in the model
categories = Categories("LightingFixtures")
byCategory = Revit.ElementFilter.ByCategory(select_model_elements, categories)
code_block_3 = CodeBlock { 0; }

byName = Revit.ElementFilter.ByName(byCategory, name)
byName_2 = Revit.ElementFilter.ByName(byCategory, name_2)
join = List.Join(byName, byName_2)

# group (continued): GROUP LIGHTS INTO ROWS BASED ON LOCATION AND ROW/COLLOUMN VALUES
getLocation = Element.GetLocation(join)
Y = Point.Y(getLocation)
sortByKey = List.SortByKey(list=join, keys=Y)
chop = List.Chop(list=sortByKey.sorted_list, lengths=code_block_2)
getItemAtIndex = List.GetItemAtIndex(list=chop, index=code_block_3)
getLocation_2 = Element.GetLocation(chop)
X = Point.X(getLocation_2)
sortByKey_2 = List.SortByKey(list=chop@@L2, keys=X@L2)

code_block_4 = CodeBlock { "Emergency Lighting"; }
boolean_2 = BoolSelector(true)
setParameterByName_2 = Element.SetParameterByName(parameterName=code_block_4, value=boolean_2)  # unwired: element
python_script = Python()  # unwired: IN[0], IN[1], IN[2]
# ---------- python_script.python (57 lines) ----------
import clr
clr.AddReference('ProtoGeometry')
from Autodesk.DesignScript.Geometry import *

clr.AddReference('RevitServices')
import RevitServices
from RevitServices.Persistence import DocumentManager
from RevitServices.Transactions import TransactionManager
from System.Collections.Generic import *

clr.AddReference('RevitNodes')
import Revit
clr.ImportExtensions(Revit.Elements)

clr.AddReference('RevitAPI')
import Autodesk
from Autodesk.Revit.DB import *
from Autodesk.Revit.DB.Electrical import *
from Autodesk.Revit.DB import MEPSystem

clr.AddReference('DSCoreNodes')
import DSCore
from DSCore.List import *

import sys
pyt_path = r'C:\Program Files (x86)\IronPython 2.7\Lib'
sys.path.append(pyt_path)

# Import List ( ICollection(ElementId) = List[ElementId]() )
clr.AddReference("System")
from System.Collections.Generic import List 

Lights = UnwrapElement(IN[0])
Rows = UnwrapElement(IN[1])
Panels = UnwrapElement(IN[2])

a = []
WeaveLights = []
for r in range(len(Lights)):

	for c in range(len(Lights[r])):
	
		WeaveLights.append(Lights[r][c*2])
	
	
	
doc = DocumentManager.Instance.CurrentDBDocument
uiapp = DocumentManager.Instance.CurrentUIApplication
app = uiapp.Application
uidoc = DocumentManager.Instance.CurrentUIApplication.ActiveUIDocument

TransactionManager.Instance.EnsureInTransaction(doc)


OUT = WeaveLights

TransactionManager.Instance.TransactionTaskDone()
# ----------------------------------------
watch = Watch(sortByKey_2.sorted_list)
diagonalLeft = List.DiagonalLeft(watch, code_block_2)

# group: # OF CIRCUITS
code_block_5 = CodeBlock { 4; }

code_block_6 = CodeBlock(A=code_block_5) { 0..(A-1); }
takeEveryNthItem = List.TakeEveryNthItem(diagonalLeft, code_block_5, code_block_6)
watch_2 = Watch(takeEveryNthItem)
code_block_7 = CodeBlock { 2; }
getItemAtIndex_2 = List.GetItemAtIndex(list=takeEveryNthItem, index=code_block_7)
flatten = Flatten(getItemAtIndex_2)
setRevitSelection = Custom[RIE.SetRevitSelection](Elements=flatten)  # Input elements to select in Revit model
