# Dynamo graph Copy Conduit Parameters into Run from Selected Conduit.dyn (Dynamo 1.3.2.2480)

# group: Select the conduit from the run you would like to copy parameters from
select_model_element = DSModelElementSelection()

elements_in_connected_network = Custom[Elements in connected network](Element=select_model_element)  # Returns all elements that are physically connected to the input element

# group: PARAMETERS
string = StringInput("CONDUIT TO")
string_2 = StringInput("CIRCUIT NUMBER")
string_3 = StringInput("CONDUIT FROM")

getParameterValueByName = Element.GetParameterValueByName(element=select_model_element, parameterName=string)
setParameterByName = Element.SetParameterByName(element=elements_in_connected_network, parameterName=string, value=getParameterValueByName)
getParameterValueByName_2 = Element.GetParameterValueByName(element=select_model_element, parameterName=string_2)
setParameterByName_2 = Element.SetParameterByName(element=elements_in_connected_network, parameterName=string_2, value=getParameterValueByName_2)
getParameterValueByName_3 = Element.GetParameterValueByName(element=select_model_element, parameterName=string_3)
setParameterByName_3 = Element.SetParameterByName(element=elements_in_connected_network, parameterName=string_3, value=getParameterValueByName_3)
select_model_elements = DSModelElementsSelection()
