# Dynamo graph Demo.dyn (Dynamo 1.3.2.2480)

select_model_element = DSModelElementSelection()  # 1 picked in the model
parameters = Element.Parameters(select_model_element)
watch = Watch(parameters)
categories = Categories("ConduitFitting")
all_elements_of_category = ElementsOfCategory(categories)
categories_2 = Categories("Conduit")
all_elements_of_category_2 = ElementsOfCategory(categories_2)
join = List.Join(all_elements_of_category, all_elements_of_category_2)
string = StringInput("Offset")
getParameterValueByName = Element.GetParameterValueByName(element=join, parameterName=string)
number = DoubleInput(11.5)
eq = getParameterValueByName == number
filterByBoolMask = List.FilterByBoolMask(list=join, mask=eq)
watch_2 = Watch(filterByBoolMask.in)
string_2 = StringInput("Offset")
number_2 = DoubleInput(15)
setParameterByName = Element.SetParameterByName(parameterName=string_2, value=number_2)  # unwired: element
