# Dynamo custom node Doc.ActiveView.dyf "Springs.Doc.ActiveView" (Dynamo 1.3.2.2480)
# category: Springs.Revit.Views
# Selects the current document's active view. Supports more view types than the built-in option.
# Will be depreciated once the bult in node works with all plan types.

refresh = Input(refresh:bool = true)
python_script = Python(IN[0]=refresh)  # unwired: IN[1]
# ---------- python_script.python (14 lines) ----------
#Copyright(c) 2016, Dimitar Venkov
# @5devene, dimitar.ven@gmail.com

import clr

clr.AddReference("RevitServices")
import RevitServices
from RevitServices.Persistence import DocumentManager
doc = DocumentManager.Instance.CurrentDBDocument
clr.AddReference("RevitNodes")
import Revit
clr.ImportExtensions(Revit.Elements)

OUT = doc.ActiveView.ToDSType(True)
# ----------------------------------------
view = Output(python_script)
