# Dynamo graph Duplicate Elements and Tags (2).dyn (Dynamo 1.3.2.2480)

# group: SELECT ELEMENTS YOU WOULD LIKE TO COPY HERE
select_model_elements = DSModelElementsSelection()  # 4 picked in the model

watch = Watch(select_model_elements)

# group: Origin Location Element
select_model_element = DSModelElementSelection()  # 1 picked in the model

# group: Destination Location Element
select_model_element_2 = DSModelElementSelection()  # 1 picked in the model

# group: COPY ELEMENTS TO FROM START POINT TO END POINT
getLocation = Element.GetLocation(select_model_element)
getLocation_2 = Element.GetLocation(select_model_element_2)
byTwoPoints = Vector.ByTwoPoints(start=getLocation, end=getLocation_2)
code_block = CodeBlock { "true"; }
copyByVector = Custom[Element.CopyByVector](element=watch@@L2, vector=byTwoPoints, rehostToClosestLevel=code_block)  # Copies an element or a list of elements by a given vector.

# group: Select Origin View
views = Views("Level 1 Orignal")

# group: Select Destination View
views_2 = Views("Level 1 Duplicate Elements and tags 2nd view")

# group: Select Destination View
views_3 = Views("Level 1 Duplicate Elements and tags")

create = List.Create(views_2, views_3)
getCategory = Element.GetCategory(watch)
uniqueItems = List.UniqueItems(getCategory)
string_from_object = FromObject(uniqueItems)
code_block_2 = CodeBlock { -1; }
code_block_3 = CodeBlock { 1; }
remove = String.Remove(str=string_from_object, startIndex=code_block_2, count=code_block_3)
sortDuplicateStrings = Lists.Strings.SortDuplicateStrings(remove)
code_block_4 = CodeBlock { " Tags"; }
add = sortDuplicateStrings + code_block_4
byName = Category.ByName(add@L1)
all_elements_of_category = ElementsOfCategory(byName)
flatten = Flatten(all_elements_of_category@L1)

# group: Obtain all the elements the tags are tagging and their element id
taggedElement = Tag.TaggedElement(flatten)
id = Element.Id(taggedElement)

# group: Group the tags by the element ids (this is for when something is tagged multiple times or in multiple views)
groupByKey = List.GroupByKey(list=flatten, keys=id)

# group: Dictionaries provide a way to look stuff up by a given key
code_block_5 = CodeBlock(taggedElement=groupByKey.groups, tag=groupByKey.unique_keys)
# ---------- code_block_5.designscript (4 lines) ----------
//declare a new dictionary to store this in
tagDictionary = {};
//dictionary[whatToLookUpBy] = tagElement
tagDictionary[taggedElement] = tag;
# ----------------------------------------

# group: Sample element selected manually to get the tags for
id_2 = Element.Id(watch)

# group: Retrieve the related tags for the given element from the dictionary
code_block_6 = CodeBlock(tagDictionary=code_block_5.tagDictionary, taggedElement=id_2) { tagDictionary[taggedElement]; }

flatten_2 = Flatten(code_block_6)
asPoint = Vector.AsPoint(byTwoPoints)
byOrigin = CoordinateSystem.ByOrigin(asPoint)

# group: Copy tags from Origin View to Destination View
python_script = Python(IN[0]=views, IN[1]=create, IN[2]=flatten_2, IN[3]=byOrigin)
# ---------- python_script.python (41 lines) ----------
import clr

clr.AddReference('RevitServices')
from RevitServices.Persistence import DocumentManager
from RevitServices.Transactions import TransactionManager
doc = DocumentManager.Instance.CurrentDBDocument

clr.AddReference('RevitAPI')
from Autodesk.Revit.DB import *

from System.Collections.Generic import List

clr.AddReference('RevitNodes')
import Revit
clr.ImportExtensions(Revit.Elements)
clr.ImportExtensions(Revit.GeometryConversion)

def singleton(x):
	if hasattr(x,'__iter__'): return x[0]
	else : return x

def tolist(x):
	if hasattr(x,'__iter__'): return x
	else : return [x]

source = UnwrapElement(singleton(IN[0]) )
dest = UnwrapElement(singleton(IN[1]) )
elements = UnwrapElement(tolist(IN[2]) )
tf1 = singleton(IN[3])

if tf1 is not None:
	tf1 = tf1.ToTransform(True)

eId = List[ElementId](e.Id for e in elements if hasattr(e, "Id") )

TransactionManager.Instance.EnsureInTransaction(doc)
copy = ElementTransformUtils.CopyElements(source, eId, dest, tf1, None)
TransactionManager.Instance.TransactionTaskDone()

#OUT = [doc.GetElement(i).ToDSType(False) for i in copy]
OUT = copy
# ----------------------------------------

byElementId = archilab.Revit.Selection.Select.ByElementId(python_script)
