# Dynamo graph Duplicate Elements and Tags 2.dyn (Dynamo 1.3.2.2480)

code_block = CodeBlock { End Element Location; }
code_block_2 = CodeBlock { Origin Element Location; }
python_script = Python()  # unwired: IN[0], IN[1], IN[2], IN[3]
# ---------- python_script.python (35 lines) ----------
import clr
clr.AddReference('ProtoGeometry')
from Autodesk.DesignScript.Geometry import *

clr.AddReference('RevitServices')
import RevitServices
from RevitServices.Persistence import DocumentManager
from RevitServices.Transactions import TransactionManager
from System.Collections.Generic import *

clr.AddReference('RevitAPI')
from Autodesk.Revit.DB import Electrical
from Autodesk.Revit.DB import ElementId

#The inputs to this node will be stored as a list in the IN variables.
PanelSched = UnwrapElement(IN[0])
col = UnwrapElement(IN[1])
row = UnwrapElement(IN[2])
parameter = UnwrapElement(IN[3])

SpareVA = []
elemId = ElementId(parameter[0])

doc = DocumentManager.Instance.CurrentDBDocument
uiapp = DocumentManager.Instance.CurrentUIApplication
app = uiapp.Application
uidoc = DocumentManager.Instance.CurrentUIApplication.ActiveUIDocument

TransactionManager.Instance.EnsureInTransaction(doc)

for i, j in zip(col,row):
	Spare = Electrical.PanelScheduleView.GetSpareLoadValue(PanelSched[0],i,j,elemId)
	SpareVA.append(Spare)
#Assign your output to the OUT variable.
OUT = SpareVA
# ----------------------------------------
views = Views("Project View")
python_script_2 = Python(IN[0]=views, IN[1]=views, IN[2]=views)  # unwired: IN[3], IN[4]
# ---------- python_script_2.python (43 lines) ----------
import clr
clr.AddReference('ProtoGeometry')
from Autodesk.DesignScript.Geometry import *

clr.AddReference('RevitServices')
import RevitServices
from RevitServices.Persistence import DocumentManager
from RevitServices.Transactions import TransactionManager
from System.Collections.Generic import *

clr.AddReference('RevitAPI')
from Autodesk.Revit.DB import ElementId
from Autodesk.Revit.DB import *

#The inputs to this node will be stored as a list in the IN variables.
SourceView = UnwrapElement(IN[0])
Elements = UnwrapElement(IN[1])
DestView = UnwrapElement(IN[2])
Transform = UnwrapElement(IN[3])
CopyP = UnwrapElement(IN[4])



elemId = List[ElementId]([el.Id for el in Elements])

doc = DocumentManager.Instance.CurrentDBDocument

def tolist(obj):
	if isinstance(obj, list):
		return UnwrapElement(obj)
	else:
		return [UnwrapElement(obj)]

#Start Transaction
TransactionManager.Instance.EnsureInTransaction(doc)

NewEl = ElementTransformUtils.CopyElements(SourceView, elemId, DestView, Transform, None)

#End Transaction
TransactionManager.Instance.TransactionTaskDone()

#Assign your output to the OUT variable.
OUT = NewEl
# ----------------------------------------
select_model_elements = DSModelElementsSelection()
turnIntoList = Custom[TurnIntoList](unknownItem=select_model_elements)  # Turns an element (or a nested list) into a flat list
select_model_element = DSModelElementSelection()  # 1 picked in the model
select_model_element_2 = DSModelElementSelection()

# group: COPY ELEMENTS TO FROM START POINT TO END POINT
getLocation = Element.GetLocation(select_model_element)
getLocation_2 = Element.GetLocation(select_model_element_2)
byTwoPoints = Vector.ByTwoPoints(start=getLocation, end=getLocation_2)

asPoint = Vector.AsPoint(byTwoPoints)
code_block_3 = CodeBlock { rehostToClosestLevel : bool = false; }
python_script_3 = Python(IN[0]=turnIntoList, IN[1]=asPoint, IN[2]=code_block_3)
# ---------- python_script_3.python (38 lines) ----------
import clr
from System.Collections.Generic import *
clr.AddReference('RevitAPI')
from Autodesk.Revit.DB import *
import Autodesk

clr.AddReference("RevitNodes")
import Revit
clr.ImportExtensions(Revit.Elements)
clr.ImportExtensions(Revit.GeometryConversion)

clr.AddReference("RevitServices")
import RevitServices
from RevitServices.Persistence import DocumentManager
from RevitServices.Transactions import TransactionManager

doc = DocumentManager.Instance.CurrentDBDocument
items = UnwrapElement(IN[0])
xyz = UnwrapElement(IN[1]).ToXyz()
rehost = IN[2]

ids = list()
for item in items:
	ids.append(item.Id)	
itemlist = List[ElementId](ids)

TransactionManager.Instance.EnsureInTransaction(doc)
if rehost:
	newitems = ElementTransformUtils.CopyElements(doc,itemlist,doc,Transform.CreateTranslation(xyz),None)
else:
	newitems = ElementTransformUtils.CopyElements(doc,itemlist,xyz)
TransactionManager.Instance.TransactionTaskDone()

elementlist = list()
for item in newitems:
	elementlist.append(doc.GetElement(item).ToDSType(False))

OUT = doc
# ----------------------------------------
code_block_4 = CodeBlock(newElement=python_script_3) { newElement; }
asPoint_2 = Vector.AsPoint(byTwoPoints)
select_model_elements_2 = DSModelElementsSelection()
watch = Watch(select_model_elements_2)
getCategory = Element.GetCategory(watch)
uniqueItems = List.UniqueItems(getCategory)
string_from_object = FromObject(uniqueItems)
code_block_5 = CodeBlock { -1; }
code_block_6 = CodeBlock { 1; }
remove = String.Remove(str=string_from_object, startIndex=code_block_5, count=code_block_6)
sortDuplicateStrings = Lists.Strings.SortDuplicateStrings(remove)
code_block_7 = CodeBlock { " Tags"; }
add = sortDuplicateStrings + code_block_7
byName = Category.ByName(add@L1)
all_elements_of_category = ElementsOfCategory(byName)
flatten = Flatten(all_elements_of_category@L1)

# group: Obtain all the elements the tags are tagging and their element id
taggedElement = Tag.TaggedElement(flatten)
id = Element.Id(taggedElement)

# group: Group the tags by the element ids (this is for when something is tagged multiple times or in multiple views)
groupByKey = List.GroupByKey(list=flatten, keys=id)

# group: Dictionaries provide a way to look stuff up by a given key
code_block_8 = CodeBlock(taggedElement=groupByKey.groups, tag=groupByKey.unique_keys)
# ---------- code_block_8.designscript (4 lines) ----------
//declare a new dictionary to store this in
tagDictionary = {};
//dictionary[whatToLookUpBy] = tagElement
tagDictionary[taggedElement] = tag;
# ----------------------------------------

# group: Sample element selected manually to get the tags for
id_2 = Element.Id(watch)

# group: Retrieve the related tags for the given element from the dictionary
code_block_9 = CodeBlock(tagDictionary=code_block_8.tagDictionary, taggedElement=id_2) { tagDictionary[taggedElement]; }

copyElementsFromViewToView = Custom[RIE.CopyElementsFromViewToView](Elements=code_block_9)  # Copies elements from view to view.; unwired: FromViews, ToViews

# group: COPY ELEMENTS TO FROM START POINT TO END POINT
code_block_10 = CodeBlock { "true"; }
copyByVector = Custom[Element.CopyByVector](element=watch@@L2, vector=byTwoPoints, rehostToClosestLevel=code_block_10)  # Copies an element or a list of elements by a given vector.
