# Dynamo graph Duplicate3DViewatLevel & PlaceOnSheet.dyn (Dynamo 1.3.2.2480)

# group: Select 3D View from menu
views = Views("ISOMETRIC VIEW")

# group: Select Viewport on Sheet in the model
# note: Plug one of these RED nodes into the 3DVIEW node.
select_model_element = DSModelElementSelection()  # 1 picked in the model
getView = RevitElements.Viewport.GetView(select_model_element)

# group: 3D View Input Here
n3DVIEW = Watch(getView)  # "3DVIEW"

# group: Lowest Level First - Highest Level Last
levels = Levels("FOUNDATION PLAN")
levels_2 = Levels("LEVEL 1")
levels_3 = Levels("LEVEL 2 T.O. STEEL")
levels_4 = Levels("LEVEL 3 T.O. JOIST")
levels_5 = Levels("LEVEL 4 T.O. JOIST")
levels_6 = Levels("ROOF T.O. JOIST")

# group: Click + or - to add or remove from the list. Do not leave an empty space in the list.create node
create = List.Create(levels, levels_2, levels_3, levels_4, levels_5, levels_6)
code_block = CodeBlock(l1=create)
# ---------- code_block.designscript (2 lines) ----------
DSCore.List.DropItems(DSCore.
List.Sublists(l1,0..1,1),-1);
# ----------------------------------------

code_block_2 = CodeBlock { 1; }
getItemAtIndex = List.GetItemAtIndex(list=code_block@L2, index=code_block_2)

# group: Create View Names
code_block_3 = CodeBlock { "View Name"; }
getParameterValueByName = Element.GetParameterValueByName(element=n3DVIEW, parameterName=code_block_3)
name = Level.Name(getItemAtIndex)
code_block_4 = CodeBlock(X=getParameterValueByName, y=name) { X + " " + y; }

duplicateWithDetailing = Custom[View.DuplicateWithDetailing](view=n3DVIEW, name=code_block_4)  # Duplicates a given view with detailing
code_block_5 = CodeBlock { 0; }
getItemAtIndex_2 = List.GetItemAtIndex(list=code_block@L2, index=code_block_5)

# group: Feet Below Level
number_from_feet_and_inches = LengthFromString(1.0668)

# group: Feet Above Level
number_from_feet_and_inches_2 = LengthFromString(1.0668)

# group: Section Box Manipultation (Magic)
boundryBox = Custom[3DView.BoundryBox](3DView=n3DVIEW)  # Takes in a 3D View and outputs the views scope box as a boundry box
minPoint = BoundingBox.MinPoint(boundryBox)
X = Point.X(minPoint)
Y = Point.Y(minPoint)
elevation = Level.Elevation(getItemAtIndex_2)
code_block_6 = CodeBlock(X=elevation, y=number_from_feet_and_inches) { X - y; }
byCoordinates = Point.ByCoordinates(x=X, y=Y, z=code_block_6)
maxPoint = BoundingBox.MaxPoint(boundryBox)
X_2 = Point.X(maxPoint)
Y_2 = Point.Y(maxPoint)
elevation_2 = Level.Elevation(getItemAtIndex)
code_block_7 = CodeBlock(X=elevation_2, y=number_from_feet_and_inches_2) { X + y; }
byCoordinates_2 = Point.ByCoordinates(x=X_2, y=Y_2, z=code_block_7)
byCorners = BoundingBox.ByCorners(min=byCoordinates, max=byCoordinates_2)
code_block_8 = CodeBlock(BoundingBox=byCorners) { BoundingBox; }

setSectionBox = RevitElements.View3D.SetSectionBox(duplicateWithDetailing, code_block_8)
flatten = Flatten(setSectionBox)

# group: Creates View set
name_of_set = StringInput("Isometric Views")
boolean = BoolSelector(true)
python_script = Python(IN[0]=flatten, IN[1]=name_of_set, IN[2]=boolean)
# ---------- python_script.python (56 lines) ----------
#Copyright(c) 2015, Dimitar Venkov
# @5devene, dimitar.ven@gmail.com
#code inspired by Harry Mattison
#https://boostyourbim.wordpress.com

import clr

clr.AddReference("RevitServices")
import RevitServices
from RevitServices.Persistence import DocumentManager
from RevitServices.Transactions import TransactionManager
doc = DocumentManager.Instance.CurrentDBDocument

clr.AddReference("RevitAPI")
from Autodesk.Revit.DB import *

def tolist(obj1):
	if hasattr(obj1,"__iter__") : return obj1
	else : return [obj1]

def first(obj1):
	if hasattr(obj1,'__iter__') : return obj1[0]
	else : return obj1

views = UnwrapElement(tolist(IN[0]))
name1 = str(first(IN[1]) )
overwrite = IN[2]
vs_exists = None

fec = FilteredElementCollector(doc).OfClass(ViewSheetSet).GetElementIterator()
fec.Reset()
for f in fec:
	if f.Name == name1:
		vs_exists = f
		break
if vs_exists != None and overwrite:
	TransactionManager.Instance.EnsureInTransaction(doc)
	doc.Delete(vs_exists.Id)
	TransactionManager.Instance.TransactionTaskDone()
	vs_exists = None
elif vs_exists != None and not overwrite:
	OUT = "There's a ViewSet with the same name.\nSet Overwrite to true to continue."
if vs_exists == None:
	vs1 = ViewSet()
	for v in views: (vs1.Insert(v))
	printMan = doc.PrintManager
	printMan.PrintRange = PrintRange.Select
	viewSS = printMan.ViewSheetSetting
	try:
		TransactionManager.Instance.EnsureInTransaction(doc)
		viewSS.CurrentViewSheetSet.Views = vs1
		viewSS.SaveAs(name1)
		TransactionManager.Instance.TransactionTaskDone()
		OUT = "ViewSet created with %s views inside." %len(views)
	except:
		OUT = "The ViewSet could not be created"
# ----------------------------------------

code_block_9 = CodeBlock { "View Name"; }
getParameterValueByName_2 = Element.GetParameterValueByName(element=flatten, parameterName=code_block_9)

# group: Name of the Sheet the views will be placed
sheet_name = StringInput("ISOMETRIC VIEWS")

count = Count(create)
code_block_10 = CodeBlock(a=count) { a-1; }

# group: Place on Sheet
cycle = List.Cycle(list=sheet_name, amount=code_block_10)
x_axis = CodeBlock { 600; }
cycle_2 = List.Cycle(list=x_axis, amount=code_block_10)
y_axis = CodeBlock { 80; }
cycle_3 = List.Cycle(list=y_axis, amount=code_block_10)
code_block_11 = CodeBlock(A=cycle_3) { 1..Count(A); }
takeItems = List.TakeItems(list=cycle_3, amount=code_block_11)
sum = Math.Sum(takeItems)

y_axis_2 = CodeBlock { 200; }
code_block_12 = CodeBlock(a=sum, b=y_axis_2) { a+b; }

# group (continued): Place on Sheet
python_script_2 = Python(IN[0]=getParameterValueByName_2, IN[1]=cycle, IN[2]=cycle_2, IN[3]=code_block_12)
# ---------- python_script_2.python (62 lines) ----------
# -*- coding: utf-8 -*-
import clr
clr.AddReference('RevitAPI')
from Autodesk.Revit.DB import *

clr.AddReference('ProtoGeometry')
from Autodesk.DesignScript.Geometry import *

clr.AddReference("RevitServices")
import RevitServices
from RevitServices.Persistence import DocumentManager
from RevitServices.Transactions import TransactionManager

doc = DocumentManager.Instance.CurrentDBDocument

def U(elem): 
	a = UnwrapElement(elem)
	return a

inc = 304.8

if not isinstance(IN[0], list): 
	viewsname = [IN[0]]
else: 
	viewsname = IN[0]

if not isinstance(IN[1], list): 
	sheetsname = [IN[1]]
else: 
	sheetsname =IN[1]

def SheeByName(name):
	sheets = FilteredElementCollector(doc).OfCategory(BuiltInCategory.OST_Sheets).WhereElementIsNotElementType().ToElements()
	for i in sheets:
		try:
			if str(i.Name) == str(name):
				return i
		except:
			pass
def ViewsByName(name):
	views = FilteredElementCollector(doc).OfCategory(BuiltInCategory.OST_Views).WhereElementIsNotElementType().ToElements()
	for i in views:
		try:
			if str(i.Name) == str(name):
				return i
		except:
			pass

xx = IN[2]
yy = IN[3]
viewports = []

for i, p, x, y in zip (viewsname, sheetsname, xx, yy):
	xyz1 = XYZ(x/inc, y/inc,0)
	sheet = SheeByName(p)
	view = ViewsByName(i)
	TransactionManager.Instance.EnsureInTransaction(doc)
	viewport = Viewport.Create(doc, sheet.Id, view.Id, xyz1)
	TransactionManager.Instance.TransactionTaskDone()
	# viewportTypeId = ElementId(10159) # NO Title
	# viewport.ChangeTypeId(viewportTypeId)
	# viewports.append(viewport)
# ----------------------------------------
