# Dynamo graph DuplicatePanelElementsAndCircuits  .DYF "PowerCopiedElements with node and ophase" (Dynamo 2.0.1.5055)

# group: GET ALL CIRCUITED ELEMENTS
categories = Categories(index=182)  # graph input
all_elements_of_category = ElementsOfCategory(Category=categories)
python_script = Python(IN[0]=all_elements_of_category)
# ---------- python_script.python (18 lines) ----------
import clr
clr.AddReference('ProtoGeometry')
from Autodesk.DesignScript.Geometry import *
#The inputs to this node will be stored as a list in the IN variables.
systems = UnwrapElement(IN[0])
panels = []
elements = []

for x in systems:
	panels.append(x.BaseEquipment)
	sublist = []
	elementset = x.Elements
	for x in elementset:
		sublist.append(x)
	elements.append(sublist)

#Assign your output to the OUT variable.
OUT = elements
# ----------------------------------------
watch = Watch(python_script)

select_model_element = DSModelElementSelection()  # 1 picked in the model

# group: GET ELEMENTS ONLY CIRCUITED TO CHOSEN PANEL
string = StringInput("Panel Name")  # graph input
getParameterValueByName = Element.GetParameterValueByName(element=select_model_element, parameterName=string)
string_2 = StringInput("Panel")  # graph input
getParameterValueByName_2 = Element.GetParameterValueByName(element=all_elements_of_category, parameterName=string_2)
eq = getParameterValueByName == getParameterValueByName_2
filterByBoolMask = List.FilterByBoolMask(list=all_elements_of_category, mask=eq)
python_script_2 = Python(IN[0]=filterByBoolMask.in)  # same code as python_script
string_3 = StringInput("Panel : ")  # graph input
add = string_3 + getParameterValueByName

select_model_element_2 = DSModelElementSelection()  # 1 picked in the model
select_model_element_3 = DSModelElementSelection()  # 1 picked in the model

# group: COPY ELEMENTS TO FROM START POINT TO END POINT
getLocation = Element.GetLocation(element=select_model_element_2)
getLocation_2 = Element.GetLocation(element=select_model_element_3)
byTwoPoints = Vector.ByTwoPoints(start=getLocation, end=getLocation_2)
code_block = CodeBlock { "true"; }

copyByVector = Custom[Element.CopyByVector](element=python_script_2@L2, vector=byTwoPoints, rehostToClosestLevel=code_block)  # Copies an element or a list of elements by a given vector.
clean = List.Clean(list=copyByVector)

# group: Create new circuit on Panel and assign elementset to new circuit
python_script_3 = Python(IN[0]=clean)
# ---------- python_script_3.python (62 lines) ----------
import clr
clr.AddReference('ProtoGeometry')
from Autodesk.DesignScript.Geometry import *

clr.AddReference('RevitServices')
import RevitServices
from RevitServices.Persistence import DocumentManager
from RevitServices.Transactions import TransactionManager
from System.Collections.Generic import *

clr.AddReference('RevitNodes')
import Revit
clr.ImportExtensions(Revit.Elements)

clr.AddReference('RevitAPI')
import Autodesk
from Autodesk.Revit.DB import *
from Autodesk.Revit.DB.Electrical import *
from Autodesk.Revit.DB import MEPSystem

clr.AddReference('DSCoreNodes')
import DSCore
from DSCore.List import *

import sys
pyt_path = r'C:\Program Files (x86)\IronPython 2.7\Lib'
sys.path.append(pyt_path)

# Import List ( ICollection(ElementId) = List[ElementId]() )
clr.AddReference("System")
from System.Collections.Generic import List 

#The inputs to this node will be stored as a list in the IN variables.
input = UnwrapElement(IN[0])

ElectComponents = []
NewCircuit = []

for sublist in input:
	sub = List[ElementId]()
	ElectComponents.append(sub)
	for item in sublist:
		sub.Add(item.Id)


doc = DocumentManager.Instance.CurrentDBDocument
uiapp = DocumentManager.Instance.CurrentUIApplication
app = uiapp.Application
uidoc = DocumentManager.Instance.CurrentUIApplication.ActiveUIDocument

ListNewCircuit = []

TransactionManager.Instance.EnsureInTransaction(doc)

for e in ElectComponents:
	NewCircuit = doc.Create.NewElectricalSystem(e, ElectricalSystemType.PowerCircuit)
	ListNewCircuit.append(NewCircuit)

TransactionManager.Instance.TransactionTaskDone()


OUT = ListNewCircuit
# ----------------------------------------

select_model_element_4 = DSModelElementSelection()  # 1 picked in the model

# group: Select panel. IN[0] = Electrical System IN[1] = Panel element
python_script_4 = Python(IN[0]=python_script_3, IN[1]=select_model_element_4)
# ---------- python_script_4.python (51 lines) ----------
import clr
clr.AddReference('ProtoGeometry')
from Autodesk.DesignScript.Geometry import *

clr.AddReference('RevitServices')
import RevitServices
from RevitServices.Persistence import DocumentManager
from RevitServices.Transactions import TransactionManager
from System.Collections.Generic import *

clr.AddReference('RevitNodes')
import Revit
clr.ImportExtensions(Revit.Elements)

clr.AddReference('RevitAPI')
import Autodesk
from Autodesk.Revit.DB import *
from Autodesk.Revit.DB.Electrical import *
from Autodesk.Revit.DB import MEPSystem

clr.AddReference('DSCoreNodes')
import DSCore
from DSCore.List import *

import sys
pyt_path = r'C:\Program Files (x86)\IronPython 2.7\Lib'
sys.path.append(pyt_path)

# Import List ( ICollection(ElementId) = List[ElementId]() )
clr.AddReference("System")
from System.Collections.Generic import List 


circuit = UnwrapElement(IN[0])
panel = UnwrapElement(IN[1])

doc = DocumentManager.Instance.CurrentDBDocument
uiapp = DocumentManager.Instance.CurrentUIApplication
app = uiapp.Application
uidoc = DocumentManager.Instance.CurrentUIApplication.ActiveUIDocument

TransactionManager.Instance.EnsureInTransaction(doc)

for _ in circuit:
	_.SelectPanel(panel)

TransactionManager.Instance.TransactionTaskDone()

#Assign your output to the OUT variable.
OUT = []
OUT = circuit, panel
# ----------------------------------------

# group: GET CIRCUIT PARAMETERS TO BE COPIED
string_4 = StringInput("Rating")  # graph input
getParameterValueByName_3 = Element.GetParameterValueByName(element=filterByBoolMask.in, parameterName=string_4)
string_5 = StringInput("Load Name")  # graph input
getParameterValueByName_4 = Element.GetParameterValueByName(element=filterByBoolMask.in, parameterName=string_5)

# group: SET RATING AND LOAD NAME FOR CIRCUITS
string_6 = StringInput("Rating")  # graph input
setParameterByName = Element.SetParameterByName(element=python_script_3, parameterName=string_6, value=getParameterValueByName_3)
string_7 = StringInput("Load Name")  # graph input
setParameterByName_2 = Element.SetParameterByName(element=python_script_3, parameterName=string_7, value=getParameterValueByName_4)

code_block_2 = CodeBlock { Circuits and Panel; }
code_block_3 = CodeBlock { Origin Element Location; }
code_block_4 = CodeBlock { End Element Location; }
code_block_5 = CodeBlock { End Panel; }
code_block_6 = CodeBlock { Elements; }
string_8 = StringInput("Phase Created")  # graph input
string_9 = StringInput("Phase 130")
setParameterByName_3 = Element.SetParameterByName(element=clean, parameterName=string_8, value=string_9)
code_block_7 = CodeBlock { Set New Phase; }
code_block_8 = CodeBlock { Origin Panel; }
copyElements = Revit.Utilities.CopyElements(translation=byTwoPoints)  # unwired: element
copyByVector_2 = Custom[Element.CopyByVector]()  # unwired: element, vector
