# Dynamo graph DuplicateSheetsAndViews-L2-L3.dyn (Dynamo 1.3.2.2480)

categories = Categories("Sheets")
all_elements_of_category = ElementsOfCategory(categories)
restOfItems = List.RestOfItems(all_elements_of_category)

# group: SORT SHEETS
sheetNumber = Sheet.SheetNumber(restOfItems)
code_block = CodeBlock { " "; }
add = sheetNumber + code_block
sheetName = Sheet.SheetName(restOfItems)
add_2 = add + sheetName
sortByKey = List.SortByKey(list=restOfItems, keys=add_2)

# group: FILTER FOR THIS NAME
code_block_2 = CodeBlock { "230"; }

code_block_3 = CodeBlock { "PHASE BY SUITE"; }
getParameterValueByName = Element.GetParameterValueByName(element=sortByKey.sorted_list, parameterName=code_block_3)
eq = code_block_2 == getParameterValueByName
filterByBoolMask = List.FilterByBoolMask(list=sortByKey.sorted_list, mask=eq)

# group: Select RANG OF SHEETS from list in ALL SHEETS
code_block_4 = CodeBlock { 9; }
code_block_5 = CodeBlock { 10; }

slice = List.Slice(filterByBoolMask.in, code_block_4, code_block_5)
code_block_6 = CodeBlock(t3=slice) { t2 = t3.SheetNumber; t4 = t2 + " "; t5 = t3.SheetName; }

# group: RANGE OF SHEETS
add_3 = code_block_6.t4 + code_block_6.t5

code_block_7 = CodeBlock(t3=filterByBoolMask.in) { t2 = t3.SheetNumber; t4 = t2 + " "; t5 = t3.SheetName; }

# group: ALL SHEETS
add_4 = code_block_7.t4 + code_block_7.t5

# group: If "True" then Range of Sheets If "False" then All Sheets
boolean = BoolSelector(false)
if_ = If(test=boolean, true=slice, false=filterByBoolMask.in)

# group: TRUE WILL RUN THE PROGRAM
boolean_2 = BoolSelector(false)

boolean_3 = BoolSelector(true)
number = DoubleInput(1)
code_block_8 = CodeBlock { "OFO - "; }
duplicate = Revit.Sheet.Duplicate(if_, boolean_2, boolean_3, number, arg5=code_block_8)
code_block_9 = CodeBlock { "PHASE BY SUITE"; }

# group: PHASE BY SUITE
string = StringInput("OFO")

setParameterByName = Element.SetParameterByName(element=duplicate.out1, parameterName=code_block_9, value=string)
categories_2 = Categories("RevisionClouds")

# group: DELETES REVISION
views = Custom[Springs.Sheet.Views+](sheet=duplicate.out1)  # Extracts all views and schedules (minus the revision schedule) placed on the input sheet (or sheets). Will be depreciated once the bult in node works with all plan types.
elementsOfCategoryByView = Custom[RIE.ElementsOfCategoryByView](Views=views.view_s@L2, Category=categories_2)  # Retrieves all elements of an input category in input views.
flatten = Flatten(elementsOfCategoryByView)
delete = archilab.Revit.Elements.Elements.Delete(flatten)
elementsOfCategoryByView_2 = Custom[RIE.ElementsOfCategoryByView](Category=categories_2)  # unwired: Views
map = List.Map(list=views.view_s, f_x=elementsOfCategoryByView_2)
flatten_2 = Flatten(map)
elementsOfCategoryByView_3 = Custom[RIE.ElementsOfCategoryByView](Category=categories_2)  # unwired: Views
flatten_3 = Flatten(elementsOfCategoryByView_3)
join = List.Join(flatten_2, flatten_3)
delete_2 = archilab.Revit.Elements.Elements.Delete(join)
