# Dynamo graph DuplicateSheetsAndViews.dyn (Dynamo 1.3.2.2480)

categories = Categories("Sheets")
all_elements_of_category = ElementsOfCategory(categories)
restOfItems = List.RestOfItems(all_elements_of_category)

# group: SORT SHEETS
sheetNumber = Sheet.SheetNumber(restOfItems)
code_block = CodeBlock { " "; }
add = sheetNumber + code_block
sheetName = Sheet.SheetName(restOfItems)
add_2 = add + sheetName
sortByKey = List.SortByKey(list=restOfItems, keys=add_2)

# group: FILTER FOR THIS NAME
code_block_2 = CodeBlock { "242"; }

code_block_3 = CodeBlock { "PHASE BY SUITE"; }
getParameterValueByName = Element.GetParameterValueByName(element=sortByKey.sorted_list, parameterName=code_block_3)
eq = code_block_2 == getParameterValueByName
filterByBoolMask = List.FilterByBoolMask(list=sortByKey.sorted_list, mask=eq)
watch = Watch(filterByBoolMask.in)

# group: Select range in SHEETS that you want duplicated
code_block_4 = CodeBlock { 7; }
code_block_5 = CodeBlock { 8; }

slice = List.Slice(watch, code_block_4, code_block_5)
sheetNumber_2 = Sheet.SheetNumber(slice)
sheetName_2 = Sheet.SheetName(slice)

# group: RANGE
add_3 = sheetNumber_2 + sheetName_2

sheetNumber_3 = Sheet.SheetNumber(watch)
code_block_6 = CodeBlock { " "; }
add_4 = sheetNumber_3 + code_block_6
sheetName_3 = Sheet.SheetName(watch)

# group: ALL SHEETS
add_5 = add_4 + sheetName_3

# group: TRUE WILL RUN THE PROGRAM
boolean = BoolSelector(true)

number = DoubleInput(1)
code_block_7 = CodeBlock { "300 - "; }
duplicate = Revit.Sheet.Duplicate(slice, boolean, boolean, number, arg5=code_block_7)
views = Sheet.Views(duplicate.out1)
code_block_8 = CodeBlock { "PHASE BY SUITE"; }

# group: SET PHASE BY SUITE
string = StringInput("L300")

setParameterByName = Element.SetParameterByName(element=views, parameterName=code_block_8, value=string)

# group: Get Primary View
python_script = Python(IN[0]=views)
# ---------- python_script.python (16 lines) ----------
import clr
clr.AddReference('RevitAPI')
from Autodesk.Revit.DB import *

clr.AddReference("RevitNodes")
import Revit

def GetPrimaryView(view):
	return view.Document.GetElement(view.GetPrimaryViewId())

views = UnwrapElement(IN[0])

if isinstance(IN[0], list):
	OUT = [GetPrimaryView(x) for x in views]
else:
	OUT = GetPrimaryView(views)
# ----------------------------------------

setParameterByName_2 = Element.SetParameterByName(element=python_script, parameterName=code_block_8, value=string)
setParameterByName_3 = Element.SetParameterByName(element=duplicate.out1, parameterName=code_block_8, value=string)

# group: DYNaMO PLAYS DEPACITO
python_script_2 = Python()  # unwired: IN[0]
# ---------- python_script_2.python (13 lines) ----------
import clr
clr.AddReference('ProtoGeometry')
from Autodesk.DesignScript.Geometry import *

import sys
pyt_path = r'C:\Program Files (x86)\IronPython 2.7\Lib'
sys.path.append(pyt_path)
import System

import os

#Assign your output to the OUT variable.
OUT = os.startfile(r"N:\aaProject Delivery\07-CAD Manual\07.4-Libraries\Dynamo\Electrical\DynamoPlayDespacito\Despacito [8 Bit Tribute to Luis Fonsi & Daddy Yankee feat. Justin Bieber] - 8 Bit Universe.mp3")
# ----------------------------------------
