# Dynamo graph DuplicateSheetsAndViews2.0.dyn (Dynamo 1.3.2.2480)

categories = Categories("Sheets")
all_elements_of_category = ElementsOfCategory(categories)
sheetName = Sheet.SheetName(all_elements_of_category)
string = StringInput("LC4")
string_2 = StringInput("Test 1 ")
create = List.Create(string, string_2)
number = DoubleInput(10)
getItemAtIndex = List.GetItemAtIndex(list=all_elements_of_category, index=number)
boolean = BoolSelector(true)
number_2 = DoubleInput(1)
code_block = CodeBlock { "test1"; "Test2"; }
duplicate = Revit.Sheet.Duplicate(getItemAtIndex, boolean, boolean, number_2, code_block.out0, code_block.out1)
all_elements_of_type = ElementsOfType()  # unwired: arg0
categories_2 = Categories("ElectricalEquipment")
all_elements_of_category_2 = ElementsOfCategory(categories_2)
watch = Watch(all_elements_of_category_2)
string_3 = StringInput("Panel Name")
parameterByName = Parameter.ParameterByName(element=all_elements_of_category_2, name=string_3)
string_from_object = FromObject(parameterByName)
string_4 = StringInput("Panel Name : ")
eq = string_from_object == string_4
filterByBoolMask = List.FilterByBoolMask(list=watch, mask=eq)
string_5 = StringInput("Level")
parameterByName_2 = Parameter.ParameterByName(element=filterByBoolMask.out, name=string_5)
string_from_object_2 = FromObject(parameterByName_2)
string_6 = StringInput("Level : Level B2")
eq_2 = string_from_object_2 == string_6
filterByBoolMask_2 = List.FilterByBoolMask(list=filterByBoolMask.out, mask=eq_2)
string_from_object_3 = FromObject(filterByBoolMask_2.in)
