# Dynamo graph Dynamo Place Views on Sheets.dyn (Dynamo 1.3.2.2480)

# group: Credits
# note: Copyright (c) 2016, AECOM
# Written by: Matthew Anderle & Chris Williams

# group: Get All ViewPlan Views in Document
element_types = ElementTypes("ViewPlan")
all_elements_of_type = ElementsOfType(element_types)
watch = Watch(all_elements_of_type)

# group: Capture View Names
name = Element.Name(all_elements_of_type)
watch_2 = Watch(name)

# group: Filter View Name by String and Case
search_string = StringInput("Level")
ignore_case = BoolSelector(true)

# group: Connect Node to Filter by String.EndsWith Logic
endsWith = String.EndsWith(watch_2, search_string, ignore_case)
connect_to_mask = Watch(endsWith)

# group: User Selection
file_path_for_excel_document = Filename(".\ViewList.xls")
worksheet_name = StringInput("Views List")
select_titleblock_for_sheets = FamilyTypes()

# group: Read Data from Excel File
fromPath = FileObject(file_path_for_excel_document)  # "File.FromPath"
boolean = BoolSelector(true)

# group: Suspend Creating Sheets Here with Freeze
readFromFile = Excel.ReadFromFile(file=fromPath, sheetName=worksheet_name, readAsStrings=boolean)  # frozen

excel_data_watch = Watch(readFromFile)

# group: Transpose List and Split Column Data by Excel Column Index
transpose = List.Transpose(excel_data_watch)
code_block = CodeBlock { 3; 4; }
getItemAtIndex = List.GetItemAtIndex(list=transpose, index=code_block.out1)
watch_3 = Watch(getItemAtIndex)
getItemAtIndex_2 = List.GetItemAtIndex(list=transpose, index=code_block.out0)
watch_4 = Watch(getItemAtIndex_2)

# group: Connect Node to Filter by String.Contains Logic
contains = String.Contains(str=watch_2, searchFor=search_string, ignoreCase=ignore_case)
connect_to_mask_2 = Watch(contains)

# group: Filter List from Mask
filterByBoolMask = List.FilterByBoolMask(list=watch, mask=connect_to_mask_2)
sort = List.Sort(filterByBoolMask.in)

# group: Remove Headers from Lists
restOfItems = List.RestOfItems(watch_3)
restOfItems_2 = List.RestOfItems(watch_4)
view_list_passthrough = Watch(sort)

# group: Create Sheet in Revit and Apply TitleBlock and View
byNameNumberTitleBlockAndView = Sheet.ByNameNumberTitleBlockAndView(sheetName=restOfItems, sheetNumber=restOfItems_2, titleBlockFamilyType=select_titleblock_for_sheets, view=view_list_passthrough)
watch_5 = Watch(byNameNumberTitleBlockAndView)

# group: Suspend Creating View List in Excel Here with Freeze
freeze_to_suspend_excel_write = Watch(sort)

# group: Create View List with Headers and Transpose
excel_column_headers = CodeBlock { "Category"; "Name"; "ElementID"; "Sheet Number"; "Sheet Name"; }
addItemToFront = List.AddItemToFront(item=excel_column_headers.out0, list=freeze_to_suspend_excel_write)
name_2 = Element.Name(freeze_to_suspend_excel_write)
addItemToFront_2 = List.AddItemToFront(item=excel_column_headers.out1, list=name_2)
id = Element.Id(freeze_to_suspend_excel_write)
addItemToFront_3 = List.AddItemToFront(item=excel_column_headers.out2, list=id)
create = List.Create(excel_column_headers.out3)
create_2 = List.Create(excel_column_headers.out4)
create_3 = List.Create(addItemToFront, addItemToFront_2, addItemToFront_3, create, create_2)
transpose_2 = List.Transpose(create_3)

# group: Write View List to Excel
code_block_2 = CodeBlock { 0; 0; }
boolean_2 = BoolSelector(true)
writeToFile = Excel.WriteToFile(filePath=file_path_for_excel_document, sheetName=worksheet_name, startRow=code_block_2.out0, startCol=code_block_2.out1, data=transpose_2, overWrite=boolean_2)
watch_6 = Watch(writeToFile)
