# Dynamo graph Find Untagged Elements with ksi.dyn (Dynamo 1.3.2.2480)

# group: Select Element Category
categories = Categories("StructuralFraming")

all_elements_of_category = ElementsOfCategory(categories)
id = Element.Id(all_elements_of_category)
groupByKey = List.GroupByKey(list=all_elements_of_category, keys=id)
code_block = CodeBlock(taggedElement=groupByKey.groups, tag=groupByKey.unique_keys)
# ---------- code_block.designscript (4 lines) ----------
//declare a new dictionary to store this in
tagDictionary = {};
//dictionary[whatToLookUpBy] = tagElement
tagDictionary[taggedElement] = tag;
# ----------------------------------------

# group: Select Element Tag Category
categories_2 = Categories("StructuralFoundationTags")

all_elements_of_category_2 = ElementsOfCategory(categories_2)
taggedElement = Tag.TaggedElement(all_elements_of_category_2)
id_2 = Element.Id(taggedElement)
join = List.Join(id_2, id)
groupByKey_2 = List.GroupByKey(list=join, keys=join)
code_block_2 = CodeBlock { 1; }
count = List.Count(groupByKey_2.groups@L2)
eq = code_block_2 == count
filterByBoolMask = List.FilterByBoolMask(list=groupByKey_2.unique_keys, mask=eq)
code_block_3 = CodeBlock(tagDictionary=code_block.tagDictionary, taggedElement=filterByBoolMask.in) { tagDictionary[taggedElement]; }

# group: Remove Nulls
python_script = Python(IN[0]=code_block_3)
# ---------- python_script.python (23 lines) ----------
#Copyright(c) 2015, Konrad K Sobon
# @arch_laboratory, http://archi-lab.net

import clr
clr.AddReference('ProtoGeometry')
from Autodesk.DesignScript.Geometry import *
#The inputs to this node will be stored as a list in the IN variable.
dataEnteringNode = IN

def ClearList(_list):
    out = []
    for _list1 in _list:
        if _list1 is None:
            continue
        if isinstance(_list1, list):
             _list1 = ClearList(_list1)
             if not _list1:
                 continue
        out.append(_list1)
    return out

#Assign your output to the OUT variable
OUT = ClearList(IN[0])
# ----------------------------------------

flatten = Flatten(python_script)
watch = Watch(flatten)

# group: FILTER FOR ELEMENTS CONTAINGING STEEL
code_block_4 = CodeBlock { "Structural Material"; }
code_block_5 = CodeBlock { "Steel"; }

getParameterValueByName = Element.GetParameterValueByName(element=watch, parameterName=code_block_4)

# group (continued): FILTER FOR ELEMENTS CONTAINGING STEEL
name = Material.Name(getParameterValueByName)
contains = String.Contains(str=name, searchFor=code_block_5)

code_block_6 = CodeBlock { "ksi"; }
contains_2 = String.Contains(str=name, searchFor=code_block_6)
or_ = Or(contains_2, contains)

# group (continued): FILTER FOR ELEMENTS CONTAINGING STEEL
filterByBoolMask_2 = List.FilterByBoolMask(list=watch, mask=or_)

# group: SELECTS ELEMENTS IN REVIT
python_script_2 = Python(IN[0]=filterByBoolMask_2.in)
# ---------- python_script_2.python (44 lines) ----------
# Copyright(c) 2017, Dimitar Venkov
# @5devene, dimitar.ven@gmail.com
# www.badmonkeys.net

import clr
import System

clr.AddReference("RevitNodes")
import Revit
clr.ImportExtensions(Revit.Elements)
clr.ImportExtensions(Revit.GeometryConversion)

clr.AddReference('RevitServices')
from RevitServices.Persistence import DocumentManager
from RevitServices.Transactions import TransactionManager
doc = DocumentManager.Instance.CurrentDBDocument

clr.AddReference('System')
from System.Collections.Generic import List

clr.AddReference("RevitAPI")
from Autodesk.Revit.DB import *

def tolist(obj1):
	if hasattr(obj1,"__iter__"): return obj1
	else: return [obj1]

doc = DocumentManager.Instance.CurrentDBDocument
uiapp = DocumentManager.Instance.CurrentUIApplication
app = uiapp.Application
uidoc=DocumentManager.Instance.CurrentUIApplication.ActiveUIDocument

eleId=[]

for i in UnwrapElement(IN[0]):
	eleId.append(i.Id)
	
elemIds = List[ElementId](eleId)

try:
	uidoc.Selection.SetElementIds(elemIds)
	OUT = IN[0]
except:
	OUT = "Failed to set selection"
# ----------------------------------------
