# Dynamo graph FindAndReplace (Sheet Types).dyn (Dynamo 1.3.2.2480)

element_types = ElementTypes("ViewSheet")
all_elements_of_type = ElementsOfType(element_types)
code_block = CodeBlock { "Type"; }
get_type_parameter = Custom[Get Type Parameter](element=all_elements_of_type, parameterName=code_block)  # This node will retrieve a type parameter by its name.
code_block_2 = CodeBlock { 216; }
getItemAtIndex = List.GetItemAtIndex(list=all_elements_of_type, index=code_block_2)
code_block_3 = CodeBlock { "Type"; }
family_types = FamilyTypes("ID TBLK 36x48:Suite 124")
set_type_parameter = Custom[Set Type Parameter](element=getItemAtIndex, parameterName=code_block_3, parameterValue=family_types)  # This node will set a type parameter for an element.
code_block_4 = CodeBlock { "Sheet Number"; }
getParameterValueByName = Element.GetParameterValueByName(element=all_elements_of_type, parameterName=code_block_4)
code_block_5 = CodeBlock { "PHASE BY SUITE"; }
getParameterValueByName_2 = Element.GetParameterValueByName(element=all_elements_of_type, parameterName=code_block_5)
add = getParameterValueByName + getParameterValueByName_2
parameter_types = ParameterTypeUi("Acceleration")
parameters = Element.Parameters(getItemAtIndex)
setValue = Parameter.SetValue()  # unwired: arg0, arg1
