# Dynamo graph FindAndReplaceParameters (SUBSTRING).dyn (Dynamo 1.3.2.2480)

# group: Select an element of the category you would like to Find Replace
select_model_element = DSModelElementSelection()  # 1 picked in the model

getCategory = Element.GetCategory(select_model_element)
all_elements_of_category = ElementsOfCategory(getCategory)

# group: Select Phase of Elements
select_phase = RevitPhases("Suite 136")

byPhaseCreated = Revit.ElementFilter.ByPhaseCreated(all_elements_of_category, select_phase)

# group: Type in Parameter Name
string = StringInput("Panel Name")

watch = Watch(string)
getParameterValueByName = Element.GetParameterValueByName(element=byPhaseCreated, parameterName=watch)
code_block = CodeBlock { "_"; }
contains = String.Contains(str=getParameterValueByName, searchFor=code_block)
filterByBoolMask = List.FilterByBoolMask(list=byPhaseCreated, mask=contains)
getParameterValueByName_2 = Element.GetParameterValueByName(element=filterByBoolMask.in, parameterName=watch)
code_block_2 = CodeBlock { 13; }
code_block_3 = CodeBlock { -3; }
remove = String.Remove(str=getParameterValueByName_2, startIndex=code_block_2, count=code_block_3)
setParameterByName = Element.SetParameterByName(element=filterByBoolMask.in, parameterName=watch, value=remove)
string_2 = StringInput("PHASE BY SUITE")
string_3 = StringInput("Location")
