# Dynamo graph FindAndReplaceText (SUBSTRING).dyn (Dynamo 1.3.2.2480)

activeView = Custom[Springs.Doc.ActiveView]()  # Selects the current document's active view. Supports more view types than the built-in option. Will be depreciated once the bult in node works with all plan types.

# group: Select an element of the category you would like to Find Replace
select_model_element = DSModelElementSelection()  # 1 picked in the model

getCategory = Element.GetCategory(select_model_element)
elements_in_view_by_category = Custom[Elements in view by category](View=activeView, Category=getCategory)  # Returns all the elements in the selected view(s) by the selected categor(y)(ies)
select_model_elements = DSModelElementsSelection()  # 129 picked in the model
byCategory = Revit.ElementFilter.ByCategory(select_model_elements, getCategory)
watch = Watch(byCategory)
text = TextNote.Text(byCategory)
code_block = CodeBlock { "_"; }
contains = String.Contains(str=text, searchFor=code_block)
filterByBoolMask = List.FilterByBoolMask(list=watch, mask=contains)
text_2 = TextNote.Text(filterByBoolMask.in)
code_block_2 = CodeBlock { 13; }
code_block_3 = CodeBlock { -3; }
remove = String.Remove(str=text_2, startIndex=code_block_2, count=code_block_3)
setText = TextNote.SetText(filterByBoolMask.in, remove)
indexOf = String.IndexOf(string=text_2, searchFor=contains)
