# Dynamo graph Fire Exit Risk Assessment.dyn (Dynamo 1.3.2.2480)

# group: DESCRIPTION
# note: DYNAMO FILE NAME
# Fire Exit Risk Assessment.dyn
# note: ASSOCIATED REVIT FILE(S)
# rac_advanced_sample_project.rvt
# note: AUTHOR(S)
# Dieter Vermeulen (Autodesk)
# note: DESCRIPTION
# With this script the shortest path between a normal exit door and the nearest emergency exit is calculated and visualized in the current Revit document with 2D Detail Lines in the assigned 2D view.
# note: DYNAMO VERSION
# 1.2.1.3083
# note: WORKING REVIT VERSION(S)
# 2017
# note: REQUIRED DYNAMO PACKAGES
# Lunchbox for Dynamo 2015.11.28
# Archi-lab 2016.5.27

# group: Analysis Settings
analysis_area_mesh_accuracy = IntegerSlider(55, range=0..100 step 1)
vertical_clearance = DoubleInput(50)

# group: Element Input
# note: Choose the level where to perform the assessment.
levels = Levels()
categories = Categories("Rooms")
categories_2 = Categories("Doors")
# note: Choose categories, representing the "OBSTACLES"
categories_3 = Categories("Walls")
categories_4 = Categories("CurtainWallPanels")
categories_5 = Categories("Stairs")

# group: Collection of Revit elements
all_elements_at_level = ElementsAtLevel(levels)
getCategory = Element.GetCategory(all_elements_at_level)
string_from_object = FromObject(getCategory)
create = List.Create(categories, categories_2, categories_3, categories_4)
string_from_object_2 = FromObject(create)
eq = string_from_object@L2 == string_from_object_2  # lacing=Longest
# note: Only return the elements at the selected level
filterByBoolMask = List.FilterByBoolMask(list=all_elements_at_level, mask=eq@L2)
# note: Stairs are added separately as the category is not recognized in the "==" comparison
all_elements_of_category = ElementsOfCategory(categories_5)
code_block = CodeBlock(a=all_elements_of_category) { {a}; }
join = List.Join(filterByBoolMask.in, code_block)
code_block_2 = CodeBlock(el=join)
# ---------- code_block_2.designscript (6 lines) ----------
//Rooms
el[0];
//Doors
el[1];
//Obstacles
el[2..List.Count(el)-1];
# ----------------------------------------

# group: Analysis Surface Definition
code_block_3 = CodeBlock(Rooms=code_block_2.out0) { Rooms; }
code_block_4 = CodeBlock()
# ---------- code_block_4.designscript (3 lines) ----------
//Room filter criteria
"Department";
"Circulation";
# ----------------------------------------
getParameterValueByName = Element.GetParameterValueByName(element=code_block_3, parameterName=code_block_4.out0)
eq_2 = getParameterValueByName == code_block_4.out1
# note: Filter rooms based on their "Department" equals "Circulation"
filterByBoolMask_2 = List.FilterByBoolMask(list=code_block_3, mask=eq_2)
finishBoundary = Room.FinishBoundary(filterByBoolMask_2.in)
flatten = Flatten(finishBoundary@L2)
byJoinedCurves = PolyCurve.ByJoinedCurves(flatten)
# note: Create calculation areas of the circulation rooms based on their closed curves defined by their Finish Boundary.
byPatch = Surface.ByPatch(byJoinedCurves)
code_block_5 = CodeBlock(VerticalClearance=vertical_clearance) { VerticalClearance; }
# note: The resulting surface is moved vertically as "clearance" to make sure the circulation surfaces intersects the obstacles (like walls, stairs, ...)
offset = Surface.Offset(byPatch, code_block_5)
area = Surface.Area(offset)
area_2 = Room.Area(filterByBoolMask_2.in)
code_block_6 = CodeBlock(x=area_2)
# ---------- code_block_6.designscript (2 lines) ----------
//Convert to mm²
x*10000;
# ----------------------------------------
minimumItem = List.MinimumItem(code_block_6)
ge = area >= minimumItem
# note: Due to Room Bounding properties of columns, the resulting surfaces can represent these small columns. In this part these small irrelevant surfaces are filtered out.
# This is done by comparing the calculation area with the minimal real room area.
filterByBoolMask_3 = List.FilterByBoolMask(list=offset, mask=ge)
byJoinedSurfaces = PolySurface.ByJoinedSurfaces(filterByBoolMask_3.in)
# note: Join all the surfaces into a polysurface and convert this surface into a single surface by recreating it based on its perimeter curves.
perimeterCurves = Surface.PerimeterCurves(byJoinedSurfaces)
byJoinedCurves_2 = PolyCurve.ByJoinedCurves(perimeterCurves)
byPatch_2 = Surface.ByPatch(byJoinedCurves_2)

# group: Obstacles Initialization
code_block_7 = CodeBlock(Obstacles=code_block_2.out2) { Obstacles; }
geometry = Element.Geometry(code_block_7)
flatten_2 = Flatten(geometry)
XY = Plane.XY()
code_block_8 = CodeBlock { 2000; }
offset_2 = Plane.Offset(XY, code_block_8)
# note: Limit the solids to only those ones that intersect with a specific level
doesIntersect = Geometry.DoesIntersect(geometry=flatten_2, other=offset_2)
filterByBoolMask_4 = List.FilterByBoolMask(list=flatten_2, mask=doesIntersect)
# note: Union all the solids into a single object for easier detection.
byUnion = Solid.ByUnion(filterByBoolMask_4.in)

# group: Analysis Surface Meshing
code_block_9 = CodeBlock(n=analysis_area_mesh_accuracy) { 0..1..#n; }
byCoordinates = UV.ByCoordinates(code_block_9, code_block_9, lacing=CrossProduct)
flatten_3 = Flatten(byCoordinates)
# note: Creation of a Delaunay mesh on the circulation surface. This results in small line segments.
byParametersOnSurface = Tessellation.Delaunay.ByParametersOnSurface(flatten_3, byPatch_2)
# note: Filter the lines that are laying on the analysis surface.
intersectAll = Geometry.IntersectAll(geometry=byParametersOnSurface, others=byPatch_2)
flatten_4 = Flatten(intersectAll)
doesIntersect_2 = Geometry.DoesIntersect(geometry=flatten_4, other=byUnion)
# note: Remove areas from the analysis grid that are obstructed by obstacles.
filterByBoolMask_5 = List.FilterByBoolMask(list=flatten_4, mask=doesIntersect_2)
flatten_5 = Flatten(filterByBoolMask_5.out)

# group: Escape Route Initialization
code_block_10 = CodeBlock(Doors=code_block_2.out1) { Doors; }
code_block_11 = CodeBlock { "Exit Type"; "Room Exit"; "Emergency Exit"; }
getParameterValueByName_2 = Element.GetParameterValueByName(element=code_block_10, parameterName=code_block_11.out0)
eq_3 = getParameterValueByName_2 == code_block_11.out1  # lacing=Longest
filterByBoolMask_6 = List.FilterByBoolMask(list=code_block_10, mask=eq_3)
# note: Get the normal "Room Exit" doors and the "Emergency Exit" doors.
code_block_12 = CodeBlock(RoomExit=filterByBoolMask_6.in) { RoomExit; }
eq_4 = getParameterValueByName_2 == code_block_11.out2  # lacing=Longest
filterByBoolMask_7 = List.FilterByBoolMask(list=code_block_10, mask=eq_4)
code_block_13 = CodeBlock(EmergencyExit=filterByBoolMask_7.in) { EmergencyExit; }
create_2 = List.Create(code_block_12, code_block_13)
solids = Element.Solids(create_2)
# note: Get the centerpoint of the door. This method is used instead of the "Element.Location" node, as the Curtain Wall Doors don't return a value for the insertion point.
byUnion_2 = Solid.ByUnion(solids@@L2)
centroid = Solid.Centroid(byUnion_2)
X = Point.X(centroid)
Y = Point.Y(centroid)
# note: Recreate the points at the floor offset level
pointAtParameter = Surface.PointAtParameter(surface=byPatch_2)
Z = Point.Z(pointAtParameter)
# note: Create a new point at the analysis surface level, representing the starting point of the Emergency Escape Route.
byCoordinates_2 = Point.ByCoordinates(x=X, y=Y, z=Z)
code_block_14 = CodeBlock(a=byCoordinates_2)
# ---------- code_block_14.designscript (4 lines) ----------
//Points of Room Exit Doors
a[0];
//Points of Emergency Exit Doors
a[1];
# ----------------------------------------
# note: Create a straight path between start and end of the escape route. This line will be optimized within the analysis grid with the "Shortest Walk" node.
byStartPointEndPoint = Line.ByStartPointEndPoint(startPoint=code_block_14.out0, endPoint=code_block_14.out1, lacing=CrossProduct)

# group: Pathfinding
code_block_15 = CodeBlock(AnalysisGrid=flatten_5) { AnalysisGrid; }
length = Curve.Length(code_block_15)
# note: *******************************************************
# Node from the Lunchbox package
shortestWalk = Geometry.Curves.ShortestWalk(code_block_15, length, byStartPointEndPoint@L2)
length_2 = Curve.Length()  # unwired: arg0
minimumItemByKey = MinimumItemByKey(shortestWalk@L2, length_2)

# group: Resolve jaggy path to smooth
join_2 = List.Join()  # unwired: arg0, arg1
curves = PolyCurve.Curves(minimumItemByKey)
firstItem = List.FirstItem(curves@L2)
startPoint = Curve.StartPoint(firstItem)
endPoint = Curve.EndPoint(curves@L2)
combine = List.Combine(join_2, startPoint, endPoint)
code_block_16 = CodeBlock { 3; }
byControlPoints = NurbsCurve.ByControlPoints(combine, code_block_16)

# group: Visualize results in Revit
views = Views("Project View")
byCurve = DetailCurve.ByCurve(views, byControlPoints)
code_block_17 = CodeBlock { "Line Style"; }
code_block_18 = CodeBlock { "Evacuation Path"; }
# note: *******************************************************
# From Archi-Lab package
get_line_style_by_name = Custom[Get Line Style by Name](Name=code_block_18)  # This node will return a line style object by its name. Line styles can be either Drafting or Model Line Property.
setParameterByName = Element.SetParameterByName(element=byCurve, parameterName=code_block_17, value=get_line_style_by_name)
