# Dynamo graph GET PARENT VIEWS.dyn (Dynamo 1.3.2.2480)

categories = Categories("Sheets")
all_elements_of_category = ElementsOfCategory(categories)
restOfItems = List.RestOfItems(all_elements_of_category)
views = Sheet.Views(restOfItems)
code_block = CodeBlock { view : Revit.View; }  # unwired: view
python_script = Python(IN[0]=code_block)
# ---------- python_script.python (16 lines) ----------
import clr
clr.AddReference('RevitAPI')
from Autodesk.Revit.DB import *

clr.AddReference("RevitNodes")
import Revit

def GetPrimaryView(view):
	return view.Document.GetElement(view.GetPrimaryViewId())

views = UnwrapElement(IN[0])

if isinstance(IN[0], list):
	OUT = [GetPrimaryView(x) for x in views]
else:
	OUT = GetPrimaryView(views)
# ----------------------------------------
code_block_2 = CodeBlock(view=python_script) { view; }
