# Dynamo custom node Get Documents.dyf (Dynamo 1.3.2.2480)
# category: archilab.Revit.Select
# Queries all linked Revit files and retrieves their Name, LinkInstance and Document properties.

empty = List.Empty()
python_script = Python(IN[0]=empty)  # unwired: IN[1]
# ---------- python_script.python (50 lines) ----------
#Copyright(c) 2015, Konrad K Sobon
# @arch_laboratory, http://archi-lab.net

# Huge thanks to Andreas Dieckmann for 
# adding link path functionality

import clr
clr.AddReference('ProtoGeometry')
from Autodesk.DesignScript.Geometry import *

# Import DocumentManager and TransactionManager
clr.AddReference("RevitServices")
import RevitServices
from RevitServices.Persistence import DocumentManager
from RevitServices.Transactions import TransactionManager

from System.Collections.Generic import *

# Import RevitAPI
clr.AddReference("RevitAPI")
import Autodesk
from Autodesk.Revit.DB import *
from Autodesk.Revit.DB.Analysis import *

doc = DocumentManager.Instance.CurrentDBDocument
uiapp = DocumentManager.Instance.CurrentUIApplication
app = uiapp.Application

# Import ToDSType(bool) extension method
clr.AddReference("RevitNodes")
import Revit
clr.ImportExtensions(Revit.Elements)

#The inputs to this node will be stored as a list in the IN variable.
dataEnteringNode = IN

collector = Autodesk.Revit.DB.FilteredElementCollector(doc)
linkInstances = collector.OfClass(Autodesk.Revit.DB.RevitLinkInstance)

linkDoc, linkName, linkPath = [], [], []
for i in linkInstances:
	linkDoc.append(i.GetLinkDocument())
	linkName.append(i.Name)
	try:
		linkPath.append(i.GetLinkDocument().PathName)
	except:
		linkPath.append(None)
		pass

OUT = linkDoc, linkName, linkInstances, linkPath
# ----------------------------------------
number = DoubleInput(2)
getItemAtIndex = List.GetItemAtIndex(list=python_script, index=number)
Link_Instance = Output(getItemAtIndex)
number_2 = DoubleInput(0)
getItemAtIndex_2 = List.GetItemAtIndex(list=python_script, index=number_2)
Link_Doc = Output(getItemAtIndex_2)
number_3 = DoubleInput(1)
getItemAtIndex_3 = List.GetItemAtIndex(list=python_script, index=number_3)
Link_Name = Output(getItemAtIndex_3)
number_4 = DoubleInput(3)
getItemAtIndex_4 = List.GetItemAtIndex(list=python_script, index=number_4)
Link_Path = Output(getItemAtIndex_4)
