# Dynamo graph Home.dyn (Dynamo 1.3.2.2480)

setParameterByName = Element.SetParameterByName()  # unwired: element, parameterName, value
file_path = Filename("No file selected.")
code_block = CodeBlock { "Sheet1"; }
code_block_2 = CodeBlock { 0; }
code_block_3 = CodeBlock { t9 = List.Join({"PHASE BY SUITE", "EQUIPMENT NAME_IDG", "location", "Apparent Load", "Number of Poles", "Volts", "Circuit Number", "FEEDER SIZE"}); }
addItemToEnd = List.AddItemToEnd()  # unwired: item, list
family_types = FamilyTypes("ID MECH CONNECTION:MECHANICAL CONNECTION (120V)")
family_types_2 = FamilyTypes("ID MECH CONNECTION:MECHANICAL CONNECTION (208V)")
family_types_3 = FamilyTypes("ID MECH CONNECTION:MECHANICAL CONNECTION (480V)")
join = List.Join(family_types, family_types_2, family_types_3)
all_elements_of_family_type = ElementsOfFamilyType(join)
select_phase = RevitPhases("Suite 224")
byPhaseCreated = Revit.ElementFilter.ByPhaseCreated(all_elements_of_family_type, select_phase)
id = Element.Id(byPhaseCreated)
getParameterValueByName = Element.GetParameterValueByName(element=code_block_3)  # unwired: parameterName
map = List.Map(list=byPhaseCreated, f_x=getParameterValueByName)
combine = List.Combine(addItemToEnd, id, map)
addItemToFront = List.AddItemToFront(item=code_block_3, list=combine)
boolean = BoolSelector(true)
writeToFile = Excel.WriteToFile(filePath=file_path, sheetName=code_block, startRow=code_block_2, startCol=code_block_2, data=addItemToFront, overWrite=boolean)
