# Dynamo graph Mechanical Connection Circuit Naming.dyn (Dynamo 1.3.2.2480)

family_types = FamilyTypes("ID MECH CONNECTION:MECHANICAL CONNECTION (480V)")
all_elements_of_family_type = ElementsOfFamilyType(family_types)
select_phase = RevitPhases("Suite 242")
byPhaseCreated = Revit.ElementFilter.ByPhaseCreated(all_elements_of_family_type, select_phase)
watch = Watch(byPhaseCreated)
electricalCircuit = Custom[Element.ElectricalCircuit](Element=watch)  # Returns the electrical circuit of the element
string = StringInput("Load Name")
string_2 = StringInput("L")
string_3 = StringInput("PHASE BY SUITE")
getParameterValueByName = Element.GetParameterValueByName(element=watch, parameterName=string_3)
add = string_2 + getParameterValueByName
code_block = CodeBlock { "-"; }
add_2 = add + code_block
string_4 = StringInput("EQUIPMENT NAME_IDG")
getParameterValueByName_2 = Element.GetParameterValueByName(element=watch, parameterName=string_4)
add_3 = add_2 + getParameterValueByName_2
code_block_2 = CodeBlock { "_"; }
add_4 = add_3 + code_block_2
string_5 = StringInput("SOURCE")
getParameterValueByName_3 = Element.GetParameterValueByName(element=watch, parameterName=string_5)
add_5 = add_4 + getParameterValueByName_3
setParameterByName = Element.SetParameterByName(element=electricalCircuit, parameterName=string, value=add_5)
string_6 = StringInput("Rating")
code_block_3 = CodeBlock { 225; }
setParameterByName_2 = Element.SetParameterByName(element=electricalCircuit, parameterName=string_6, value=code_block_3)
