# Dynamo graph PATTERN (CRAC WEAVE) 2ND TRY.dyn (Dynamo 1.3.2.2480)

code_block = CodeBlock { t5 = List.Join({"A", "B", "C", "D"}); }
code_block_2 = CodeBlock { 2; }
permutations = List.Permutations(code_block, code_block_2)
watch = Watch(permutations)
code_block_3 = CodeBlock { "A"; }
eq = watch == code_block_3
code_block_4 = CodeBlock { 1; }
getItemAtIndex = List.GetItemAtIndex(list=eq@@L2, index=code_block_4)
code_block_5 = CodeBlock { 0; }
getItemAtIndex_2 = List.GetItemAtIndex(list=eq@@L2, index=code_block_5)
or_ = getItemAtIndex || getItemAtIndex_2
filterByBoolMask = List.FilterByBoolMask(list=watch@@L3, mask=or_)
code_block_6 = CodeBlock { "B"; }
eq_2 = watch == code_block_6
code_block_7 = CodeBlock { 1; }
getItemAtIndex_3 = List.GetItemAtIndex(list=eq_2@@L2, index=code_block_7)
code_block_8 = CodeBlock { 0; }
getItemAtIndex_4 = List.GetItemAtIndex(list=eq_2@@L2, index=code_block_8)
or_2 = getItemAtIndex_3 || getItemAtIndex_4
filterByBoolMask_2 = List.FilterByBoolMask(list=watch@@L3, mask=or_2)
code_block_9 = CodeBlock { "C"; }
eq_3 = watch == code_block_9
code_block_10 = CodeBlock { 1; }
getItemAtIndex_5 = List.GetItemAtIndex(list=eq_3@@L2, index=code_block_10)
code_block_11 = CodeBlock { 0; }
getItemAtIndex_6 = List.GetItemAtIndex(list=eq_3@@L2, index=code_block_11)
or_3 = getItemAtIndex_5 || getItemAtIndex_6
filterByBoolMask_3 = List.FilterByBoolMask(list=watch@@L3, mask=or_3)
code_block_12 = CodeBlock { "D"; }
eq_4 = watch == code_block_12
code_block_13 = CodeBlock { 1; }
getItemAtIndex_7 = List.GetItemAtIndex(list=eq_4@@L2, index=code_block_13)
code_block_14 = CodeBlock { 0; }
getItemAtIndex_8 = List.GetItemAtIndex(list=eq_4@@L2, index=code_block_14)
or_4 = getItemAtIndex_7 || getItemAtIndex_8
filterByBoolMask_4 = List.FilterByBoolMask(list=watch@@L3, mask=or_4)
join = List.Join()  # unwired: arg0
python_script = Python(IN[0]=code_block)
# ---------- python_script.python (12 lines) ----------
import clr
clr.AddReference('ProtoGeometry')
from Autodesk.DesignScript.Geometry import *

import itertools
#The inputs to this node will be stored as a list in the IN variables.
Panels = UnwrapElement(IN[0])

perm = list(itertools.permutations(Panels,2))

#Assign your output to the OUT variable.
OUT = perm
# ----------------------------------------
watch_2 = Watch(python_script)
code_block_15 = CodeBlock { 2; }
permutations_2 = List.Permutations(watch_2, code_block_15)
code_block_16 = CodeBlock { 4; }
permutations_3 = List.Permutations(code_block, code_block_16)
flatten = Flatten(permutations_3)
code_block_17 = CodeBlock { 6; }
chop = List.Chop(list=flatten, lengths=code_block_17)
code_block_18 = CodeBlock { 2; }
combinations = List.Combinations(watch_2@L3, code_block_18)
flatten_2 = Flatten(combinations)
code_block_19 = CodeBlock { 4; }
chop_2 = List.Chop(list=flatten_2, lengths=code_block_19)
code_block_20 = CodeBlock { "A"; "B"; "C"; "D"; }
join_2 = List.Join(code_block_20.out0, code_block_20.out1, code_block_20.out2, code_block_20.out3)
containsItem = List.ContainsItem(list=chop_2@L2, item=join_2)
code_block_21 = CodeBlock { 0; }
getItemAtIndex_9 = List.GetItemAtIndex(list=containsItem@L2, index=code_block_21)
code_block_22 = CodeBlock { 1; }
getItemAtIndex_10 = List.GetItemAtIndex(list=containsItem@L2, index=code_block_22)
and_ = getItemAtIndex_9 && getItemAtIndex_10
code_block_23 = CodeBlock { 2; }
getItemAtIndex_11 = List.GetItemAtIndex(list=containsItem@L2, index=code_block_23)
code_block_24 = CodeBlock { 3; }
getItemAtIndex_12 = List.GetItemAtIndex(list=containsItem@L2, index=code_block_24)
and_2 = getItemAtIndex_11 && getItemAtIndex_12
and_3 = and_ && and_2
filterByBoolMask_5 = List.FilterByBoolMask(list=chop_2, mask=and_3)
watch_3 = Watch(filterByBoolMask_5.in)
code_block_25 = CodeBlock { 4; }
chop_3 = List.Chop(list=watch_3, lengths=code_block_25)
code_block_26 = CodeBlock { 4; }
diagonalLeft = List.DiagonalLeft(chop_3, code_block_26)
diagonalRight = List.DiagonalRight(chop_3, code_block_26)
byColumns = Dynamo.AI.Data.Matrix.ByColumns()  # unwired: arg0
