# Dynamo graph PATTERN (CRAC WEAVE).dyn (Dynamo 1.3.2.2480)

code_block = CodeBlock { "CRAC-"; }
code_block_2 = CodeBlock { 1..8; }
add = code_block + code_block_2
code_block_3 = CodeBlock { "-NORM"; }
add_2 = add + code_block_3
code_block_4 = CodeBlock { "-ALT"; }
add_3 = add + code_block_4
join = List.Join(add_2, add_3)
code_block_5 = CodeBlock { 2; }
code_block_6 = CodeBlock { 0; }
combinations = List.Combinations(join, code_block_5, code_block_6)
code_block_7 = CodeBlock { " "; }
join_2 = String.Join(code_block_7)  # unwired: arg1, arg2
code_block_8 = CodeBlock { t5 = List.Join({"A", "B", "C", "D"}); }
add_4 = add + code_block_3
code_block_9 = CodeBlock { 4; }
code_block_10 = CodeBlock(A=code_block_9) { 0..(A-1); }
takeEveryNthItem = List.TakeEveryNthItem(join, code_block_9, code_block_10)
code_block_11 = CodeBlock { 0; }
getItemAtIndex = List.GetItemAtIndex(list=takeEveryNthItem, index=code_block_11)
permutations = List.Permutations(join, code_block_5)
