# Dynamo graph PanelViewCreator.dyn (Dynamo 1.3.2.2480)

all_elements_at_level = ElementsAtLevel()  # unwired: arg0
map = List.Map()  # unwired: list, f_x
categories = Categories("ElectricalCircuit")
all_elements_of_category = ElementsOfCategory(categories)
watch = Watch(all_elements_of_category)
python_script = Python(IN[0]=watch)
# ---------- python_script.python (18 lines) ----------
import clr
clr.AddReference('ProtoGeometry')
from Autodesk.DesignScript.Geometry import *
#The inputs to this node will be stored as a list in the IN variables.
systems = UnwrapElement(IN[0])
panels = []
elements = []

for x in systems:
	panels.append(x.BaseEquipment)
	sublist = []
	elementset = x.Elements
	for x in elementset:
		sublist.append(x)
	elements.append(sublist)

#Assign your output to the OUT variable.
OUT = elements
# ----------------------------------------
number = DoubleInput(2)
flatten = List.Flatten(list=python_script, amt=number)
watch_2 = Watch(flatten)
string = StringInput("Panel Name")
parameterByName = Parameter.ParameterByName(element=watch_2, name=string)
restOfItems = List.RestOfItems(python_script)
views = Views()
string_2 = StringInput("Panel")
parameterByName_2 = Parameter.ParameterByName(element=watch_2, name=string_2)
string_from_object = FromObject(parameterByName_2)
code_block = CodeBlock { "Panel : "; }

# group: 1. Create a view set in Revit 2. Select a view set and run the program for each view. Start at 0 and arun the program, add one after each comletion and repeat until you have run through each vew.
view_sets = ViewSetUi()
number_2 = DoubleInput(1)

get_views_from_view_set = Custom[Get Views from View Set](ViewSet=view_sets)  # This node will take a name of a view set and return views/sheet elements contained in it.
getItemAtIndex = List.GetItemAtIndex(list=get_views_from_view_set, index=number_2)
string_from_object_2 = FromObject(getItemAtIndex)
number_3 = DoubleInput(0)
number_4 = DoubleInput(45)
remove = String.Remove(str=string_from_object_2, startIndex=number_3, count=number_4)
number_5 = DoubleInput(-1)
number_6 = DoubleInput(-2)
remove_2 = String.Remove(str=remove, startIndex=number_5, count=number_6)
code_block_2 = CodeBlock(a=code_block, b=remove_2) { a+b; }
eq = string_from_object == code_block_2
watch_3 = Watch(eq)
filterByBoolMask = List.FilterByBoolMask(list=watch_2, mask=watch_3)
code_block_3 = CodeBlock { "True"; }
unhideElements = Custom[View.UnhideElements](Element=filterByBoolMask.in, View=getItemAtIndex, RunIt=code_block_3)  # This node will unhide specified elemeints in given views.
isolate_in_view = Custom[Isolate in View](Element=filterByBoolMask.in, View=getItemAtIndex)  # This node will take input of elements and a view to isolate selected elements in a view.
string_3 = StringInput("Schedule Level")
parameterByName_3 = Parameter.ParameterByName(element=isolate_in_view, name=string_3)
uniqueItems = List.UniqueItems(parameterByName_3)
code_block_4 = CodeBlock { " "; }
split = String.Split(string_from_object_2, code_block_4)
string_from_object_3 = FromObject(code_block_2)
watch_4 = Watch(remove)
code_block_5 = CodeBlock { 0; }
code_block_6 = CodeBlock { 15; }
lt = _ < code_block_6  # unwired: arg0
code_block_7 = CodeBlock { 1; }
add = _ + code_block_7  # unwired: arg0
loopWhile = LoopWhile(code_block_5, lt, add)
n1 = Custom[+1]()  # Increments a value by 1; unwired: dbl
