# Dynamo graph Parametric-dome (2).dyn_xml.dyn (Dynamo 0.7.5.3566)

# note: Radius of the sphere
double_slider = DoubleSlider(13.68940101, range=0..100)
# note: Number of O segments
integer_slider = IntegerSlider(13, range=0..30)
# note: Your O value
double_slider_2 = DoubleSlider(4.448265199, range=0..20)
# note: Number of triangle per "slice"
integer_slider_2 = IntegerSlider(29, range=0..50)
code_block = CodeBlock(r=double_slider, n=integer_slider, o=double_slider_2, nb=integer_slider_2)
# ---------- code_block.designscript (22 lines) ----------
//getting the arc
c=Point.ByCoordinates(0,0,0);
sp=Point.ByCoordinates(r,0,0);
s=Arc.ByCenterPointStartPointSweepAngle(c,sp,-180,Vector.YAxis());


//tracing the "o segments"
p0=s.PointAtParameter(0);
p1=s.PointAtParameter(0.5);
p=p0.Translate(Vector.ZAxis(),0..n*o..o);
l=Line.ByStartPointEndPoint(c,p);

//dividing the arc
Pointlist=Flatten(l.Intersect(s));
Pointlist1=List.TakeEveryNthItem(Pointlist,2,0);
Pointlist2=List.TakeEveryNthItem(Pointlist,2,1);

//getting points for tesselation
degrees=0..360..#nb;
degrees2=degrees+(360/(2*nb));
tespoint1=Transpose(Pointlist1<2>.Rotate(c,Vector.ZAxis(),degrees<1>));
tespoint2=Transpose(Pointlist2<2>.Rotate(c,Vector.ZAxis(),degrees2<1>));
# ----------------------------------------
lastItem = List.LastItem(code_block.tespoint1)
code_block_2 = CodeBlock(p=lastItem) { p[0].Z; }
lastItem_2 = List.LastItem(code_block.tespoint2)
code_block_3 = CodeBlock(p=lastItem_2) { p[0].Z; }
code_block_4 = CodeBlock(a=code_block_2, b=code_block_3) { a>b; }
if_ = If(code_block_4, lastItem, lastItem_2)
byStartPointEndPoint = Line.ByStartPointEndPoint(code_block.p1, if_)
code_block_5 = CodeBlock { 1; }
shiftIndices = List.ShiftIndices(byStartPointEndPoint, code_block_5)
create = List.Create(byStartPointEndPoint, shiftIndices)
transpose = List.Transpose(create)
byLoft = Surface.ByLoft(transpose)
code_block_6 = CodeBlock(tp1=code_block.tespoint1, tp2=code_block.tespoint2)
# ---------- code_block_6.designscript (7 lines) ----------
l={tp1,tp2};
lt=List.Transpose(l);
tlt=List.Transpose(lt<1>);
tltd=List.DropItems(tlt<1>,1);
tltdf=Flatten(tltd<1>);
p=PolyCurve.ByPoints(tltdf,true);
p.Curves().Explode();
# ----------------------------------------
count = Count(code_block.tespoint1)
code_block_7 = CodeBlock(c=count) { c-1; }
removeItemAtIndex = List.RemoveItemAtIndex(code_block.tespoint1, code_block_7)
code_block_8 = CodeBlock { 1; }
dropItems = List.DropItems(code_block.tespoint2, code_block_8)
code_block_9 = CodeBlock(tp1=removeItemAtIndex, tp2=dropItems)  # same code as code_block_6
join = List.Join(code_block_6.out6, code_block_9.out6)
flatten = Flatten(join, lacing=Longest)
code_block_10 = CodeBlock { 1; }
shiftIndices_2 = List.ShiftIndices(flatten, code_block_10, lacing=Longest)
join_2 = List.Join(flatten, shiftIndices_2)
code_block_11 = CodeBlock { 2; }
chop = List.Chop(join_2, code_block_11, lacing=Longest)
byLoft_2 = Surface.ByLoft(chop)
create_2 = List.Create(byLoft, byLoft_2)
flatten_2 = Flatten(create_2)
perimeterCurves = Surface.PerimeterCurves(flatten_2)
