# Dynamo graph Part-01-Structural-Framing.dyn (Dynamo 1.3.2.2480)

select_model_element = DSModelElementSelection()
curve = CurveElement.Curve(select_model_element)
length = Curve.Length(curve)
select_model_element_2 = DSModelElementSelection()
curve_2 = CurveElement.Curve(select_model_element_2)
length_2 = Curve.Length(curve_2)
integer_slider = IntegerSlider(12, range=0..100 step 1)
code_block = CodeBlock(curveLength=length_2, curveSpacing=integer_slider) { 0..curveLength..curveSpacing; }
pointAtSegmentLength = Curve.PointAtSegmentLength(curve=curve_2, segmentLength=code_block)
pointAtSegmentLength_2 = Curve.PointAtSegmentLength(curve=curve, segmentLength=code_block)
byStartPointEndPoint = Line.ByStartPointEndPoint(startPoint=pointAtSegmentLength, endPoint=pointAtSegmentLength_2)
levels = Levels("SECOND FLOOR RECESSED")
ZAxis = Vector.ZAxis()
beam = StructuralType.Beam()
structural_framing_types = StructuralFramingTypes("No structural framing types available.")
byCurveLevelUpVectorAndType = StructuralFraming.ByCurveLevelUpVectorAndType(byStartPointEndPoint, levels, ZAxis, beam, structural_framing_types)
