# Dynamo graph PlaceViewsOnSheetByLocation.dyn (Dynamo 1.3.2.2480)

# group: Get Sheet By Name
refresh = BoolSelector(false)
getallsheets_py = Python(IN[0]=refresh)
# ---------- getallsheets_py.python (25 lines) ----------
import clr

clr.AddReference("RevitServices")
import RevitServices
from RevitServices.Persistence import DocumentManager
from RevitServices.Transactions import TransactionManager
doc =  DocumentManager.Instance.CurrentDBDocument
app = DocumentManager.Instance.CurrentUIApplication.Application

clr.AddReference("RevitNodes")
import Revit
clr.ImportExtensions(Revit.Elements)
clr.ImportExtensions(Revit.GeometryConversion)

clr.AddReference("RevitAPI")
from Autodesk.Revit.DB import *

outList = []


for s in FilteredElementCollector(doc).OfClass(ViewSheet).ToElements():
	if not "*" in s.SheetNumber: outList.append(s)

OUT = outList
#For more information refer to RBG Wiki or email me (ctrl + click link): daniel.woodcock@robertbird.com
# ----------------------------------------
sheetNumber = Sheet.SheetNumber(getallsheets_py)
code_block = CodeBlock { "S-3."; }
contains = String.Contains(str=sheetNumber, searchFor=code_block)
filterByBoolMask = List.FilterByBoolMask(list=getallsheets_py, mask=contains)

# group: Get Views By Name
code_block_2 = CodeBlock { {"1","2","3"}; false; }
code_block_3 = CodeBlock(ViewNames=code_block_2.out0, DoesContain=code_block_2.out1, IsViewTemplate=code_block_2.out1) { ViewNames; DoesContain; IsViewTemplate; }
get_view_by_name_py = Python(IN[0]=code_block_3.ViewNames, IN[1]=code_block_3.DoesContain, IN[2]=code_block_3.IsViewTemplate)
# ---------- get_view_by_name_py.python (69 lines) ----------
#For more information refer to RBG Wiki or email me (ctrl + click link): daniel.woodcock@robertbird.com

import clr
clr.AddReference("RevitNodes")
import Revit
clr.ImportExtensions(Revit.Elements)

# Import DocumentManager and TransactionManager
clr.AddReference("RevitServices")
import RevitServices
from RevitServices.Persistence import DocumentManager
from RevitServices.Transactions import TransactionManager
doc = DocumentManager.Instance.CurrentDBDocument
uidoc = DocumentManager.Instance.CurrentUIDocument

# Import RevitAPI
clr.AddReference("RevitAPI")
import Autodesk
from Autodesk.Revit.DB import *

import System
from System.Collections.Generic import *

import sys
pyt_path = r'C:\Program Files (x86)\IronPython 2.7\Lib'
sys.path.append(pyt_path)

def tolist(obj1):
	if hasattr(obj1,"__iter__"): return obj1
	else: return [obj1]

names = tolist(IN[0])
cont = tolist(IN[1])
cont = cont[0]
isVTemp = tolist(IN[2])
isVTemp = isVTemp[0]

fec = FilteredElementCollector(doc)
fec = fec.OfClass(View)

outList = []

for name in names:
	found = None
	for view in fec:
		v = UnwrapElement(view)	
		if not isVTemp:
			if not v.IsTemplate:			
				if cont:
					if name in v.Name:
						found = v
						break
				else:
					if v.Name == name:
						found = v
						break
		else:
			if v.IsTemplate:				
				if cont:
					if name in v.Name:
						found = v
						break
				else:
					if v.Name == name:
						found = v
						break
	outList.append(found)
	
OUT = outList
# ----------------------------------------

# group: Get Views By Name
code_block_4 = CodeBlock { {"4","5","6"}; false; }
code_block_5 = CodeBlock(ViewNames=code_block_4.out0, DoesContain=code_block_4.out1, IsViewTemplate=code_block_4.out1) { ViewNames; DoesContain; IsViewTemplate; }
get_view_by_name_py_2 = Python(IN[0]=code_block_5.ViewNames, IN[1]=code_block_5.DoesContain, IN[2]=code_block_5.IsViewTemplate)  # same code as get_view_by_name_py

create = List.Create(get_view_by_name_py, get_view_by_name_py_2)

# group: Create Some Points
number_slider = DoubleSlider(181.374, range=0..1000 step 0.001)
number_slider_2 = DoubleSlider(212.882, range=0..1000 step 0.001)
byCoordinates = Point.ByCoordinates(x=number_slider, y=number_slider_2)
number_slider_3 = DoubleSlider(510.466, range=0..1000 step 0.001)
number_slider_4 = DoubleSlider(468.222, range=0..1000 step 0.001)
byCoordinates_2 = Point.ByCoordinates(x=number_slider_3, y=number_slider_4)
number_slider_5 = DoubleSlider(176.372, range=0..1000 step 0.001)
number_slider_6 = DoubleSlider(426.468, range=0..1000 step 0.001)
byCoordinates_3 = Point.ByCoordinates(x=number_slider_5, y=number_slider_6)
create_2 = List.Create(byCoordinates, byCoordinates_2, byCoordinates_3)

# group: Create Some Points
number_slider_7 = DoubleSlider(161.714, range=0..1000 step 0.001)
number_slider_8 = DoubleSlider(603.659, range=0..1000 step 0.001)
byCoordinates_4 = Point.ByCoordinates(x=number_slider_7, y=number_slider_8)
number_slider_9 = DoubleSlider(402.151, range=0..1000 step 0.001)
byCoordinates_5 = Point.ByCoordinates(x=number_slider_9, y=number_slider_8)
number_slider_10 = DoubleSlider(645.692, range=0..1000 step 0.001)
byCoordinates_6 = Point.ByCoordinates(x=number_slider_10, y=number_slider_8)
create_3 = List.Create(byCoordinates_4, byCoordinates_5, byCoordinates_6)
number_slider_11 = DoubleSlider(567.723, range=0..1000 step 0.001)
number_slider_12 = DoubleSlider(359.385, range=0..1000 step 0.001)

create_4 = List.Create(create_2, create_3)

# group: Place Views on a Sheet
run = BoolSelector(false)
code_block_6 = CodeBlock(Run=run, Sheet=filterByBoolMask.in, Views=create, Locations=create_4) { Run; Sheet; Views; Locations; }
place_views_on_sheet_py = Python(IN[0]=code_block_6.Run, IN[1]=code_block_6.Sheet, IN[2]=code_block_6.Views, IN[3]=code_block_6.Locations)
# ---------- place_views_on_sheet_py.python (60 lines) ----------
################### Import References ###################
import clr

clr.AddReference("RevitServices")
import RevitServices
from RevitServices.Persistence import DocumentManager
from RevitServices.Transactions import TransactionManager
doc =  DocumentManager.Instance.CurrentDBDocument
app = DocumentManager.Instance.CurrentUIApplication.Application

clr.AddReference("RevitNodes")
import Revit
clr.ImportExtensions(Revit.Elements)
clr.ImportExtensions(Revit.GeometryConversion)

clr.AddReference("RevitAPI")
from Autodesk.Revit.DB import *
################### Definitions ###################
def tolist(obj1):
	if hasattr(obj1,"__iter__"): return obj1
	else: return [obj1]
################### Inputs ###################
#get the bool in port IN[0]...
run = tolist(IN[0])[0]
#get the sheet in port IN[1] and UnwrapElement if not already...
sheetsIN = tolist(UnwrapElement(IN[1]))
#get the views in port IN[1] and UnwrapElement if not already...
viewsIN = tolist(UnwrapElement(IN[2]))
#get the points in port IN[2] (no need to unwrap as these are Dynamo Points)...
locsIN = tolist(IN[3])
################### Outputs ###################
outList = []
################### Script ###################
if run:
	# check if list lengths are the same (the views and locations will be lists of lists here, but the outermost list layer should all be the same length)
	if len(sheetsIN) == len(viewsIN) == len(locsIN):
		TransactionManager.Instance.EnsureInTransaction(doc)
		# loop through all lists (views and locs will be lists of lists)
		for sht,views,locs in zip(sheetsIN,viewsIN,locsIN):
			arr = []
			# test if number of views and number of locations match
			if len(views) == len(locs):
				# loop through all views and locations and try place them on sheet...			
				for v,l in zip(views, locs):					
					try:
						if Viewport.CanAddViewToSheet(doc,sht.Id,v.Id):
							vp = Viewport.Create(doc,sht.Id,v.Id,l.ToXyz())
							arr.append(vp)
						else: arr.append("Can't place view on sheet")
					except Exception, e:
						arr.append(e.message)					
				outList.append(arr)								
			else:
				outList.append("Number of views does not match number of locations")				
		OUT = outList
		TransactionManager.Instance.TransactionTaskDone()			
	else:
		OUT = "Number of sheets does not match either the number of view lists of location lists"
else:
	OUT = "Set Run to True"
# ----------------------------------------

# group: Preview Outlines For Placement
code_block_7 = CodeBlock(Sheet=filterByBoolMask.in, View=create, Locations=create_4) { Sheet; View; Locations; }
preview_viewsonsheet_py = Python(IN[0]=code_block_7.Sheet, IN[1]=code_block_7.View, IN[2]=code_block_7.Locations)
# ---------- preview_viewsonsheet_py.python (111 lines) ----------
################### Import References ###################
import clr

clr.AddReference("ProtoGeometry")
from Autodesk.DesignScript import Geometry as geom
clr.AddReference("RevitServices")
import RevitServices
from RevitServices.Persistence import DocumentManager
from RevitServices.Transactions import TransactionManager
doc =  DocumentManager.Instance.CurrentDBDocument
app = DocumentManager.Instance.CurrentUIApplication.Application

clr.AddReference("RevitNodes")
import Revit
clr.ImportExtensions(Revit.Elements)
clr.ImportExtensions(Revit.GeometryConversion)

clr.AddReference("RevitAPI")
from Autodesk.Revit.DB import *

import System
from System.Collections.Generic import *
################### Definitions ###################
def tolist(obj1):
	if hasattr(obj1,"__iter__"): return obj1
	else: return [obj1]
	
def getOutlines(v):
	#get outline
	oLine = v.Outline
	minU = oLine.Min.U*304.8
	minV = oLine.Min.V*304.8
	maxU = oLine.Max.U*304.8
	maxV = oLine.Max.V*304.8
	
	#get width and length of Rectangle
	w = maxU-minU
	l = maxV-minV
	
	#create rectangle
	myRec = geom.Rectangle.ByWidthLength(w,l)
	#move rectangle so bottom left corner is at origin
	myRec2 = geom.Geometry.Translate(myRec,w/2,l/2,0)
	#add rectangle to output list
	return myRec2,w,l

def moveRec(rec,p):
	cntr = geom.Polygon.Center(rec)
	vec = geom.Vector.ByTwoPoints(cntr,p)				
	return geom.Geometry.Translate(rec,vec)

def setTiling(xd,yd,rec):
	tileVec = geom.Vector.ByCoordinates(xd,yd,0)	
	#cntr = geom.Polygon.Center(rec)
	#vec = geom.Vector.ByTwoPoints(cntr,tileLoc)	
	return geom.Geometry.Translate(rec,tileVec)

################### Input Variables ###################
#get the sheet in port IN[1] and UnwrapElement if not already...
sheetsIN = tolist(UnwrapElement(IN[0]))
viewsIN = tolist(UnwrapElement(IN[1]))
locsIN = tolist(UnwrapElement(IN[2]))
################### Output Variables ###################
outList = []
################### other Variables ###################
#conversion between ft and mm
ft2mm = 304.8

xDiff = 0
yDiff = 0
yMax = 0
cx = 0
cy = 0
spacing = 100

################### Script ###################
if len(sheetsIN) == len(viewsIN) == len(locsIN):
	for sht,views,locs in zip(sheetsIN,viewsIN,locsIN):
		arr = []
		# get sheet outline info...
		sgo = getOutlines(sht)
		# sheet outline...
		sOLine = sgo[0]		
		arr.append(setTiling(xDiff,yDiff,sOLine))
		
		if len(views) == len(locs):
			for v,l in zip(views,locs):				
				vOLine = moveRec(getOutlines(v)[0],l)
				arr.append(setTiling(xDiff,yDiff,vOLine))
			outList.append(arr)
			cx = cx+1
		else:
			outList.append("Number of views does not match number of locations")
		
		# Tiling logic...
		# if number of sheets along x axis > 5 then return to a new line above by the largest sheet height...
		if cx >= 5:
			cx = 0
			xDiff = 0
			yDiff = yDiff + yMax + spacing
			cy = cy+1
		# else if number of sheets along x axis <= 5 then store the largest sheet height found and move a long the x axis...
		else:			
			xDiff = xDiff + sgo[1] + spacing	
			if sgo[2] > yMax: yMax = sgo[2]
	OUT = outList
else:
	OUT = "Number of sheets does not match either the number of view lists of location lists"


	
# ----------------------------------------

# group: Testing - Test Tiling Functionality
code_block_8 = CodeBlock(a=filterByBoolMask.in) { a[0]; }
code_block_9 = CodeBlock(a=get_view_by_name_py) { {a}; }
code_block_10 = CodeBlock(a=create_2) { {a}; }
integer_slider = IntegerSlider(24, range=1..50 step 1)
cycle = List.Cycle(list=filterByBoolMask.in, amount=integer_slider)
cycle_2 = List.Cycle(list=create, amount=integer_slider)
cycle_3 = List.Cycle(list=create_4, amount=integer_slider)

# group: Preview Outlines For Placement
code_block_11 = CodeBlock(Sheet=cycle, View=cycle_2, Locations=cycle_3) { Sheet; View; Locations; }
preview_viewsonsheet_py_2 = Python(IN[0]=code_block_11.Sheet, IN[1]=code_block_11.View, IN[2]=code_block_11.Locations)
# ---------- preview_viewsonsheet_py_2.python (111 lines) ----------
################### Import References ###################
import clr

clr.AddReference("ProtoGeometry")
from Autodesk.DesignScript import Geometry as geom
clr.AddReference("RevitServices")
import RevitServices
from RevitServices.Persistence import DocumentManager
from RevitServices.Transactions import TransactionManager
doc =  DocumentManager.Instance.CurrentDBDocument
app = DocumentManager.Instance.CurrentUIApplication.Application

clr.AddReference("RevitNodes")
import Revit
clr.ImportExtensions(Revit.Elements)
clr.ImportExtensions(Revit.GeometryConversion)

clr.AddReference("RevitAPI")
from Autodesk.Revit.DB import *

import System
from System.Collections.Generic import *
################### Definitions ###################
def tolist(obj1):
	if hasattr(obj1,"__iter__"): return obj1
	else: return [obj1]
	
def getOutlines(v):
	#get outline
	oLine = v.Outline
	minU = oLine.Min.U*304.8
	minV = oLine.Min.V*304.8
	maxU = oLine.Max.U*304.8
	maxV = oLine.Max.V*304.8
	
	#get width and length of Rectangle
	w = maxU-minU
	l = maxV-minV
	
	#create rectangle
	myRec = geom.Rectangle.ByWidthLength(w,l)
	#move rectangle so bottom left corner is at origin
	myRec2 = geom.Geometry.Translate(myRec,w/2,l/2,0)
	#add rectangle to output list
	return myRec2,w,l

def moveRec(rec,p):
	cntr = geom.Polygon.Center(rec)
	vec = geom.Vector.ByTwoPoints(cntr,p)				
	return geom.Geometry.Translate(rec,vec)

def setTiling(xd,yd,rec):
	tileVec = geom.Vector.ByCoordinates(xd,yd,0)	
	#cntr = geom.Polygon.Center(rec)
	#vec = geom.Vector.ByTwoPoints(cntr,tileLoc)	
	return geom.Geometry.Translate(rec,tileVec)

################### Input Variables ###################
#get the sheet in port IN[1] and UnwrapElement if not already...
sheetsIN = tolist(UnwrapElement(IN[0]))
viewsIN = tolist(UnwrapElement(IN[1]))
locsIN = tolist(UnwrapElement(IN[2]))
################### Output Variables ###################
outList = []
################### other Variables ###################
#conversion between ft and mm
ft2mm = 304.8

xDiff = 0
yDiff = 0
yMax = 0
cx = 0
cy = 0
spacing = 100

################### Script ###################
if len(sheetsIN) == len(viewsIN) == len(locsIN):
	for sht,views,locs in zip(sheetsIN,viewsIN,locsIN):
		arr = []
		# get sheet outline info...
		sgo = getOutlines(sht)
		# sheet outline...
		sOLine = sgo[0]		
		arr.append(setTiling(xDiff,yDiff,sOLine))
		
		if len(views) == len(locs):
			for v,l in zip(views,locs):				
				vOLine = moveRec(getOutlines(v)[0],l)
				arr.append(setTiling(xDiff,yDiff,vOLine))
			outList.append(arr)
			cx = cx+1
		else:
			outList.append("Number of views does not match number of locations")
		
		# Tiling logic...
		# if number of sheets along x axis > 5 then return to a new line above by the largest sheet height...
		if cx >=5:
			cx = 0
			xDiff = 0
			yDiff = yDiff + yMax + spacing
			cy = cy+1
		# else if number of sheets along x axis <= 5 then store the largest sheet height found and move a long the x axis...
		else:			
			xDiff = xDiff + sgo[1] + spacing	
			if sgo[2] > yMax: yMax = sgo[2]
	OUT = outList
else:
	OUT = "Number of sheets does not match either the number of view lists of location lists"


	
# ----------------------------------------
