# Dynamo graph Power Copied Elements 3.0 (Node Included).dyn (Dynamo 1.3.2.2480)

select_model_elements = DSModelElementsSelection()
select_model_elements_2 = DSModelElementsSelection()
select_model_elements_3 = DSModelElementsSelection()
select_model_elements_4 = DSModelElementsSelection()
duplicatePanelElementsAndCircuits = Custom[DuplicatePanelElementsAndCircuits](Origin_Element_Location=select_model_elements, End_Element_Location=select_model_elements_2, Origin_Panel=select_model_elements_3, End_Panel=select_model_elements_4)  # Duplicate an electrical panels elements and circuits to another selected panel
select_model_element = DSModelElementSelection()
