# Dynamo graph PowerCopiedElements 2.0 - CopyCircuitSettings_xml.dyn (Dynamo 1.3.2.2480)

# group: SET RATING AND LOAD NAME FOR CIRCUITS
categories = Categories("ElectricalCircuit")
all_elements_of_category = ElementsOfCategory(categories)
select_model_element = DSModelElementSelection()  # 1 picked in the model
string = StringInput("Panel Name")
getParameterValueByName = Element.GetParameterValueByName(element=select_model_element, parameterName=string)
string_2 = StringInput("Panel")
getParameterValueByName_2 = Element.GetParameterValueByName(element=all_elements_of_category, parameterName=string_2)
eq = getParameterValueByName == getParameterValueByName_2
filterByBoolMask = List.FilterByBoolMask(list=all_elements_of_category, mask=eq)
python_script = Python(IN[0]=filterByBoolMask.in)
# ---------- python_script.python (18 lines) ----------
import clr
clr.AddReference('ProtoGeometry')
from Autodesk.DesignScript.Geometry import *
#The inputs to this node will be stored as a list in the IN variables.
systems = UnwrapElement(IN[0])
panels = []
elements = []

for x in systems:
	panels.append(x.BaseEquipment)
	sublist = []
	elementset = x.Elements
	for x in elementset:
		sublist.append(x)
	elements.append(sublist)

#Assign your output to the OUT variable.
OUT = elements
# ----------------------------------------
select_model_element_2 = DSModelElementSelection()  # 1 picked in the model
getLocation = Element.GetLocation(select_model_element_2)
select_model_element_3 = DSModelElementSelection()  # 1 picked in the model
getLocation_2 = Element.GetLocation(select_model_element_3)
byTwoPoints = Vector.ByTwoPoints(start=getLocation, end=getLocation_2)
code_block = CodeBlock { "true"; }
copyByVector = Custom[Element.CopyByVector](element=python_script@@L2, vector=byTwoPoints, rehostToClosestLevel=code_block)  # Copies an element or a list of elements by a given vector.
clean = List.Clean(list=copyByVector)
python_script_2 = Python(IN[0]=clean)
# ---------- python_script_2.python (62 lines) ----------
import clr
clr.AddReference('ProtoGeometry')
from Autodesk.DesignScript.Geometry import *

clr.AddReference('RevitServices')
import RevitServices
from RevitServices.Persistence import DocumentManager
from RevitServices.Transactions import TransactionManager
from System.Collections.Generic import *

clr.AddReference('RevitNodes')
import Revit
clr.ImportExtensions(Revit.Elements)

clr.AddReference('RevitAPI')
import Autodesk
from Autodesk.Revit.DB import *
from Autodesk.Revit.DB.Electrical import *
from Autodesk.Revit.DB import MEPSystem

clr.AddReference('DSCoreNodes')
import DSCore
from DSCore.List import *

import sys
pyt_path = r'C:\Program Files (x86)\IronPython 2.7\Lib'
sys.path.append(pyt_path)

# Import List ( ICollection(ElementId) = List[ElementId]() )
clr.AddReference("System")
from System.Collections.Generic import List 

#The inputs to this node will be stored as a list in the IN variables.
input = UnwrapElement(IN[0])

ElectComponents = []
NewCircuit = []

for sublist in input:
	sub = List[ElementId]()
	ElectComponents.append(sub)
	for item in sublist:
		sub.Add(item.Id)


doc = DocumentManager.Instance.CurrentDBDocument
uiapp = DocumentManager.Instance.CurrentUIApplication
app = uiapp.Application
uidoc = DocumentManager.Instance.CurrentUIApplication.ActiveUIDocument

ListNewCircuit = []

TransactionManager.Instance.EnsureInTransaction(doc)

for e in ElectComponents:
	NewCircuit = doc.Create.NewElectricalSystem(e, ElectricalSystemType.PowerCircuit)
	ListNewCircuit.append(NewCircuit)

TransactionManager.Instance.TransactionTaskDone()


OUT = ListNewCircuit
# ----------------------------------------
string_3 = StringInput("Load Name")
string_4 = StringInput("Rating")
select_model_element_4 = DSModelElementSelection()  # 1 picked in the model
python_script_3 = Python(IN[0]=python_script_2, IN[1]=select_model_element_4)
# ---------- python_script_3.python (51 lines) ----------
import clr
clr.AddReference('ProtoGeometry')
from Autodesk.DesignScript.Geometry import *

clr.AddReference('RevitServices')
import RevitServices
from RevitServices.Persistence import DocumentManager
from RevitServices.Transactions import TransactionManager
from System.Collections.Generic import *

clr.AddReference('RevitNodes')
import Revit
clr.ImportExtensions(Revit.Elements)

clr.AddReference('RevitAPI')
import Autodesk
from Autodesk.Revit.DB import *
from Autodesk.Revit.DB.Electrical import *
from Autodesk.Revit.DB import MEPSystem

clr.AddReference('DSCoreNodes')
import DSCore
from DSCore.List import *

import sys
pyt_path = r'C:\Program Files (x86)\IronPython 2.7\Lib'
sys.path.append(pyt_path)

# Import List ( ICollection(ElementId) = List[ElementId]() )
clr.AddReference("System")
from System.Collections.Generic import List 


circuit = UnwrapElement(IN[0])
panel = UnwrapElement(IN[1])

doc = DocumentManager.Instance.CurrentDBDocument
uiapp = DocumentManager.Instance.CurrentUIApplication
app = uiapp.Application
uidoc = DocumentManager.Instance.CurrentUIApplication.ActiveUIDocument

TransactionManager.Instance.EnsureInTransaction(doc)

for _ in circuit:
	_.SelectPanel(panel)

TransactionManager.Instance.TransactionTaskDone()

#Assign your output to the OUT variable.
OUT = []
OUT = circuit, panel
# ----------------------------------------
string_5 = StringInput("Panel : ")
add = string_5 + getParameterValueByName
python_script_4 = Python(IN[0]=all_elements_of_category)  # same code as python_script
watch = Watch(python_script_4)

# group: GET CIRCUIT PARAMETERS TO BE COPIED
string_6 = StringInput("Load Name")
getParameterValueByName_3 = Element.GetParameterValueByName(element=filterByBoolMask.in, parameterName=string_6)
string_7 = StringInput("Rating")
getParameterValueByName_4 = Element.GetParameterValueByName(element=filterByBoolMask.in, parameterName=string_7)

# group (continued): SET RATING AND LOAD NAME FOR CIRCUITS
setParameterByName = Element.SetParameterByName(element=python_script_2, parameterName=string_3, value=getParameterValueByName_3)
setParameterByName_2 = Element.SetParameterByName(element=python_script_2, parameterName=string_4, value=getParameterValueByName_4)

select_model_element_5 = DSModelElementSelection()  # 1 picked in the model
select_model_element_6 = DSModelElementSelection()  # 1 picked in the model
duplicatePanelElementsAndCircuits = Custom[DuplicatePanelElementsAndCircuits](Origin_Element=select_model_element_5, End_Element=select_model_element_6, New_Panel=select_model_element_6, Panel_To_Be_Duplicated=select_model_element_5)  # Duplicate an electrical panels elements and circuits to another selected panel
