# Dynamo graph PowerCopiedElements with node and ophase_xml.dyn (Dynamo 1.3.2.2480)

select_model_element = DSModelElementSelection()  # 1 picked in the model
select_model_element_2 = DSModelElementSelection()  # 1 picked in the model
select_model_element_3 = DSModelElementSelection()  # 1 picked in the model
select_model_element_4 = DSModelElementSelection()  # 1 picked in the model
string = StringInput("Suite 130")
duplicatePanelElementsAndCircuits = Custom[DuplicatePanelElementsAndCircuits](Origin_Element_Location=select_model_element, End_Element_Location=select_model_element_2, Origin_Panel=select_model_element_3, End_Panel=select_model_element_4, Set_New_Phase=string)  # Duplicate an electrical panels elements and circuits to another selected panel
