# Dynamo graph PowerCopiedElements_xml.dyn (Dynamo 1.3.2.2480)

# group: GET ALL CIRCUITED ELEMENTS
categories = Categories("ElectricalCircuit")
all_elements_of_category = ElementsOfCategory(categories)
python_script = Python(IN[0]=all_elements_of_category)
# ---------- python_script.python (18 lines) ----------
import clr
clr.AddReference('ProtoGeometry')
from Autodesk.DesignScript.Geometry import *
#The inputs to this node will be stored as a list in the IN variables.
systems = UnwrapElement(IN[0])
panels = []
elements = []

for x in systems:
	panels.append(x.BaseEquipment)
	sublist = []
	elementset = x.Elements
	for x in elementset:
		sublist.append(x)
	elements.append(sublist)

#Assign your output to the OUT variable.
OUT = elements
# ----------------------------------------
watch = Watch(python_script)

restOfItems = List.RestOfItems(python_script)
string = StringInput("Panel")
parameterByName = Parameter.ParameterByName(element=watch, name=string)
string_from_object = FromObject(parameterByName)
code_block = CodeBlock { "Panel : Panel 1"; }
eq = string_from_object == code_block
watch_2 = Watch(eq)
filterByBoolMask = List.FilterByBoolMask(list=watch, mask=watch_2)
clean = List.Clean(list=filterByBoolMask.in)

# group: SELECT ORIGIN POINT ELEMENT
select_model_element = DSModelElementSelection()  # 1 picked in the model

# group: SELECT END POINT ELEMENT
select_model_element_2 = DSModelElementSelection()  # 1 picked in the model

# group: COPY ELEMENTS TO VECTOR
getLocation = Element.GetLocation(select_model_element)
getLocation_2 = Element.GetLocation(select_model_element_2)
byTwoPoints = Vector.ByTwoPoints(start=getLocation, end=getLocation_2)
code_block_2 = CodeBlock { "true"; }
copyByVector = Custom[Element.CopyByVector](element=clean@@L2, vector=byTwoPoints, rehostToClosestLevel=code_block_2)  # Copies an element or a list of elements by a given vector.

clean_2 = List.Clean(list=copyByVector)

# group: Create new circuit on Panel and assign elementset to new circuit
python_script_2 = Python(IN[0]=clean_2)
# ---------- python_script_2.python (62 lines) ----------
import clr
clr.AddReference('ProtoGeometry')
from Autodesk.DesignScript.Geometry import *

clr.AddReference('RevitServices')
import RevitServices
from RevitServices.Persistence import DocumentManager
from RevitServices.Transactions import TransactionManager
from System.Collections.Generic import *

clr.AddReference('RevitNodes')
import Revit
clr.ImportExtensions(Revit.Elements)

clr.AddReference('RevitAPI')
import Autodesk
from Autodesk.Revit.DB import *
from Autodesk.Revit.DB.Electrical import *
from Autodesk.Revit.DB import MEPSystem

clr.AddReference('DSCoreNodes')
import DSCore
from DSCore.List import *

import sys
pyt_path = r'C:\Program Files (x86)\IronPython 2.7\Lib'
sys.path.append(pyt_path)

# Import List ( ICollection(ElementId) = List[ElementId]() )
clr.AddReference("System")
from System.Collections.Generic import List 

#The inputs to this node will be stored as a list in the IN variables.
input = UnwrapElement(IN[0])

ElectComponents = []
NewCircuit = []

for sublist in input:
	sub = List[ElementId]()
	ElectComponents.append(sub)
	for item in sublist:
		sub.Add(item.Id)


doc = DocumentManager.Instance.CurrentDBDocument
uiapp = DocumentManager.Instance.CurrentUIApplication
app = uiapp.Application
uidoc = DocumentManager.Instance.CurrentUIApplication.ActiveUIDocument

ListNewCircuit = []

TransactionManager.Instance.EnsureInTransaction(doc)

for e in ElectComponents:
	NewCircuit = doc.Create.NewElectricalSystem(e, ElectricalSystemType.PowerCircuit)
	ListNewCircuit.append(NewCircuit)

TransactionManager.Instance.TransactionTaskDone()


OUT = ListNewCircuit
# ----------------------------------------

# group: SELECT PANEL THE COPIED ELEMENTS WILL BE POWERED TO
select_model_element_3 = DSModelElementSelection()  # 1 picked in the model

# group: Select panel. IN[0] = Electrical System IN[1] = Panel element
python_script_3 = Python(IN[0]=python_script_2, IN[1]=select_model_element_3)
# ---------- python_script_3.python (51 lines) ----------
import clr
clr.AddReference('ProtoGeometry')
from Autodesk.DesignScript.Geometry import *

clr.AddReference('RevitServices')
import RevitServices
from RevitServices.Persistence import DocumentManager
from RevitServices.Transactions import TransactionManager
from System.Collections.Generic import *

clr.AddReference('RevitNodes')
import Revit
clr.ImportExtensions(Revit.Elements)

clr.AddReference('RevitAPI')
import Autodesk
from Autodesk.Revit.DB import *
from Autodesk.Revit.DB.Electrical import *
from Autodesk.Revit.DB import MEPSystem

clr.AddReference('DSCoreNodes')
import DSCore
from DSCore.List import *

import sys
pyt_path = r'C:\Program Files (x86)\IronPython 2.7\Lib'
sys.path.append(pyt_path)

# Import List ( ICollection(ElementId) = List[ElementId]() )
clr.AddReference("System")
from System.Collections.Generic import List 


circuit = UnwrapElement(IN[0])
panel = UnwrapElement(IN[1])

doc = DocumentManager.Instance.CurrentDBDocument
uiapp = DocumentManager.Instance.CurrentUIApplication
app = uiapp.Application
uidoc = DocumentManager.Instance.CurrentUIApplication.ActiveUIDocument

TransactionManager.Instance.EnsureInTransaction(doc)

for _ in circuit:
	_.SelectPanel(panel)

TransactionManager.Instance.TransactionTaskDone()

#Assign your output to the OUT variable.
OUT = []
OUT = circuit, panel
# ----------------------------------------
