# Dynamo graph Purge Line.dyn (Dynamo 1.3.2.2480)

code_block = CodeBlock { "IMPORT"; false; }
contains = String.Contains(searchFor=code_block.out0, ignoreCase=code_block.out1)  # unwired: str
filterByBoolMask = List.FilterByBoolMask(mask=contains)  # unwired: list
python_script = Python()  # unwired: IN[0]
# ---------- python_script.python (47 lines) ----------
#Copyright(c) 2014, Konrad Sobon
# @arch_laboratory, http://archi-lab.net

import clr
clr.AddReference('ProtoGeometry')
from Autodesk.DesignScript.Geometry import *

# Import DocumentManager and TransactionManager
clr.AddReference("RevitServices")
import RevitServices
from RevitServices.Persistence import DocumentManager
from RevitServices.Transactions import TransactionManager

# Import RevitAPI
clr.AddReference("RevitAPI")
import Autodesk
from Autodesk.Revit.DB import *

doc = DocumentManager.Instance.CurrentDBDocument
uiapp = DocumentManager.Instance.CurrentUIApplication
app = uiapp.Application

from System.Collections.Generic import *

#The inputs to this node will be stored as a list in the IN variable.
dataEnteringNode = IN

#unwrap all elements to use with API
elements = []
for i in IN[0]:
	elements.append(UnwrapElement(i))

idsToDelete = List[Autodesk.Revit.DB.ElementId]()
for i in elements:
	idsToDelete.Add(i.Id)

# "Start" the transaction
TransactionManager.Instance.EnsureInTransaction(doc)

doc.Delete(idsToDelete)

# "End" the transaction
TransactionManager.Instance.TransactionTaskDone()

message = "You have successfully deleted n " + str(idsToDelete.Count) + " elements from Revit model."

OUT = 'n'.join('{:^35}'.format(s) for s in message.split('n'))
# ----------------------------------------
categories = Categories("Lines")
all_elements_of_category = ElementsOfCategory(categories)
string = StringInput("Line Style")
parameterByName = Parameter.ParameterByName(element=all_elements_of_category, name=string)
