# Dynamo graph PushTypeMarkandMarktoElecModel.dyn (Dynamo 1.3.2.2480)

# group: MECHANICAL EQUIPMENT FROM MECHANICAL MODEL
get_linked_rvt_documents = Custom[Get Linked RVT Documents]()
integer_slider = IntegerSlider(0, range=0..100 step 1)
getItemAtIndex = List.GetItemAtIndex(list=get_linked_rvt_documents.Link_Instance, index=integer_slider)
categories = Categories("MechanicalEquipment")
linkedInstanceElements = Custom[Springs.Collector.LinkedInstanceElements](linkInstance=getItemAtIndex, category=categories)  # Extract elements by category from the selected linked instances. The transform vector can be used to get the exact location of the elements in the local file

# group: GET PARAMETERS FROM LINKED EQUIPMENT
code_block = CodeBlock { "Type Mark"; }
getParameterValueByName = Element.GetParameterValueByName(element=linkedInstanceElements.elements, parameterName=code_block)
code_block_2 = CodeBlock { "Mark"; }
getParameterValueByName_2 = Element.GetParameterValueByName(element=linkedInstanceElements.elements, parameterName=code_block_2)
code_block_3 = CodeBlock { "## Electrical/Mechanical Coordination - Horsepower"; }
getParameterValueByName_3 = Element.GetParameterValueByName(element=linkedInstanceElements.elements, parameterName=code_block_3)
code_block_4 = CodeBlock { "## Electrical/Mechanical Coordination - Kilowatts"; }
getParameterValueByName_4 = Element.GetParameterValueByName(element=linkedInstanceElements.elements, parameterName=code_block_4)
code_block_5 = CodeBlock { "## Electrical/Mechanical Coordination - Full Load Amp"; }
getParameterValueByName_5 = Element.GetParameterValueByName(element=linkedInstanceElements.elements, parameterName=code_block_5)
code_block_6 = CodeBlock { "## Electrical/Mechanical Coordination - Voltage"; }
getParameterValueByName_6 = Element.GetParameterValueByName(element=linkedInstanceElements.elements, parameterName=code_block_6)
code_block_7 = CodeBlock { "## Electrical/Mechanical Coordination - Phase"; }
getParameterValueByName_7 = Element.GetParameterValueByName(element=linkedInstanceElements.elements, parameterName=code_block_7)
code_block_8 = CodeBlock { "## Electrical/Mechanical Coordination - Maximum Overcurrent Protection"; }
getParameterValueByName_8 = Element.GetParameterValueByName(element=linkedInstanceElements.elements, parameterName=code_block_8)

# group: COPY MONITORED MECHANICAL EQUIPMENT IN ELECTRIC MODEL
categories_2 = Categories("MechanicalEquipment")
all_elements_of_category = ElementsOfCategory(categories_2)

# group: GET INTERSECTION POINTS
getLocation = Element.GetLocation(linkedInstanceElements.elements)
getLocation_2 = Element.GetLocation(all_elements_of_category)
doesIntersect = Geometry.DoesIntersect(geometry=getLocation, other=getLocation_2, lacing=CrossProduct)
filterByBoolMask = List.FilterByBoolMask(list=all_elements_of_category)  # unwired: mask

map = List.Map(list=doesIntersect, f_x=filterByBoolMask.in)
flatten = Flatten(map)

# group: SET PARAMETERS
code_block_9 = CodeBlock { "Type Mark"; }
setParameterByName = Element.SetParameterByName(parameterName=code_block_9, value=getParameterValueByName)  # unwired: element
code_block_10 = CodeBlock { "Mark"; }
setParameterByName_2 = Element.SetParameterByName(element=flatten, parameterName=code_block_10, value=getParameterValueByName_2)
code_block_11 = CodeBlock { "## Electrical/Mechanical Coordination - Horsepower"; }
setParameterByName_3 = Element.SetParameterByName(parameterName=code_block_11, value=getParameterValueByName_3)  # unwired: element
code_block_12 = CodeBlock { "## Electrical/Mechanical Coordination - Kilowatts"; }
setParameterByName_4 = Element.SetParameterByName(parameterName=code_block_12, value=getParameterValueByName_4)  # unwired: element
code_block_13 = CodeBlock { "## Electrical/Mechanical Coordination - Full Load Amp"; }
setParameterByName_5 = Element.SetParameterByName(parameterName=code_block_13, value=getParameterValueByName_5)  # unwired: element
code_block_14 = CodeBlock { "## Electrical/Mechanical Coordination - Voltage"; }
setParameterByName_6 = Element.SetParameterByName(parameterName=code_block_14, value=getParameterValueByName_6)  # unwired: element
code_block_15 = CodeBlock { "## Electrical/Mechanical Coordination - Phase"; }
setParameterByName_7 = Element.SetParameterByName(parameterName=code_block_15, value=getParameterValueByName_7)  # unwired: element
code_block_16 = CodeBlock { "## Electrical/Mechanical Coordination - Maximum Overcurrent Protection"; }
setParameterByName_8 = Element.SetParameterByName(element=flatten, parameterName=code_block_16, value=getParameterValueByName_8)

watch = Watch()  # unwired: arg0
watch_2 = Watch()  # unwired: arg0
