# Dynamo graph Remove Circuits from Panel v2.0.dyn (Dynamo 2.0.1.5055)

# group: SELECT PANEL YOU WANT TO DELETE CIRCUIT ELEMENTS FROM
select_model_element = DSModelElementSelection()  # 1 picked in the model; graph input

# group: GET ALL CIRCUITED ELEMENTS
categories = Categories(index=182)  # graph input
all_elements_of_category = ElementsOfCategory(Category=categories)
python_script = Python(IN[0]=all_elements_of_category)
# ---------- python_script.python (18 lines) ----------
import clr
clr.AddReference('ProtoGeometry')
from Autodesk.DesignScript.Geometry import *
#The inputs to this node will be stored as a list in the IN variables.
systems = UnwrapElement(IN[0])
panels = []
elements = []

for x in systems:
	panels.append(x.BaseEquipment)
	sublist = []
	elementset = x.Elements
	for x in elementset:
		sublist.append(x)
	elements.append(sublist)

#Assign your output to the OUT variable.
OUT = elements
# ----------------------------------------
watch = Watch(python_script)

# group: GET ELEMENTS ONLY CIRCUITED TO CHOSEN PANEL
string = StringInput("Panel : ")  # graph input
string_2 = StringInput("Panel Name")  # graph input
getParameterValueByName = Element.GetParameterValueByName(element=select_model_element, parameterName=string_2)
add = string + getParameterValueByName
string_3 = StringInput("Panel")  # graph input
getParameterValueByName_2 = Element.GetParameterValueByName(element=all_elements_of_category, parameterName=string_3)
eq = getParameterValueByName == getParameterValueByName_2
filterByBoolMask = List.FilterByBoolMask(list=all_elements_of_category, mask=eq)

python_script_2 = Python(IN[0]=filterByBoolMask.in)  # same code as python_script

# group: DELETE
delete = archilab.Revit.Elements.Elements.Delete()  # unwired: element

# group: CIRCUIT FILTER
code_block = CodeBlock { "Load Classification"; }
getParameterValueByName_3 = Element.GetParameterValueByName(element=filterByBoolMask.in, parameterName=code_block)
code_block_2 = CodeBlock { "Lighting"; }
eq_2 = getParameterValueByName_3 == code_block_2
filterByBoolMask_2 = List.FilterByBoolMask(list=filterByBoolMask.in, mask=eq_2)
