# Dynamo graph START.dyn (Dynamo 1.3.2.2480)

# note: PATH from Script
file_path = Filename("..\..\..\..\Desktop\Dyn\Ruski Dyn\START_5.03.py")
fromPath = FileObject(file_path)  # "File.FromPath"
readText = File.ReadText(fromPath)
# note: PATH from Excel
file_path_2 = Filename("..\..\..\..\Desktop\Dyn\Ruski Dyn\test.xlsx")
fromPath_2 = FileObject(file_path_2)  # "File.FromPath"
code_block = CodeBlock { "sheet1"; }
readFromFile = Excel.ReadFromFile(file=fromPath_2, sheetName=code_block)
deconstruct = List.Deconstruct(list=readFromFile)
transpose = List.Transpose(deconstruct.rest)
code_block_2 = CodeBlock(p=transpose) { p[0]; p[1]; p[2]; p[3]; }
python_script_from_string = PythonStringNode(script=readText, IN[0]=code_block_2.out1, IN[1]=code_block_2.out0, IN[2]=code_block_2.out2, IN[3]=code_block_2.out3)
python_script = Python()  # unwired: IN[0], IN[1], IN[2], IN[3]
# ---------- python_script.python (62 lines) ----------
# -*- coding: utf-8 -*-
import clr
clr.AddReference('RevitAPI')
from Autodesk.Revit.DB import *

clr.AddReference('ProtoGeometry')
from Autodesk.DesignScript.Geometry import *

clr.AddReference("RevitServices")
import RevitServices
from RevitServices.Persistence import DocumentManager
from RevitServices.Transactions import TransactionManager

doc = DocumentManager.Instance.CurrentDBDocument

def U(elem): 
	a = UnwrapElement(elem)
	return a

inc = 304.8

if not isinstance(IN[0], list): 
	viewsname = [IN[0]]
else: 
	viewsname = IN[0]

if not isinstance(IN[1], list): 
	sheetsname = [IN[1]]
else: 
	sheetsname =IN[1]

def SheeByName(name):
	sheets = FilteredElementCollector(doc).OfCategory(BuiltInCategory.OST_Sheets).WhereElementIsNotElementType().ToElements()
	for i in sheets:
		try:
			if str(i.Name) == str(name):
				return i
		except:
			pass
def ViewsByName(name):
	views = FilteredElementCollector(doc).OfCategory(BuiltInCategory.OST_Views).WhereElementIsNotElementType().ToElements()
	for i in views:
		try:
			if str(i.Name) == str(name):
				return i
		except:
			pass

xx = IN[2]
yy = IN[3]
viewports = []

for i, p, x, y in zip (viewsname, sheetsname, xx, yy):
	xyz1 = XYZ(x/inc, y/inc,0)
	sheet = SheeByName(p)
	view = ViewsByName(i)
	TransactionManager.Instance.EnsureInTransaction(doc)
	viewport = Viewport.Create(doc, sheet.Id, view.Id, xyz1)
	TransactionManager.Instance.TransactionTaskDone()
	# viewportTypeId = ElementId(10159) # NO Title
	# viewport.ChangeTypeId(viewportTypeId)
	# viewports.append(viewport)
# ----------------------------------------
