# Dynamo graph Select Tags.dyn (Dynamo 1.3.2.2480)

element_types = ElementTypes("ElectricalSystem")
elementsByView = Custom[RIE.ElementsByView]()  # Selects elements that are visible in input view. Forked from Marc; unwired: Views

# group: SELECT ELEMENT TYPE TO BE BE TAGGED
select_model_element = DSModelElementSelection()

type = archilab.Revit.Elements.Elements.Type(select_model_element)
all_elements_of_family_type = ElementsOfFamilyType(type)
getLocation = Element.GetLocation(all_elements_of_family_type)
type_2 = archilab.Revit.Elements.Elements.Type()  # unwired: arg0
activeViewFromCurrentDocument = Custom[Document.ActiveViewFromCurrentDocument]()  # Gets the active view of the current document
boolean = BoolSelector(false)
create_annotation_tag = Custom[Create Annotation Tag](TagLocations=getLocation, TagType=type_2, Elements=all_elements_of_family_type, Views=activeViewFromCurrentDocument, RunIt=boolean)  # This node will create an annotation tag at a given location, of given type and in a supplied view. If only single view is supplied then all tags will be created in that view.
setRevitSelection = Custom[RIE.SetRevitSelection](Elements=create_annotation_tag)  # Input elements to select in Revit model
tag_host_element = Custom[Tag Host Element]()  # This node will retrieve an element that is hosting a given tag.; unwired: Tag
all_elements_in_active_view = ElementsInView()
byElementAndOffset = Tag.ByElementAndOffset()  # unwired: arg0, arg1
isTagged = Custom[Element.IsTagged]()  # Checks if all Elements are tagged in the project; unwired: Tags_of_Category, Elements_of_Category
activeView = Custom[Springs.Doc.ActiveView]()  # Selects the current document's active view. Supports more view types than the built-in option. Will be depreciated once the bult in node works with all plan types.
byElementAndLocation = Tag.ByElementAndLocation()  # unwired: view, element, location
tag_host_element_2 = Custom[Tag Host Element](Tag=type_2)
lunchbox_list_matcher = Custom[LunchBox List Matcher](ListA=all_elements_of_family_type, ListB=tag_host_element_2)  # Compares a List A against a List B and matches length of List A. If ListA > ListB, ListB will be extended. If ListA < ListB, ListB will be truncated.

# group: SELECT TAG TYPE
select_model_element_2 = DSModelElementSelection()  # 1 picked in the model

tag_get_location = Custom[Tag Get Location](tags=select_model_element_2)  # Returns the location of the tags
select_model_element_3 = DSModelElementSelection()  # 1 picked in the model
tag_get_location_2 = Custom[Tag Get Location](tags=select_model_element_3)
byElementAndOffset_2 = Tag.ByElementAndOffset()  # unwired: arg0, arg1
taggedElement = Tag.TaggedElement()  # unwired: arg0
isTagged_2 = Custom[Element.IsTagged]()  # unwired: Tags_of_Category, Elements_of_Category
