# Dynamo custom node TurnIntoList.dyf (Dynamo 1.3.2.2480)
# category: Clockwork.Core.List.Create
# Turns an element (or a nested list) into a flat list

unknownItem = Input()
create = List.Create(unknownItem)  # unwired: arg1
flatten = Flatten(create)
seq = Output(flatten)
