# Dynamo custom node View.DuplicateWithDetailing.dyf (Dynamo 1.3.2.2480)
# category: Clockwork.Revit.Views.View.Actions
# Duplicates a given view with detailing

view = Input()
turnIntoList = Custom[Turn Into List](unknownItem=view)  # Turns an element (or a nested list) into a flat list
python_script = Python(IN[0]=turnIntoList)  # unwired: IN[1]
# ---------- python_script.python (25 lines) ----------
import clr
clr.AddReference('RevitAPI')
from Autodesk.Revit.DB import *
import Autodesk

clr.AddReference("RevitServices")
import RevitServices
from RevitServices.Persistence import DocumentManager
from RevitServices.Transactions import TransactionManager

doc = DocumentManager.Instance.CurrentDBDocument
views = UnwrapElement(IN[0])
elementlist = list()
dupopt = Autodesk.Revit.DB.ViewDuplicateOption.WithDetailing

TransactionManager.Instance.EnsureInTransaction(doc)
for view in views:
	try:
		newview = view.Duplicate(dupopt)
		elementlist.append(doc.GetElement(newview))
	except:
		elementlist.append(None)
TransactionManager.Instance.TransactionTaskDone()
	
OUT = elementlist
# ----------------------------------------
returnListOrSingleValue = Custom[ReturnListOrSingleValue](unknownItem=view, seq=python_script)  # If the item in input #1 is not a list, only the first item of the list in input #2 will be returned.
view_2 = Output(returnListOrSingleValue)  # "view"
