# Dynamo graph boundingBoxByLevelsAndSectionBox rhythm.dyn (Dynamo 1.3.2.2480)

views = Views("{3D - dancleary21}")
parameters = Element.Parameters(views)
boundryBox = Custom[3DView.BoundryBox](3DView=views)  # Takes in a 3D View and outputs the views scope box as a boundry box
minPoint = BoundingBox.MinPoint(boundryBox)
X = Point.X(minPoint)
Y = Point.Y(minPoint)

# group: Lowest Level
levels = Levels("FIRST FLOOR")

elevation = Level.Elevation(levels)

# group: Feet Below
code_block = CodeBlock { 4; }

code_block_2 = CodeBlock(X=elevation, y=code_block) { X - y; }
byCoordinates = Point.ByCoordinates(x=X, y=Y, z=code_block_2)
maxPoint = BoundingBox.MaxPoint(boundryBox)
X_2 = Point.X(maxPoint)
Y_2 = Point.Y(maxPoint)

# group: Highest Level
levels_2 = Levels("SECOND FLOOR")

elevation_2 = Level.Elevation(levels_2)

# group: Feet Above
code_block_3 = CodeBlock { 4; }

code_block_4 = CodeBlock(X=elevation_2, y=code_block_3) { X + y; }
byCoordinates_2 = Point.ByCoordinates(x=X_2, y=Y_2, z=code_block_4)
byCorners = BoundingBox.ByCorners(min=byCoordinates, max=byCoordinates_2)
code_block_5 = CodeBlock(BoundingBox=byCorners) { BoundingBox; }
setSectionBox = RevitElements.View3D.SetSectionBox(arg1=code_block_5)  # unwired: arg0
views_2 = Views("3D VIEW")
code_block_6 = CodeBlock { "View Name"; }
getParameterValueByName = Element.GetParameterValueByName(element=views_2, parameterName=code_block_6)
name = Level.Name(levels)
code_block_7 = CodeBlock(X=getParameterValueByName, y=name) { X + " " + y; }
duplicateWithDetailing = Custom[View.DuplicateWithDetailing](view=views_2, name=code_block_7)  # Duplicates a given view with detailing
eq = code_block_5 == _  # unwired: arg1
code_block_8 = CodeBlock { "testo9"; }
