# Dynamo graph boundingBoxByLevelsAndSectionBox.dyn (Dynamo 1.3.2.2480)

views = Views("{3D - dancleary21}")
parameters = Element.Parameters(views)
code_block = CodeBlock { 1; }
code_block_2 = CodeBlock { 1; }
code_block_3 = CodeBlock { 1; }
boundingBox = Element.BoundingBox(views)
toCuboid = BoundingBox.ToCuboid(boundingBox)

# group: Obtrains the planes for the desired levels (clockwork)
levels = Levels("LOWER LEVEL")
plane = Custom[Level.Plane](level=levels)  # Retrieves the plane of a given level
levels_2 = Levels("FIRST FLOOR")
plane_2 = Custom[Level.Plane](level=levels_2)

# group: Generates the top and bottom curves to generate a new bounding box
intersect = Geometry.Intersect(geometry=toCuboid, other=plane)
perimeterCurves = Surface.PerimeterCurves(intersect)
pullOntoPlane = Curve.PullOntoPlane(curve=perimeterCurves, plane=plane_2)
create = List.Create(perimeterCurves, pullOntoPlane)
byJoinedCurves = PolyCurve.ByJoinedCurves(create)

# group: Generates a new bounding box for a view
flatten = Flatten(byJoinedCurves)
byLoft = Solid.ByLoft(flatten)
byGeometry = BoundingBox.ByGeometry(byLoft)

code_block_4 = CodeBlock { "TEST View2"; }

# group: Creates a new view rather than modifying original.
byCoordinates = Point.ByCoordinates(x=code_block, y=code_block_2, z=code_block_3)
byEyePointTargetAndBoundingBox = AxonometricView.ByEyePointTargetAndBoundingBox(byCoordinates, byCoordinates, byGeometry, code_block_4)

code_block_5 = CodeBlock { "Target Elevation"; }
getParameterValueByName = Element.GetParameterValueByName(element=views, parameterName=code_block_5)
setParameterByName = Element.SetParameterByName(element=byEyePointTargetAndBoundingBox, parameterName=code_block_5, value=getParameterValueByName)
intersect_2 = Geometry.Intersect()  # unwired: geometry, other
code_block_6 = CodeBlock { "Eye Elevation"; }
getParameterValueByName_2 = Element.GetParameterValueByName(element=views, parameterName=code_block_6)
setParameterByName_2 = Element.SetParameterByName(element=byEyePointTargetAndBoundingBox, parameterName=code_block_6, value=getParameterValueByName_2)
