# Dynamo graph circuitstest.dyn (Dynamo 1.3.2.2480)

select_model_elements = DSModelElementsSelection()
categories = Categories("ElectricalCircuit")
all_elements_of_category = ElementsOfCategory(categories)
code_block = CodeBlock(a=all_elements_of_category) { a[1]; }

# group: Move elements from existing to existing circuit. IN[0] = Elements IN[1] = move to this existing Electrical System
python_script = Python(IN[0]=select_model_elements, IN[1]=code_block)  # frozen
# ---------- python_script.python (48 lines) ----------
import clr
clr.AddReference('ProtoGeometry')
from Autodesk.DesignScript.Geometry import *

clr.AddReference('RevitServices')
import RevitServices
from RevitServices.Persistence import DocumentManager
from RevitServices.Transactions import TransactionManager
from System.Collections.Generic import *

clr.AddReference('RevitNodes')
import Revit
clr.ImportExtensions(Revit.Elements)

clr.AddReference('RevitAPI')
import Autodesk
from Autodesk.Revit.DB import *

clr.AddReference('DSCoreNodes')
import DSCore
from DSCore.List import *

import sys
pyt_path = r'C:\Program Files (x86)\IronPython 2.7\Lib'
sys.path.append(pyt_path)

#The inputs to this node will be stored as a list in the IN variables.
input = UnwrapElement(IN[0])
addto = UnwrapElement(IN[1])

doc = DocumentManager.Instance.CurrentDBDocument
uiapp = DocumentManager.Instance.CurrentUIApplication
app = uiapp.Application
uidoc = DocumentManager.Instance.CurrentUIApplication.ActiveUIDocument
OUT = []

elemSet = ElementSet()

for _ in input:
	elemSet.Insert(_)

OUT = input, addto

TransactionManager.Instance.EnsureInTransaction(doc)

addto.AddToCircuit(elemSet)
	
TransactionManager.Instance.TransactionTaskDone()
# ----------------------------------------

select_model_elements_2 = DSModelElementsSelection()
select_model_elements_3 = DSModelElementsSelection()
create = List.Create(select_model_elements_2, select_model_elements_3)

# group: Create new circuit on Panel and assign elementset to new circuit
python_script_2 = Python(IN[0]=create)
# ---------- python_script_2.python (62 lines) ----------
import clr
clr.AddReference('ProtoGeometry')
from Autodesk.DesignScript.Geometry import *

clr.AddReference('RevitServices')
import RevitServices
from RevitServices.Persistence import DocumentManager
from RevitServices.Transactions import TransactionManager
from System.Collections.Generic import *

clr.AddReference('RevitNodes')
import Revit
clr.ImportExtensions(Revit.Elements)

clr.AddReference('RevitAPI')
import Autodesk
from Autodesk.Revit.DB import *
from Autodesk.Revit.DB.Electrical import *
from Autodesk.Revit.DB import MEPSystem

clr.AddReference('DSCoreNodes')
import DSCore
from DSCore.List import *

import sys
pyt_path = r'C:\Program Files (x86)\IronPython 2.7\Lib'
sys.path.append(pyt_path)

# Import List ( ICollection(ElementId) = List[ElementId]() )
clr.AddReference("System")
from System.Collections.Generic import List 

#The inputs to this node will be stored as a list in the IN variables.
input = UnwrapElement(IN[0])

ElectComponents = []
NewCircuits = []

for sublist in input:
	sub = List[ElementId]()
	ElectComponents.append(sub)
	for item in sublist:
		sub.Add(item.Id)

doc = DocumentManager.Instance.CurrentDBDocument
uiapp = DocumentManager.Instance.CurrentUIApplication
app = uiapp.Application
uidoc = DocumentManager.Instance.CurrentUIApplication.ActiveUIDocument

ListNewCircuit = []

TransactionManager.Instance.EnsureInTransaction(doc)


for e in ElectComponents:
	NewCircuit =  doc.Create.NewElectricalSystem(e,ElectricalSystemType.PowerCircuit)
	ListNewCircuit.append(NewCircuit)


TransactionManager.Instance.TransactionTaskDone()

OUT = ListNewCircuit
# ----------------------------------------

select_panel = DSModelElementSelection()

# group: Select panel. IN[0] = Electrical System IN[1] = Panel element
python_script_3 = Python(IN[0]=python_script_2, IN[1]=select_panel)
# ---------- python_script_3.python (51 lines) ----------
import clr
clr.AddReference('ProtoGeometry')
from Autodesk.DesignScript.Geometry import *

clr.AddReference('RevitServices')
import RevitServices
from RevitServices.Persistence import DocumentManager
from RevitServices.Transactions import TransactionManager
from System.Collections.Generic import *

clr.AddReference('RevitNodes')
import Revit
clr.ImportExtensions(Revit.Elements)

clr.AddReference('RevitAPI')
import Autodesk
from Autodesk.Revit.DB import *
from Autodesk.Revit.DB.Electrical import *
from Autodesk.Revit.DB import MEPSystem

clr.AddReference('DSCoreNodes')
import DSCore
from DSCore.List import *

import sys
pyt_path = r'C:\Program Files (x86)\IronPython 2.7\Lib'
sys.path.append(pyt_path)

# Import List ( ICollection(ElementId) = List[ElementId]() )
clr.AddReference("System")
from System.Collections.Generic import List 


circuit = UnwrapElement(IN[0])
panel = UnwrapElement(IN[1])

doc = DocumentManager.Instance.CurrentDBDocument
uiapp = DocumentManager.Instance.CurrentUIApplication
app = uiapp.Application
uidoc = DocumentManager.Instance.CurrentUIApplication.ActiveUIDocument

TransactionManager.Instance.EnsureInTransaction(doc)

for _ in circuit:
	_.SelectPanel(panel)

TransactionManager.Instance.TransactionTaskDone()

#Assign your output to the OUT variable.
OUT = []
OUT = circuit, panel
# ----------------------------------------

code_block_2 = CodeBlock(a=python_script_3) { a[0]; }
select_model_elements_4 = DSModelElementsSelection()  # 3 picked in the model

# group: Create new circuit on Panel and assign elementset to new circuit
python_script_4 = Python(IN[0]=select_model_elements_4)
# ---------- python_script_4.python (56 lines) ----------
import clr
clr.AddReference('ProtoGeometry')
from Autodesk.DesignScript.Geometry import *

clr.AddReference('RevitServices')
import RevitServices
from RevitServices.Persistence import DocumentManager
from RevitServices.Transactions import TransactionManager
from System.Collections.Generic import *

clr.AddReference('RevitNodes')
import Revit
clr.ImportExtensions(Revit.Elements)

clr.AddReference('RevitAPI')
import Autodesk
from Autodesk.Revit.DB import *
from Autodesk.Revit.DB.Electrical import *
from Autodesk.Revit.DB import MEPSystem

clr.AddReference('DSCoreNodes')
import DSCore
from DSCore.List import *

import sys
pyt_path = r'C:\Program Files (x86)\IronPython 2.7\Lib'
sys.path.append(pyt_path)

# Import List ( ICollection(ElementId) = List[ElementId]() )
clr.AddReference("System")
from System.Collections.Generic import List 

#The inputs to this node will be stored as a list in the IN variables.
input = UnwrapElement(IN[0])

electComponents = List[ElementId]()


for i in input:
	electComponents.Add(i.Id)


doc = DocumentManager.Instance.CurrentDBDocument
uiapp = DocumentManager.Instance.CurrentUIApplication
app = uiapp.Application
uidoc = DocumentManager.Instance.CurrentUIApplication.ActiveUIDocument

TransactionManager.Instance.EnsureInTransaction(doc)

newcircuit =  doc.Create.NewElectricalSystem(electComponents, ElectricalSystemType.PowerCircuit)

OUT = []
OUT.append(newcircuit)


TransactionManager.Instance.TransactionTaskDone()
# ----------------------------------------

select_panel_2 = DSModelElementSelection()  # 1 picked in the model
python_script_5 = Python(IN[0]=python_script_4, IN[1]=select_panel_2)  # same code as python_script_3
code_block_3 = CodeBlock(a=python_script_5) { a[0]; }
join = List.Join(code_block_2, code_block_3)
activeView = Custom[Springs.Doc.ActiveView]()  # Selects the current document's active view. Supports more view types than the built-in option. Will be depreciated once the bult in node works with all plan types.

# group: Generate Wires for electrical systems
python_script_6 = Python(IN[0]=join, IN[1]=activeView)
# ---------- python_script_6.python (45 lines) ----------
import clr
clr.AddReference('ProtoGeometry')
from Autodesk.DesignScript.Geometry import *

clr.AddReference('RevitServices')
import RevitServices
from RevitServices.Persistence import DocumentManager
from RevitServices.Transactions import TransactionManager
from System.Collections.Generic import *

clr.AddReference('RevitNodes')
import Revit
clr.ImportExtensions(Revit.Elements)

clr.AddReference('RevitAPI')
import Autodesk
from Autodesk.Revit.DB import *
from Autodesk.Revit.DB.Electrical import *

clr.AddReference('DSCoreNodes')
import DSCore
from DSCore.List import *

import sys
pyt_path = r'C:\Program Files (x86)\IronPython 2.7\Lib'
sys.path.append(pyt_path)

#The inputs to this node will be stored as a list in the IN variables.
addto = UnwrapElement(IN[0])
view = UnwrapElement(IN[1])

doc = DocumentManager.Instance.CurrentDBDocument
uiapp = DocumentManager.Instance.CurrentUIApplication
app = uiapp.Application
uidoc = DocumentManager.Instance.CurrentUIApplication.ActiveUIDocument

OUT = []
OUT = input, addto

TransactionManager.Instance.EnsureInTransaction(doc)

for _ in addto:
	_.NewWires(view, WiringType.Arc)
	
TransactionManager.Instance.TransactionTaskDone()
# ----------------------------------------

sublists = List.Sublists()  # unwired: list, ranges, offset
python_script_7 = Python()  # unwired: IN[0]
# ---------- python_script_7.python (61 lines) ----------
import clr
clr.AddReference('ProtoGeometry')
from Autodesk.DesignScript.Geometry import *

clr.AddReference('RevitServices')
import RevitServices
from RevitServices.Persistence import DocumentManager
from RevitServices.Transactions import TransactionManager
from System.Collections.Generic import *

clr.AddReference('RevitNodes')
import Revit
clr.ImportExtensions(Revit.Elements)

clr.AddReference('RevitAPI')
import Autodesk
from Autodesk.Revit.DB import *
from Autodesk.Revit.DB.Electrical import *
from Autodesk.Revit.DB import MEPSystem

clr.AddReference('DSCoreNodes')
import DSCore
from DSCore.List import *

import sys
pyt_path = r'C:\Program Files (x86)\IronPython 2.7\Lib'
sys.path.append(pyt_path)

# Import List ( ICollection(ElementId) = List[ElementId]() )
clr.AddReference("System")
from System.Collections.Generic import List 

#The inputs to this node will be stored as a list in the IN variables.
input = UnwrapElement(IN[0])

electComponents = List[ElementId]()



for each i in input:

    electComponents = ListElementId

    for each item in i:
        electComponents.Add(item.Id)


doc = DocumentManager.Instance.CurrentDBDocument
uiapp = DocumentManager.Instance.CurrentUIApplication
app = uiapp.Application
uidoc = DocumentManager.Instance.CurrentUIApplication.ActiveUIDocument

TransactionManager.Instance.EnsureInTransaction(doc)

newcircuit =  doc.Create.NewElectricalSystem(electComponents, ElectricalSystemType.PowerCircuit)

OUT = []
OUT.append(newcircuit)


TransactionManager.Instance.TransactionTaskDone()
# ----------------------------------------
diagonalRight = List.DiagonalRight()  # unwired: arg0, arg1
valueByRowAndColumn = archilab.Csv.Csv.ValueByRowAndColumn()  # unwired: arg0, arg1, arg2
