# Dynamo graph copy.dyn (Dynamo 1.3.2.2480)

select_model_elements = DSModelElementsSelection()  # 3 picked in the model
watch = Watch(select_model_elements)
getCategory = Element.GetCategory(watch)
uniqueItems = List.UniqueItems(getCategory)
string_from_object = FromObject(uniqueItems)
code_block = CodeBlock { -1; }
code_block_2 = CodeBlock { 1; }
remove = String.Remove(str=string_from_object, startIndex=code_block, count=code_block_2)
sortDuplicateStrings = Lists.Strings.SortDuplicateStrings(remove)
code_block_3 = CodeBlock { " Tags"; }
add = sortDuplicateStrings + code_block_3
byName = Category.ByName(add@L1)
all_elements_of_category = ElementsOfCategory(byName)
flatten = Flatten(all_elements_of_category@L1)

# group: Obtain all the elements the tags are tagging and their element id
taggedElement = Tag.TaggedElement(flatten)
id = Element.Id(taggedElement)

# group: Group the tags by the element ids (this is for when something is tagged multiple times or in multiple views)
groupByKey = List.GroupByKey(list=flatten, keys=id)

# group: Dictionaries provide a way to look stuff up by a given key
code_block_4 = CodeBlock(taggedElement=groupByKey.groups, tag=groupByKey.unique_keys)
# ---------- code_block_4.designscript (4 lines) ----------
//declare a new dictionary to store this in
tagDictionary = {};
//dictionary[whatToLookUpBy] = tagElement
tagDictionary[taggedElement] = tag;
# ----------------------------------------

# group: Sample element selected manually to get the tags for
id_2 = Element.Id(watch)

# group: Retrieve the related tags for the given element from the dictionary
code_block_5 = CodeBlock(tagDictionary=code_block_4.tagDictionary, taggedElement=id_2) { tagDictionary[taggedElement]; }

select_model_element = DSModelElementSelection()  # 1 picked in the model
watch_2 = Watch()  # unwired: arg0
