# Dynamo graph get location.dyn (Dynamo 1.3.2.2480)

select_model_elements = DSModelElementsSelection()  # 4 picked in the model
curve = DetailCurve.Curve(select_model_elements)
flatten = Flatten(curve)
intersectionsFromListOfLines = Custom[RIE.IntersectionsFromListOfLines](Lines=flatten)  # Outputs points on which lines in a list intersect
code_block = CodeBlock { 0; }
getItemAtIndex = List.GetItemAtIndex(list=select_model_elements, index=code_block)
intersect = Geometry.Intersect(geometry=getItemAtIndex, other=select_model_elements)
solidIntersection = Curve.SolidIntersection()  # unwired: arg0, arg1

# group: New and Improved
python_script = Python(IN[0]=curve)
# ---------- python_script.python (51 lines) ----------
import clr
clr.AddReference("ProtoGeometry")
from Autodesk.DesignScript.Geometry import *
clr.AddReference('DSCoreNodes') 
import DSCore
from DSCore import *


#The inputs to this node will be stored as a list in the IN variables.
if isinstance(IN[0], list):
    lines = UnwrapElement(IN[0])
else:
    lines = [UnwrapElement(IN[0])]

OUT = []
pershape = []

def line_intersects(p1sp,p1ep,p2sp,p2ep):
	xdiff = (p1sp.X - p1ep.X, p2sp.X - p2ep.X)
	ydiff = (p1sp.Y - p1ep.Y, p2sp.Y - p2ep.Y)
	
	def det(a1,a2,b1,b2):
		return a1 * b2 - a2 * b1
	
	div = det(xdiff[0],xdiff[1],ydiff[0],ydiff[1])
	if div <> 0:
		d = (det(p1sp.X,p1sp.Y,p1ep.X,p1ep.Y), det(p2sp.X,p2sp.Y,p2ep.X,p2ep.Y))
		x = det(d[0],d[1], xdiff[0],xdiff[1]) / div
		y = det(d[0],d[1], ydiff[0],ydiff[1]) / div
		if x > p1sp.X and x < p1ep.X and y > p2sp.Y and y < p2ep.Y:
			return Point.ByCoordinates(x,y)
for f in range(0, len(lines)):			
	for l1 in lines:
		p1sp = l1.StartPoint 
		p1ep = l1.EndPoint
		data = []
		for l2 in lines:
			if l1 != l2:
				p2sp = l2.StartPoint
				p2ep = l2.EndPoint
				if  p1sp.X < p2sp.X and p1ep.X > p2ep.X  or p1sp.Y > p2sp.Y and p1ep.Y < p2ep.Y:
					if not (line_intersects(p1sp,p1ep,p2sp,p2ep) is None):
						data.append(line_intersects(p1sp,p1ep,p2sp,p2ep))
		if len(data) > 0:
			pershape.append(data)
	if len(pershape) > 0:
		OUT.append(pershape)
		pershape = []
	else:
		OUT.append('No intersections found')
		pershape = []
# ----------------------------------------

python_script_2 = Python()  # unwired: IN[0]; starter script, not edited (OUT = 0)
