# Dynamo graph groupConduits.dyn (Dynamo 1.3.2.2480)

# group: Get all Conduit Fittings and their curves
categories = Categories("ConduitFitting")
all_elements_of_category = ElementsOfCategory(categories)

# group: Get all Conduits and their location lines
categories_2 = Categories("Conduit")
all_elements_of_category_2 = ElementsOfCategory(categories_2)
