# Dynamo graph tagging panels.dyn (Dynamo 1.3.2.2480)

family_types = FamilyTypes("ID LIGHTS (SQUARE):2 x 4 LP4")
all_elements_of_family_type = Custom[All Elements of Family Type+](familyType=family_types)  # Unlike the built-in node, this node retrieves all placed instances of a given loadable *or* system family type
location = FamilyInstance.Location(all_elements_of_family_type)
code_block = CodeBlock { 1; }
cycle = List.Cycle(list=location, amount=code_block)
family_types_2 = FamilyTypes("ID LITE FIXTURE TAG:LIGHT FIXTURE TYPE")
views = Views("FIRST FLOOR - LIGHTING - TAG DEMO")
boolean = BoolSelector(true)
create_annotation_tag = Custom[Create Annotation Tag](TagLocations=cycle, TagType=family_types_2, Elements=all_elements_of_family_type, Views=views, RunIt=boolean)  # This node will create an annotation tag at a given location, of given type and in a supplied view. If only single view is supplied then all tags will be created in that view.
watch = Watch(location)
cycle_2 = List.Cycle()  # unwired: list, amount
number = DoubleInput(100)
current = Document.Current()
activeView = Document.ActiveView(current)
code_block_2 = CodeBlock(IN=activeView) { {IN}; }
views_2 = Views("Project View")
create = List.Create(family_types_2)
code_block_3 = CodeBlock { 25; }
cycle_3 = List.Cycle(list=create, amount=code_block_3)
categories = Categories("LightingFixtures")
all_elements_of_category = ElementsOfCategory(categories)
code_block_4 = CodeBlock { 22..23; }
removeItemAtIndex = List.RemoveItemAtIndex(list=all_elements_of_category, indices=code_block_4)
code_block_5 = CodeBlock { 0; }
getItemAtIndex = List.GetItemAtIndex(list=removeItemAtIndex, index=code_block_5)
all_elements_of_type = ElementsOfType(family_types)
